vi "Enable Remote Sensing.gvi"   [LabVIEW NXG 5.0.0]
# Enables Remote (4-wire) sensing.  This type of sensing allows the instrument to bypass the input and output leads and make a more accurate measurement at the device under test.  This also allows the source to adjust its voltage so that the desired voltage is located at the sensing leads, not at the input and output jacks.
inputs:
  "VISA resource name": "VISA Instr", required
    # A reference to the instrument in use.  The reference to the resource name is created in the Initialize VI.  Therefore, before calling this VI, you need to call the Initialize VI.  To run this VI interactively, select the previously initialized resource name from the pull-down menu.  To run this VI programmatically, wire the VISA resource name out terminal of the Initialize VI to subsequent VISA resource name input terminals.  You chain instrument driver VIs together by wiring the VISA resource name out terminal to subsequent VISA resource name input terminals.
  "Enable Remote Sensing (T: Enable)": bool = TRUE  # Enable Remote (4-wire) sensing on the instrument. Note: This setting may cause the voltage source to move into compliance if the sensing wires are not properly used and the output is enabled.
  "Function (0:Voltage)": u16 = "Voltage"(0)  # This selects the function that remote sensing settings will apply to. The Digitizer Voltage and Digitizer Current functions are only compatible with the 2461.
  "error in (no error)": error
outputs:
  "VISA resource name out": "VISA Instr"  # A copy of the reference to the instrument in use. The reference to the resource name is created in the Initialize VI. Wire the VISA resource name out terminal of the Initialize VI to subsequent VISA resource name input terminals. You chain instrument driver VIs together by wiring the VISA resource name out terminal to subsequent VISA resource name input terminals.
  "error out": error
uses:
  NI::G Core::Strings::Append True Or False String.gvi
  NI::VISA::Write (Instr, String).gvi
  Labview_NXG_Keithley_SMU_2450_2460_2461::Utility::Error Query.gvi
diagram:
  # SCPI 2450
  Pick Line(line index=$"Function (0:Voltage)", multi-line string=":VOLT\n:CURR\n:RES\n:DIG:VOLT\n:DIG:CURR") -> (output string=w1)
  call "Append True Or False String.gvi"(string=w1, true string=":RSEN ON;", false string=":RSEN OFF;", selector=$"Enable Remote Sensing (T: Enable)") -> (output string=w2)
  call "Write (Instr, String).gvi"(session in=$"VISA resource name", error in=$"error in (no error)", write buffer=w2) -> (session out=w3, error out=w4)
  call "Error Query.gvi"(VISA resource name=w3, error in (no error)=w4) -> (VISA resource name out=w5, error out=w6)
  $"VISA resource name out" <- w5
  $"error out" <- w6
