vi "Get Digital IO Pins Mode.gvi"   [LabVIEW NXG 5.0.0]
# This VI gets the digital I/O line state of the selected line.
inputs:
  "VISA resource name": "VISA Instr", required
    # A reference to the instrument in use.  The reference to the resource name is created in the Initialize VI.  Therefore, before calling this VI, you need to call the Initialize VI.  To run this VI interactively, select the previously initialized resource name from the pull-down menu.  To run this VI programmatically, wire the VISA resource name out terminal of the Initialize VI to subsequent VISA resource name input terminals.  You chain instrument driver VIs together by wiring the VISA resource name out terminal to subsequent VISA resource name input terminals.
  "Digital IO Line (1)": u32 = 1  # The Digital I/O line to query for its state.
  "error in (no error)": error
outputs:
  "VISA resource name out": "VISA Instr"  # A copy of the reference to the instrument in use. The reference to the resource name is created in the Initialize VI. Wire the VISA resource name out terminal of the Initialize VI to subsequent VISA resource name input terminals. You chain instrument driver VIs together by wiring the VISA resource name out terminal to subsequent VISA resource name input terminals.
  "Digital I/O State?": string
    # IN Detects falling-edge, rising-edge, or either-edge triggers as input.
    # OUT Generates a positive or negative edge for output when requested.
    # OPENdrain Configures the line to be an open-drain signal (makes the line a digital open-drain line with 100 k pull-up resistor). When used with <triggerType> set to TRIGger, this values uses the edge setting as IN.
    # ACCeptor Use this value only with the SYNChronous trigger type. This value detects a falling-edge as an input trigger and automatically latches and drives the trigger line low. Asserting the output trigger releases the latched line. Detects a falling-edge input pulse.
    # MASTer Use this value only with the SYNChronous trigger type. This value detects a rising-edge triggers as an input. Asserts a TTL-low pulse for output. Detects a rising-edge input pulse.
  "error out": error
uses:
  NI::VISA::Write (Instr, String).gvi
  NI::VISA::Read (Instr, String).gvi
  Labview_NXG_Keithley_SMU_2450_2460_2461::Utility::Error Query.gvi
diagram:
  Format Into String(formatString=":DIG:LINE%d:MODE?", $"Digital IO Line (1)") -> w1
  call "Write (Instr, String).gvi"(session in=$"VISA resource name", error in=$"error in (no error)", write buffer=w1) -> (session out=w2, error out=w3)
  call "Read (Instr, String).gvi"(session in=w2, error in=w3, byte count=128) -> (session out=w4, error out=w5, read buffer=w6)
  $"Digital I/O State?" <- w6
  call "Error Query.gvi"(VISA resource name=w4, error in (no error)=w5) -> (VISA resource name out=w7, error out=w8)
  $"VISA resource name out" <- w7
  $"error out" <- w8
