vi "In Compliance Query.gvi"   [LabVIEW NXG 5.0.0]
# Queries the instrument to determine if source is in current or voltage compliance.
inputs:
  "VISA resource name": "VISA Instr", required
    # A reference to the instrument in use.  The reference to the resource name is created in the Initialize VI.  Therefore, before calling this VI, you need to call the Initialize VI.  To run this VI interactively, select the previously initialized resource name from the pull-down menu.  To run this VI programmatically, wire the VISA resource name out terminal of the Initialize VI to subsequent VISA resource name input terminals.  You chain instrument driver VIs together by wiring the VISA resource name out terminal to subsequent VISA resource name input terminals.
  "error in (no error)": error
outputs:
  "VISA resource name out": "VISA Instr"  # A copy of the reference to the instrument in use. The reference to the resource name is created in the Initialize VI. Wire the VISA resource name out terminal of the Initialize VI to subsequent VISA resource name input terminals. You chain instrument driver VIs together by wiring the VISA resource name out terminal to subsequent VISA resource name input terminals.
  "Voltage Source": bool  # Indicates whether or not the source exceeded the current limits. True: In compliance. False: Not in compliance.
  "Current Source": bool  # Indicates whether or not the source has exceeded the voltage limits. True: In compliance. False: Not in compliance.
  "error out": error
uses:
  NI::VISA::Write (Instr, String).gvi
  NI::VISA::Read (Instr, String).gvi
  Labview_NXG_Keithley_SMU_2450_2460_2461::Utility::Error Query.gvi
diagram:
  call "Write (Instr, String).gvi"(session in=$"VISA resource name", error in=$"error in (no error)", write buffer=":SOUR:CURR:VLIM:TRIP?") -> (session out=w1, error out=w2)
  call "Read (Instr, String).gvi"(session in=w1, error in=w2, byte count=128) -> (session out=w3, error out=w4, read buffer=w5)
  Is Equal(x=w5, y="1\n") -> w6
  $"Voltage Source" <- w6
  call "Write (Instr, String).gvi"(session in=w3, error in=w4, write buffer=":SOUR:VOLT:ILIM:TRIP?") -> (session out=w7, error out=w8)
  call "Read (Instr, String).gvi"(session in=w7, error in=w8, byte count=128) -> (session out=w9, read buffer=w10)
  Is Equal(x=w10, y="1\n") -> w11
  $"Current Source" <- w11
  call "Error Query.gvi"(VISA resource name=w9) -> (VISA resource name out=w12, error out=w13)
  $"VISA resource name out" <- w12
  $"error out" <- w13
