vi "Set Digital IO Mode.gvi"   [LabVIEW NXG 5.0.0]
# Sets the digital I/O line to be a digital line or trigger model line and sets the line as an input or output. You can also use this VI to configure synchronous triggering modes.
inputs:
  "Digital IO Mode (0: IN)": enum{"Input", "Output", "Open Drain", ""} = "Input"  # Sets the digital I/O line as an input or output or Open-Drain.
  "VISA resource name": "VISA Instr", required
    # A reference to the instrument in use.  The reference to the resource name is created in the Initialize VI.  Therefore, before calling this VI, you need to call the Initialize VI.  To run this VI interactively, select the previously initialized resource name from the pull-down menu.  To run this VI programmatically, wire the VISA resource name out terminal of the Initialize VI to subsequent VISA resource name input terminals.  You chain instrument driver VIs together by wiring the VISA resource name out terminal to subsequent VISA resource name input terminals.
  "Digital IO Line (1)": u32 = 1  # Digital I/O trigger line (1 to 6).
  "Digital IO Trigger Type (0: Digital)": enum{"Digital", "Trigger"} = "Digital"  # Sets the digital I/O line to be a digital line or trigger model line
  "error in (no error)": error
outputs:
  "VISA resource name out": "VISA Instr"  # A copy of the reference to the instrument in use. The reference to the resource name is created in the Initialize VI. Wire the VISA resource name out terminal of the Initialize VI to subsequent VISA resource name input terminals. You chain instrument driver VIs together by wiring the VISA resource name out terminal to subsequent VISA resource name input terminals.
  "error out": error
uses:
  NI::VISA::Write (Instr, String).gvi
  Labview_NXG_Keithley_SMU_2450_2460_2461::Utility::Error Query.gvi
diagram:
  Format Into String(formatString=":DIG:LINE%d:MODE ", $"Digital IO Line (1)") -> w1
  Pick Line(line index=$"Digital IO Trigger Type (0: Digital)", multi-line string="DIG,\nTRIG,", string=w1) -> (output string=w2)
  Pick Line(line index=$"Digital IO Mode (0: IN)", multi-line string="IN\nOUT\nOPEN", string=w2) -> (output string=w3)
  call "Write (Instr, String).gvi"(session in=$"VISA resource name", error in=$"error in (no error)", write buffer=w3) -> (session out=w4, error out=w5)
  call "Error Query.gvi"(VISA resource name=w4, error in (no error)=w5) -> (VISA resource name out=w6, error out=w7)
  $"VISA resource name out" <- w6
  $"error out" <- w7
