vi "Append Buffer to File in the USB.gvi"   [LabVIEW NXG 5.0.0]
# This VI appends data from the reading buffer to a file on the USB flash drive.
inputs:
  "Start": i32  # The starting point in the buffer to start saving data.
  "End": i32  # The ending point in the buffer to stop saving data.
  "VISA resource name": "VISA Instr", required
    # A reference to the instrument in use.  The reference to the resource name is created in the Initialize VI.  Therefore, before calling this VI, you need to call the Initialize VI.  To run this VI interactively, select the previously initialized resource name from the pull-down menu.  To run this VI programmatically, wire the VISA resource name out terminal of the Initialize VI to subsequent VISA resource name input terminals.  You chain instrument driver VIs together by wiring the VISA resource name out terminal to subsequent VISA resource name input terminals.
  "Buffer Name (defbuffer1)": string = "defbuffer1"  # A string that indicates the reading buffer; the default buffers (defbuffer1 or defbuffer2) or the name of a user-defined buffer; if no buffer is specified, this parameter defaults to defbuffer1.
  "File Name": string  # The file name that the reading buffer data will be appended to. This file must exist on the USB drive or the operation will fail.
  "Time Format": u16 = "Format"(0)  # Time format defines how date and time information from the buffer is saved in the file; the values are: • Dates, times, and fractional seconds are saved; the default value: FORMat • Relative time stamps are saved: RELative • Seconds and fractional seconds are saved: RAW • Time stamps are saved: STAMp
  "error in (no error)": error
  "Enable Time Format (F:Disable)": bool  # This will enable the export of the time format along with the measurement data.
  "Enable Start & End (F:Disable)": bool  # This will allow export of the reading buffer data at a specified index range.
outputs:
  "VISA resource name out": "VISA Instr"  # A copy of the reference to the instrument in use. The reference to the resource name is created in the Initialize VI. Wire the VISA resource name out terminal of the Initialize VI to subsequent VISA resource name input terminals. You chain instrument driver VIs together by wiring the VISA resource name out terminal to subsequent VISA resource name input terminals.
  "error out": error
uses:
  NI::VISA::Write (Instr, String).gvi
  Labview_NXG_Keithley_SMU_2450_2460_2461::Utility::Error Query.gvi
diagram:
  Logical And($"Enable Time Format (F:Disable)", $"Enable Start & End (F:Disable)") -> w1
  Is Equal(x="", y=$"Buffer Name (defbuffer1)") -> w2
  Select(s=w2, t="defbuffer1", f=$"Buffer Name (defbuffer1)") -> w3
  Format Into String(formatString="TRAC:SAVE:APP \"/usb1/%s\",\"%s\"", $"File Name", w3) -> w4
  case ($"Enable Time Format (F:Disable)") {
    frame False, Default {
      w5 = w4
    }
    frame True {
      Pick Line(line index=$"Time Format", multi-line string=",FORM\n,REL\n,RAW\n,STAM", string=w4) -> (output string=w5)
    }
  }
  case (w1) {
    frame False, Default {
      w6 = w5
    }
    frame True {
      Format Into String(formatString=",%d,%d", initString=w5, $Start, $End) -> w6
    }
  }
  call "Write (Instr, String).gvi"(session in=$"VISA resource name", error in=$"error in (no error)", write buffer=w6) -> (session out=w7, error out=w8)
  call "Error Query.gvi"(VISA resource name=w7, error in (no error)=w8) -> (VISA resource name out=w9, error out=w10)
  $"VISA resource name out" <- w9
  $"error out" <- w10
