vi "Clear Trigger timer.gvi"   [LabVIEW NXG 5.0.0]
# This VI clears the timer event detector and overrun indicator for the specified trigger timer number.
inputs:
  "VISA resource name": "VISA Instr", required
    # A reference to the instrument in use.  The reference to the resource name is created in the Initialize VI.  Therefore, before calling this VI, you need to call the Initialize VI.  To run this VI interactively, select the previously initialized resource name from the pull-down menu.  To run this VI programmatically, wire the VISA resource name out terminal of the Initialize VI to subsequent VISA resource name input terminals.  You chain instrument driver VIs together by wiring the VISA resource name out terminal to subsequent VISA resource name input terminals.
  "Timer (1)": i32 = 1  # The number of triggers to be performed for each trigger arming. Trigger timer number (1 to 4).
  "error in (no error)": error
outputs:
  "VISA resource name out": "VISA Instr"  # A copy of the reference to the instrument in use. The reference to the resource name is created in the Initialize VI. Wire the VISA resource name out terminal of the Initialize VI to subsequent VISA resource name input terminals. You chain instrument driver VIs together by wiring the VISA resource name out terminal to subsequent VISA resource name input terminals.
  "error out": error
uses:
  NI::VISA::Write (Instr, String).gvi
  Labview_NXG_Keithley_SMU_2450_2460_2461::Utility::Error Query.gvi
diagram:
  # :TRIGger:BLOCk:BUFFer:CLEar <blockNumber>, <bufferName>
  # TRIGger:BLOCk:MEASure <blockNumber>, <bufferName>
  # :TRIGger:BLOCk:CONFig:NEXT <blockNumber>, <configurationList>
  # :TRIGger:BLOCk:CONFig:PREVious <blockNumber>, <configurationList>
  # :TRIGger:BLOCk:CONFig:RECall <blockNumber>, <configurationList>
  # :TRIGger:BLOCk:DELay:DYNamic <blockNumber>, <configList> or <user delay>
  # :TRIGger:BLOCk:DELay <blockNumber>, <time>
  # :TRIGger:BLOCk:SOURce:STATe <blockNumber>, <state>
  # :TRIGger:BLOCk:BRANch:DELTa <blockNumber>, <targetDifference>, <branchPath>, <measureBlock>
  # :TRIGger:TIMer<n>:CLEar
  Format Into String(formatString=":TRIG:TIM%d:CLE;", initString="", $"Timer (1)") -> w1
  # :TRIGger:BLOCk:BRANch:ALWays <blockNumber>, <branchPath>
  # :TRIGger:BLOCk:BRANch:ONCE <blockNumber>, <branchPath>
  # :TRIGger:BLOCk:BRANch:ONCE:EXCLuded <blockNumber>, <branchPath>
  call "Write (Instr, String).gvi"(session in=$"VISA resource name", error in=$"error in (no error)", write buffer=w1) -> (session out=w2, error out=w3)
  call "Error Query.gvi"(VISA resource name=w2, error in (no error)=w3) -> (VISA resource name out=w4, error out=w5)
  $"VISA resource name out" <- w4
  $"error out" <- w5
