vi "Configure Contact Check.gvi"   [LabVIEW NXG 5.0.0]
# Use this command to enable or disable the contact check function.
# The Digitizer Voltage and Digitizer Current functions are only compatible with the 2461.
inputs:
  "VISA resource name": "VISA Instr" = "USB0::0x05E6::0x2461::04090176::INSTR"
    # A reference to the instrument in use.  The reference to the resource name is created in the Initialize VI.  Therefore, before calling this VI, you need to call the Initialize VI.  To run this VI interactively, select the previously initialized resource name from the pull-down menu.  To run this VI programmatically, wire the VISA resource name out terminal of the Initialize VI to subsequent VISA resource name input terminals.  You chain instrument driver VIs together by wiring the VISA resource name out terminal to subsequent VISA resource name input terminals.
  "Threshold (2: OHM50)": u16 = "OHM50"(2)  # This attribute sets the threshold value for contact resistance for the contact check status functions.
  "Contact Check On (T:OFF)": bool  # Turns the contact check function On or Off.
  "error in (no error)": error
outputs:
  "VISA resource name out": "VISA Instr"  # A copy of the reference to the instrument in use. The reference to the resource name is created in the Initialize VI. Wire the VISA resource name out terminal of the Initialize VI to subsequent VISA resource name input terminals. You chain instrument driver VIs together by wiring the VISA resource name out terminal to subsequent VISA resource name input terminals.
  "error out": error
uses:
  NI::G Core::Strings::Append True Or False String.gvi
  NI::VISA::Write (Instr, String).gvi
  Labview_NXG_Keithley_SMU_2450_2460_2461::Utility::Error Query.gvi
diagram:
  Pick Line(line index=$"Threshold (2: OHM50)", multi-line string="OHM2;\nOHM15; \nOHM50; ", string=":SYSTem:CCHeck:THReshold ") -> (output string=w1)
  call "Append True Or False String.gvi"(string=":SYSTem:CCHeck:STATe ", true string="on; ", false string="off; ", selector=$"Contact Check On (T:OFF)") -> (output string=w2)
  Concatenate Strings(w1, w2) -> w3
  call "Write (Instr, String).gvi"(session in=$"VISA resource name", error in=$"error in (no error)", write buffer=w3) -> (session out=w4, error out=w5)
  call "Error Query.gvi"(VISA resource name=w4, error in (no error)=w5) -> (VISA resource name out=w6, error out=w7)
  $"VISA resource name out" <- w6
  $"error out" <- w7
