vi "Configure Digits for Display.gvi"   [LabVIEW NXG 5.0.0]
# Determines the number of digits that are displayed for measurements.
# The Digitize Voltage and Digitize Current functions are only valid on the 2461
inputs:
  "VISA resource name": "VISA Instr" = "USB0::0x05E6::0x2461::04090176::INSTR", required
    # A reference to the instrument in use.  The reference to the resource name is created in the Initialize VI.  Therefore, before calling this VI, you need to call the Initialize VI.  To run this VI interactively, select the previously initialized resource name from the pull-down menu.  To run this VI programmatically, wire the VISA resource name out terminal of the Initialize VI to subsequent VISA resource name input terminals.  You chain instrument driver VIs together by wiring the VISA resource name out terminal to subsequent VISA resource name input terminals.
  "Function (0: Volts)": u16 = "Volts"(0)  # The function on which to configure digits for display. Note: Voltage, Current, and Resistance measurements are always taken regardless of any VI calls, except when selecting a digitizer function. The Digitize Voltage and Digitize Current functions are only compatible with the 2461.
  "Display Digits (3)": u32 = 3  # The number of digits that are displayed for measurements on the front panel. It takes these values. 3: 3.5 digit resolution 4: 4.5 digit resolution 5: 5.5 digit resolution 6: 6.5 digit resolution
  "error in (no error)": error
outputs:
  "VISA resource name out": "VISA Instr"  # A copy of the reference to the instrument in use. The reference to the resource name is created in the Initialize VI. Wire the VISA resource name out terminal of the Initialize VI to subsequent VISA resource name input terminals. You chain instrument driver VIs together by wiring the VISA resource name out terminal to subsequent VISA resource name input terminals.
  "error out": error
uses:
  NI::VISA::Write (Instr, String).gvi
  Labview_NXG_Keithley_SMU_2450_2460_2461::Utility::Error Query.gvi
diagram:
  Pick Line(line index=$"Function (0: Volts)", multi-line string="VOLT\nCURR\nRES\nDIG:VOLT\nDIG:CURR") -> (output string=w1)
  Format Into String(formatString=":DISP:%s:DIG %d;", w1, $"Display Digits (3)") -> w2
  call "Write (Instr, String).gvi"(session in=$"VISA resource name", error in=$"error in (no error)", write buffer=w2) -> (session out=w3, error out=w4)
  call "Error Query.gvi"(VISA resource name=w3, error in (no error)=w4) -> (VISA resource name out=w5, error out=w6)
  $"VISA resource name out" <- w5
  $"error out" <- w6
