vi "Configure Filter.gvi"   [LabVIEW NXG 5.0.0]
# Configures the measurement filter, including the number of readings averaged the type of filter applied.
inputs:
  "VISA resource name": "VISA Instr"
    # A reference to the instrument in use.  The reference to the resource name is created in the Initialize VI.  Therefore, before calling this VI, you need to call the Initialize VI.  To run this VI interactively, select the previously initialized resource name from the pull-down menu.  To run this VI programmatically, wire the VISA resource name out terminal of the Initialize VI to subsequent VISA resource name input terminals.  You chain instrument driver VIs together by wiring the VISA resource name out terminal to subsequent VISA resource name input terminals.
  "Function (0: Volts)": u16 = "Volts"(0)  # The function on which to configure measurement settings. Note: Voltage, Current, and Resistance measurements are always taken regardless of any VI calls.
  "Enable Filter (T: Enable)": bool = TRUE  # Enables or disables the measurement filter. The filter will slow down instrument operation but allow for more accurate measurements.
  "Filter Type (0: Repeating)": u16 = "Repeating"(0)  # The type of filter to be applied. The repeating filter averages a given amount of measurements and returns the result. The moving filter is faster, but achieves this speed by only taking a single new measurement and averaging the measurements in memory.
  "Number of Filter Readings (3)": u32 = 10  # The number of readings to apply in the filter.,1-100.
  "error in (no error)": error
outputs:
  "VISA resource name out": "VISA Instr"  # A copy of the reference to the instrument in use. The reference to the resource name is created in the Initialize VI. Wire the VISA resource name out terminal of the Initialize VI to subsequent VISA resource name input terminals. You chain instrument driver VIs together by wiring the VISA resource name out terminal to subsequent VISA resource name input terminals.
  "error out": error
uses:
  NI::G Core::Strings::Append True Or False String.gvi
  NI::VISA::Write (Instr, String).gvi
  Labview_NXG_Keithley_SMU_2450_2460_2461::Utility::Error Query.gvi
diagram:
  w1 = ":VOLT\n:CURR\n:RES"  # Function
  Pick Line(line index=$"Function (0: Volts)", multi-line string=w1) -> (output string=w2)
  Pick Line(line index=$"Filter Type (0: Repeating)", multi-line string=":AVER:TCON REP;\n:AVER:TCON MOV;", string=w2) -> (output string=w3)
  call "Append True Or False String.gvi"(string=w2, true string=":AVER ON;", false string=":AVER OFF;", selector=$"Enable Filter (T: Enable)") -> (output string=w4)
  Format Into String(formatString="%s:AVER:COUN %d;%s", initString=w3, w2, $"Number of Filter Readings (3)", w4) -> w5
  call "Write (Instr, String).gvi"(session in=$"VISA resource name", error in=$"error in (no error)", write buffer=w5) -> (session out=w6, error out=w7)
  call "Error Query.gvi"(VISA resource name=w6, error in (no error)=w7) -> (VISA resource name out=w8, error out=w9)
  $"VISA resource name out" <- w8
  $"error out" <- w9
