vi "Configure Integration Filter.gvi"   [LabVIEW NXG 5.0.0]
# Configures the amount of time spent integrating the measurement before returning a measurement.  This time is expressed in power line cycles.
inputs:
  "VISA resource name": "VISA Instr", required
    # A reference to the instrument in use.  The reference to the resource name is created in the Initialize VI.  Therefore, before calling this VI, you need to call the Initialize VI.  To run this VI interactively, select the previously initialized resource name from the pull-down menu.  To run this VI programmatically, wire the VISA resource name out terminal of the Initialize VI to subsequent VISA resource name input terminals.  You chain instrument driver VIs together by wiring the VISA resource name out terminal to subsequent VISA resource name input terminals.
  "Function (0: Volts)": u16 = "Volts"(0)  # The function on which to configure measurement settings. Note: Voltage, Current, and Resistance measurements are always taken regardless of any VI calls.
  "Measurement Speed (1 PLC)": f64 = 1  # The number of power line cycles the instrument spends taking a measurement. This setting is global for voltage, current, and resistance measurements. Valid Range: 0.01 to 10 PLC
  "error in (no error)": error
outputs:
  "VISA resource name out": "VISA Instr"  # A copy of the reference to the instrument in use. The reference to the resource name is created in the Initialize VI. Wire the VISA resource name out terminal of the Initialize VI to subsequent VISA resource name input terminals. You chain instrument driver VIs together by wiring the VISA resource name out terminal to subsequent VISA resource name input terminals.
  "error out": error
uses:
  NI::VISA::Write (Instr, String).gvi
  Labview_NXG_Keithley_SMU_2450_2460_2461::Utility::Error Query.gvi
diagram:
  w1 = "VOLT\nCURR\nRES"  # Function
  Pick Line(line index=$"Function (0: Volts)", multi-line string=w1) -> (output string=w2)
  Format Into String(formatString="%.;:%s:NPLC %g ", w2, $"Measurement Speed (1 PLC)") -> w3
  call "Write (Instr, String).gvi"(session in=$"VISA resource name", error in=$"error in (no error)", write buffer=w3) -> (session out=w4, error out=w5)
  call "Error Query.gvi"(VISA resource name=w4, error in (no error)=w5) -> (VISA resource name out=w6, error out=w7)
  $"VISA resource name out" <- w6
  $"error out" <- w7
