vi "Configure Limit Test Auto Clear.gvi"   [LabVIEW NXG 5.0.0]
# Configures limit testing settings, such as the source of the tested value, binning, and I/O settings.
inputs:
  "VISA resource name": "VISA Instr", required
    # A reference to the instrument in use.  The reference to the resource name is created in the Initialize VI.  Therefore, before calling this VI, you need to call the Initialize VI.  To run this VI interactively, select the previously initialized resource name from the pull-down menu.  To run this VI programmatically, wire the VISA resource name out terminal of the Initialize VI to subsequent VISA resource name input terminals.  You chain instrument driver VIs together by wiring the VISA resource name out terminal to subsequent VISA resource name input terminals.
  "Limit Test Number (2)": u16 = 1  # The limit test number : 1 or 2.
  "Enable Auto Clear (OFF)": bool = TRUE  # Enables Auto Clear for the selected limit test.
  "Function (0: Volts)": u16 = "Volts"(0)  # The function which is to be measured. Note: Voltage, Current, and Resistance measurements are always taken regardless of any VI calls. The Digitize Voltage and Digitize Current functions are only compatible with the 2461.
  "error in (no error)": error
outputs:
  "VISA resource name out": "VISA Instr"  # A copy of the reference to the instrument in use. The reference to the resource name is created in the Initialize VI. Wire the VISA resource name out terminal of the Initialize VI to subsequent VISA resource name input terminals. You chain instrument driver VIs together by wiring the VISA resource name out terminal to subsequent VISA resource name input terminals.
  "error out": error
uses:
  NI::VISA::Write (Instr, String).gvi
  Labview_NXG_Keithley_SMU_2450_2460_2461::Utility::Error Query.gvi
diagram:
  w1 = "VOLT\nCURR\nRES\nDIG:VOLT\nDIG:CURR"  # Function
  Pick Line(line index=$"Function (0: Volts)", multi-line string=w1) -> (output string=w2)
  case ($"Enable Auto Clear (OFF)") {
    frame False, Default {
      Format Into String(formatString=":CALC2:%s:LIM%d:CLE:AUTO OFF", w2, $"Limit Test Number (2)") -> w3
    }
    frame True {
      Format Into String(formatString=":CALC2:%s:LIM%d:CLE:AUTO ON", w2, $"Limit Test Number (2)") -> w3
    }
  }
  call "Write (Instr, String).gvi"(session in=$"VISA resource name", error in=$"error in (no error)", write buffer=w3) -> (session out=w4, error out=w5)
  call "Error Query.gvi"(VISA resource name=w4, error in (no error)=w5) -> (VISA resource name out=w6, error out=w7)
  $"VISA resource name out" <- w6
  $"error out" <- w7
