vi "Configure Linear Mode Sweep.gvi"   [LabVIEW NXG 5.0.0]
# This sets up a linear sweep for a set number of measurement points.
inputs:
  "Range Type (0: Best Fixed Range)": u16 = "Best Fixed Range"(1)  # The source range that is used for the sweep: • Most sensitive source range for each source level in the sweep: 0 • Best fixed range: 2 (default) • Present source range for the entire sweep: 1
  "Buffer Name (defbuffer1)": string = "defbuffer1"  # The name of the data buffer used to store the readings of the sweep.
  "VISA resource name": "VISA Instr"
    # A reference to the instrument in use.  The reference to the resource name is created in the Initialize VI.  Therefore, before calling this VI, you need to call the Initialize VI.  To run this VI interactively, select the previously initialized resource name from the pull-down menu.  To run this VI programmatically, wire the VISA resource name out terminal of the Initialize VI to subsequent VISA resource name input terminals.  You chain instrument driver VIs together by wiring the VISA resource name out terminal to subsequent VISA resource name input terminals.
  "Source Mode (0: Voltage)": u16 = "Voltage"(0)  # Activates the desired sourcing mode for the upcoming sweep.
  "Sweep Points": T1 = {"Start "=1, "Stop "=0, "Number of Points (5)"=5}
  "Delay (0)": f64  # The delay between measurement points; default is -1, which enables autodelay, or a specific delay value from 50 ìs to 10,000 seconds, or 0 for no delay
  "Count (1)": i32 = 1  # The number of times to run the sweep; default is 1: • Infinite loop: 0 • Finite loop: 1 to 999
  "error in (no error)": error
  "Fail Abort (T:ON)": bool = TRUE  # Abort the sweep if the source limit is exceeded: ON (default) Complete the sweep if the source limit is exceeded: OFF
  "Dual (T:OFF)": bool  # This makes the sweep a dual slope sweep. If the sweep was going from 0 to 5 volts for 100 points, it will now go from 5 to 0 volts for 100 points.
outputs:
  "VISA resource name out": "VISA Instr"  # A copy of the reference to the instrument in use. The reference to the resource name is created in the Initialize VI. Wire the VISA resource name out terminal of the Initialize VI to subsequent VISA resource name input terminals. You chain instrument driver VIs together by wiring the VISA resource name out terminal to subsequent VISA resource name input terminals.
  "error out": error
types:
  T1 = cluster{"Start ": f64, "Stop ": f64, "Number of Points (5)": u32}
uses:
  NI::VISA::Write (Instr, String).gvi
  Labview_NXG_Keithley_SMU_2450_2460_2461::Utility::Error Query.gvi
diagram:
  Property Node(instance in=$"Sweep Points") -> ("Start "=w1, "Stop "=w2, "Number of Points (5)"=w3)
  Select(s=$"Fail Abort (T:ON)", t="ON", f="OFF") -> w4
  Select(s=$"Dual (T:OFF)", t="ON", f="OFF") -> w5
  Is Equal(x="", y=$"Buffer Name (defbuffer1)") -> w6
  Select(s=w6, t="defbuffer1", f=$"Buffer Name (defbuffer1)") -> w7
  Pick Line(line index=$"Source Mode (0: Voltage)", multi-line string="VOLT\nCURR") -> (output string=w8)
  Pick Line(line index=$"Range Type (0: Best Fixed Range)", multi-line string="AUTO\nBEST\nFIXED") -> (output string=w9)
  Format Into String(formatString=":SOUR:SWE:%s:LIN %g, %g, %d, %g, %d, %s, %s, %s, \"%s\"", w8, w1, w2, w3, $"Delay (0)", $"Count (1)", w9, w4, w5, w7) -> w10
  call "Write (Instr, String).gvi"(session in=$"VISA resource name", error in=$"error in (no error)", write buffer=w10) -> (session out=w11, error out=w12)
  call "Error Query.gvi"(VISA resource name=w11, error in (no error)=w12) -> (VISA resource name out=w13, error out=w14)
  $"VISA resource name out" <- w13
  $"error out" <- w14
