vi "Configure Linear Step Mode Sweep.gvi"   [LabVIEW NXG 5.0.0]
# This VI sets up a linear source sweep configuration list and trigger model with a fixed number of steps.
inputs:
  "Range Type (0: Best Fixed Range)": u16 = "Best Fixed Range"(1)  # The source range that is used for the sweep: • Most sensitive source range for each source level in the sweep: 0 • Best fixed range: 2 (default) • Present source range for the entire sweep: 1
  "Buffer Name (defbuffer1)": string = "defbuffer1"  # The name of the data buffer used to store the readings of the sweep.
  "VISA resource name": "VISA Instr"
    # A reference to the instrument in use.  The reference to the resource name is created in the Initialize VI.  Therefore, before calling this VI, you need to call the Initialize VI.  To run this VI interactively, select the previously initialized resource name from the pull-down menu.  To run this VI programmatically, wire the VISA resource name out terminal of the Initialize VI to subsequent VISA resource name input terminals.  You chain instrument driver VIs together by wiring the VISA resource name out terminal to subsequent VISA resource name input terminals.
  "Source Mode (0: Voltage)": u16 = "Voltage"(0)  # Activates the desired sourcing mode for the upcoming sweep.
  "Sweep Points": T1 = {"Start "=0, "Stop "=1, "Step"=0.1}
  "Delay (0)": f64 = -1  # The delay between measurement points; default is 0
  "Count (1)": i32 = 1  # The number of times to run the sweep; default is 1: • Infinite loop: 0 • Finite loop: 1 to 268435455
  "error in (no error)": error
  "Fail Abort (T:ON)": bool = TRUE  # Abort the sweep if the source limit is exceeded: ON (default) Complete the sweep if the source limit is exceeded: OFF
  "Dual (F:OFF)": bool  # This makes the sweep a dual slope sweep. If the sweep was going from 0 to 5 volts for 100 points, it will now go from 5 to 0 volts for 100 points.
outputs:
  "VISA resource name out": "VISA Instr"  # A copy of the reference to the instrument in use. The reference to the resource name is created in the Initialize VI. Wire the VISA resource name out terminal of the Initialize VI to subsequent VISA resource name input terminals. You chain instrument driver VIs together by wiring the VISA resource name out terminal to subsequent VISA resource name input terminals.
  "error out": error
types:
  T1 = cluster{"Start ": f64, "Stop ": f64, "Step": f64}
uses:
  NI::VISA::Write (Instr, String).gvi
  Labview_NXG_Keithley_SMU_2450_2460_2461::Utility::Error Query.gvi
diagram:
  w1 = ":SOUR:SWE:%s:LIN:STEP %g, %g, %g, %g, %d, %s, %s, %s, \"%s\" "
  Property Node(instance in=$"Sweep Points") -> ("Start "=w2, "Stop "=w3, "Step"=w4)
  Select(s=$"Fail Abort (T:ON)", t="ON", f="OFF") -> w5
  Select(s=$"Dual (F:OFF)", t="ON", f="OFF") -> w6
  Is Equal(x="", y=$"Buffer Name (defbuffer1)") -> w7
  Select(s=w7, t="defbuffer1", f=$"Buffer Name (defbuffer1)") -> w8
  Pick Line(line index=$"Source Mode (0: Voltage)", multi-line string="VOLT\nCURR") -> (output string=w9)
  Pick Line(line index=$"Range Type (0: Best Fixed Range)", multi-line string="AUTO\nBEST\nFIXED") -> (output string=w10)
  Format Into String(formatString=w1, w9, w2, w3, w4, $"Delay (0)", $"Count (1)", w10, w5, w6, w8) -> w11
  # :SOURce[1]:SWEep:<function>:LINear:STEP <start>, <stop>, <steps>, <delay>, <count>, <rangeType>, <failAbort>, <dual>, <bufferName>
  call "Write (Instr, String).gvi"(session in=$"VISA resource name", error in=$"error in (no error)", write buffer=w11) -> (session out=w12, error out=w13)
  call "Error Query.gvi"(VISA resource name=w12, error in (no error)=w13) -> (VISA resource name out=w14, error out=w15)
  $"VISA resource name out" <- w14
  $"error out" <- w15
