vi "Configure List Mode Sweep.gvi"   [LabVIEW NXG 5.0.0]
# This sets up a sweep based on a configuration list, which allows you to customize the sweep.
inputs:
  "Fail Abort (T:OFF)": bool  # Abort the sweep if the source limit is exceeded: ON (default) Complete the sweep if the source limit is exceeded: OFF
  "Buffer Name (defbuffer1)": string = "defbuffer1"  # The name of the data buffer used to store the readings of the sweep.
  "Configuration List Name": string  # The source configuration list which contains the values to be used for the sweep.
  "VISA resource name": "VISA Instr", required
    # A reference to the instrument in use.  The reference to the resource name is created in the Initialize VI.  Therefore, before calling this VI, you need to call the Initialize VI.  To run this VI interactively, select the previously initialized resource name from the pull-down menu.  To run this VI programmatically, wire the VISA resource name out terminal of the Initialize VI to subsequent VISA resource name input terminals.  You chain instrument driver VIs together by wiring the VISA resource name out terminal to subsequent VISA resource name input terminals.
  "Start Index": u32 = 1  # The index in the configuration list where the sweep starts; default is 1
  "Delay (0)": f64  # The delay between measurement points; default is 0 for no delay or you can set a specific delay value from 50 ìs to 10,000 seconds.
  "Count (1)": i32 = 1  # The number of times to run the sweep; default is 1: • Infinite loop: 0 • Finite loop: 1 to 999
  "error in (no error)": error
  "Source Mode (0: Voltage)": u16 = "Voltage"(0)  # Activates the desired sourcing mode for the upcoming sweep.
outputs:
  "VISA resource name out": "VISA Instr"  # A copy of the reference to the instrument in use. The reference to the resource name is created in the Initialize VI. Wire the VISA resource name out terminal of the Initialize VI to subsequent VISA resource name input terminals. You chain instrument driver VIs together by wiring the VISA resource name out terminal to subsequent VISA resource name input terminals.
  "error out": error
uses:
  NI::VISA::Write (Instr, String).gvi
  Labview_NXG_Keithley_SMU_2450_2460_2461::Utility::Error Query.gvi
diagram:
  # :SOURce[1]:SWEep:<function>:LIST <startIndex>, <delay>, <count>, <failAbort>, <bufferName>, <configListName>
  Select(s=$"Fail Abort (T:OFF)", t="ON", f="OFF") -> w1
  Is Equal(x="", y=$"Buffer Name (defbuffer1)") -> w2
  Select(s=w2, t="defbuffer1", f=$"Buffer Name (defbuffer1)") -> w3
  Pick Line(line index=$"Source Mode (0: Voltage)", multi-line string="VoltCustomSweepList\nCurrCustomSweepList") -> (output string=w4)
  Is Equal(x="", y=$"Configuration List Name") -> w5
  Select(s=w5, t=w4, f=$"Configuration List Name") -> w6
  Pick Line(line index=$"Source Mode (0: Voltage)", multi-line string="VOLT\nCURR") -> (output string=w7)
  Format Into String(formatString=":SOUR:SWE:%s:LIST %d, %g, %d, %s, \"%s\", \"%s\" ", w7, $"Start Index", $"Delay (0)", $"Count (1)", w1, w3, w6) -> w8
  call "Write (Instr, String).gvi"(session in=$"VISA resource name", error in=$"error in (no error)", write buffer=w8) -> (session out=w9, error out=w10)
  call "Error Query.gvi"(VISA resource name=w9, error in (no error)=w10) -> (VISA resource name out=w11, error out=w12)
  $"VISA resource name out" <- w11
  $"error out" <- w12
