vi "Configure Math.gvi"   [LabVIEW NXG 5.0.0]
# Configure the math operation performed by the instrument on collected data.
inputs:
  "Percent Value (1)": f64 = 1  # The constant when the math operation is set to percent; the range is -1e12 to +1e12
  "VISA resource name": "VISA Instr"
    # A reference to the instrument in use.  The reference to the resource name is created in the Initialize VI.  Therefore, before calling this VI, you need to call the Initialize VI.  To run this VI interactively, select the previously initialized resource name from the pull-down menu.  To run this VI programmatically, wire the VISA resource name out terminal of the Initialize VI to subsequent VISA resource name input terminals.  You chain instrument driver VIs together by wiring the VISA resource name out terminal to subsequent VISA resource name input terminals.
  "Function (0: Volts)": u16 = "Volts"(0)  # The function which is to be measured. Note: Voltage, Current, and Resistance measurements are always taken regardless of any VI calls. The Digitize Voltage and Digitize Current functions are only compatible with the 2461.
  "Math Operation (1: Percent)": u16 = "Percent"(1)  # The name of the math operation: • y = mx+b: MXB • Percent • Reciprocal
  "M Value (1)": f64 = 1  # This command specifies the scale factor (m) for the y = mx + b math operation. The scale factor; the valid range is -4294967295 to +4294967295
  "B Value (0)": f64  # This command specifies the offset(b) for the y = mx + b operation. The offset for the y = mx + b operation; the valid range is -1e12 to +1e12.
  "error in (no error)": error
  "Enable Math Function (T:Disable)": bool = TRUE  # Enables or disables the math function functionality on the instrument.
outputs:
  "VISA resource name out": "VISA Instr"  # A copy of the reference to the instrument in use. The reference to the resource name is created in the Initialize VI. Wire the VISA resource name out terminal of the Initialize VI to subsequent VISA resource name input terminals. You chain instrument driver VIs together by wiring the VISA resource name out terminal to subsequent VISA resource name input terminals.
  "error out": error
uses:
  Labview_NXG_Keithley_SMU_2450_2460_2461::Utility::Create Math Operation.gvi
  Labview_NXG_Keithley_SMU_2450_2460_2461::Configure::Enable Math Operation.gvi
diagram:
  call "Create Math Operation.gvi"(Percent Value (1)=$"Percent Value (1)", VISA resource name=$"VISA resource name", Function (0: Volts)=$"Function (0: Volts)", Math Operation (1: Percent)=$"Math Operation (1: Percent)", M Value (0)=$"M Value (1)", B Value (1)=$"B Value (0)", error in (no error)=$"error in (no error)") -> (VISA resource name out=w1, error out=w2)
  call "Enable Math Operation.gvi"(VISA resource name=w1, Function (0: Volts)=$"Function (0: Volts)", Enable Math Operations (T:Enable)=$"Enable Math Function (T:Disable)", error in (no error)=w2) -> (VISA resource name out=w3, error out=w4)
  $"VISA resource name out" <- w3
  $"error out" <- w4
