vi "Configure Measurement Function.gvi"   [LabVIEW NXG 5.0.0]
# Configures the measurement function on the instrument.
inputs:
  "VISA resource name": "VISA Instr", required
    # A reference to the instrument in use.  The reference to the resource name is created in the Initialize VI.  Therefore, before calling this VI, you need to call the Initialize VI.  To run this VI interactively, select the previously initialized resource name from the pull-down menu.  To run this VI programmatically, wire the VISA resource name out terminal of the Initialize VI to subsequent VISA resource name input terminals.  You chain instrument driver VIs together by wiring the VISA resource name out terminal to subsequent VISA resource name input terminals.
  "Function (0: Volts)": u16 = "Volts"(0)
    # The function on which to configure measurement settings.
    # 1. Volts: Measure voltage.
    # 2. Current: Measure current.
    # 3. Auto Resistance: Measure resistance. When the measure function is set to resistance, the instrument sets the source current and source limit automatically.
    # 4. Manual Resistance: The user sets either a current/voltage source value and limits, and then measures the resistance value. This allows the user to get better measurements by having complete control of the source.
    # 5. Digitize Voltage: Use the digitizer to aquire voltage readings.
    # 6. Digitize Current: Use the digitizer to aquire current readings.
    # The Digitize Voltage and Digitize Current are only compatible with the 2461.
    # Note: When using the Manual Resistance option, you must use the Configured Source Function VI prior to the Configure Measurement Function VI.
  "error in (no error)": error
outputs:
  "VISA resource name out": "VISA Instr"  # A copy of the reference to the instrument in use. The reference to the resource name is created in the Initialize VI. Wire the VISA resource name out terminal of the Initialize VI to subsequent VISA resource name input terminals. You chain instrument driver VIs together by wiring the VISA resource name out terminal to subsequent VISA resource name input terminals.
  "error out": error
uses:
  Labview_NXG_Keithley_SMU_2450_2460_2461::Configure::Get Source Function.gvi
  NI::VISA::Write (Instr, String).gvi
  Labview_NXG_Keithley_SMU_2450_2460_2461::Utility::Error Query.gvi
diagram:
  Is Equal(x=$"Function (0: Volts)", y=3) -> w1
  w2 = ":FUNC \"VOLT\"\n:FUNC \"CURR\"\n:FUNC \"RES\"\nSENSE:%s:UNIT OHM\nDIG:FUNC \"VOLT\"\nDIG:FUNC \"CURR\""  # Function
  Pick Line(line index=$"Function (0: Volts)", multi-line string=w2) -> (output string=w3)
  case (w1) {
    frame False, Default {
      w4 = w3
      w5 = $"VISA resource name"
      w6 = $"error in (no error)"
    }
    frame True {
      call "Get Source Function.gvi"(VISA resource name=$"VISA resource name", error in (no error)=$"error in (no error)") -> (VISA resource name out=w5, Source Function=w7, error out=w6)
      Is Equal(x="VOLT", y=w7) -> w8
      case (w8) {
        frame False, Default {
          Format Into String(formatString=w3, "VOLT") -> w4
        }
        frame True {
          Format Into String(formatString=w3, "CURR") -> w4
        }
      }
    }
  }
  call "Write (Instr, String).gvi"(session in=w5, error in=w6, write buffer=w4) -> (session out=w9, error out=w10)
  call "Error Query.gvi"(VISA resource name=w9, error in (no error)=w10) -> (VISA resource name out=w11, error out=w12)
  $"VISA resource name out" <- w11
  $"error out" <- w12
