vi "Configure Measurement Manual Range.gvi"   [LabVIEW NXG 5.0.0]
# This VI sets the positive full-scale value of the measurement range for measurements of the selected function.
# The Digitize Voltage and Digitize Current functions are only valid on the 2461
inputs:
  "VISA resource name": "VISA Instr" = "USB0::0x05E6::0x2461::04090176::INSTR", required
    # A reference to the instrument in use.  The reference to the resource name is created in the Initialize VI.  Therefore, before calling this VI, you need to call the Initialize VI.  To run this VI interactively, select the previously initialized resource name from the pull-down menu.  To run this VI programmatically, wire the VISA resource name out terminal of the Initialize VI to subsequent VISA resource name input terminals.  You chain instrument driver VIs together by wiring the VISA resource name out terminal to subsequent VISA resource name input terminals.
  "Function (0: Volts)": u16 = "Volts"(0)  # The function on which to configure measurement settings. Note: Voltage, Current, and Resistance measurements are always taken regardless of any VI calls. The Digitizer Voltage and Digitizer Current functions are only compatible with the 2461.
  "Manual Range (1.0)": f64 = 0.1  # Set this command to a specific value or a preset value: Current: 1e-08 to 1 amps Resistance: 20 to 2e8 ohms Voltage: 0.02 to 200 volts
  "error in (no error)": error
outputs:
  "VISA resource name out": "VISA Instr"  # A copy of the reference to the instrument in use. The reference to the resource name is created in the Initialize VI. Wire the VISA resource name out terminal of the Initialize VI to subsequent VISA resource name input terminals. You chain instrument driver VIs together by wiring the VISA resource name out terminal to subsequent VISA resource name input terminals.
  "error out": error
panel indicators:
  "Error Message": string
  "Error Code": i32[]
uses:
  NI::VISA::Write (Instr, String).gvi
  Labview_NXG_Keithley_SMU_2450_2460_2461::Utility::Error Query.gvi
diagram:
  w1 = ":SENS:%s:RANG %e;"  # Manual Range
  w2 = "VOLT\nCURR\nRES"  # Function
  Pick Line(line index=$"Function (0: Volts)", multi-line string=w2) -> (output string=w3)
  Format Into String(formatString=w1, w3, $"Manual Range (1.0)") -> w4
  call "Write (Instr, String).gvi"(session in=$"VISA resource name", error in=$"error in (no error)", write buffer=w4) -> (session out=w5, error out=w6)
  call "Error Query.gvi"(VISA resource name=w5, error in (no error)=w6) -> (VISA resource name out=w7, Error Code=w8, Error Message=w9, error out=w10)
  $"Error Code" <- w8
  $"VISA resource name out" <- w7
  $"Error Message" <- w9
  $"error out" <- w10
