vi "Configure Measurement Range.gvi"   [LabVIEW NXG 5.0.0]
# Configures the measurement type, resolution, and range on the instrument.
# Note: This VI should be called for each measurement that is of interest.  This VI can be called multiple times in a row.
inputs:
  "Manual Range (1.0)": f64 = 1  # Set this command to a specific value or a preset value: Current: 1e-08 to 1 amps Resistance: 20 to 2e8 ohms Voltage: 0.02 to 200 volts
  "VISA resource name": "VISA Instr", required
    # A reference to the instrument in use.  The reference to the resource name is created in the Initialize VI.  Therefore, before calling this VI, you need to call the Initialize VI.  To run this VI interactively, select the previously initialized resource name from the pull-down menu.  To run this VI programmatically, wire the VISA resource name out terminal of the Initialize VI to subsequent VISA resource name input terminals.  You chain instrument driver VIs together by wiring the VISA resource name out terminal to subsequent VISA resource name input terminals.
  "Function (0: Volts)": u16 = "Volts"(0)  # The function on which to configure measurement settings. Note: Voltage, Current, and Resistance measurements are always taken regardless of any VI calls.
  "Enable Auto Range (T:Enable)": bool = TRUE  # Enables or disables automatic range selection on the instrument. If this control is set to Disable, the Manual Range control is used to set the range.
  "error in (no error)": error
outputs:
  "VISA resource name out": "VISA Instr"  # A copy of the reference to the instrument in use. The reference to the resource name is created in the Initialize VI. Wire the VISA resource name out terminal of the Initialize VI to subsequent VISA resource name input terminals. You chain instrument driver VIs together by wiring the VISA resource name out terminal to subsequent VISA resource name input terminals.
  "error out": error
uses:
  Labview_NXG_Keithley_SMU_2450_2460_2461::Configure::Enable Measurement Auto Range.gvi
  Labview_NXG_Keithley_SMU_2450_2460_2461::Configure::Configure Measurement Manual Range.gvi
  Labview_NXG_Keithley_SMU_2450_2460_2461::Utility::Error Query.gvi
diagram:
  call "Enable Measurement Auto Range.gvi"(VISA resource name=$"VISA resource name", Function (0: Volts)=$"Function (0: Volts)", Enable Auto Range (T:Enable)=$"Enable Auto Range (T:Enable)", error in (no error)=$"error in (no error)") -> (VISA resource name out=w1, error out=w2)
  case ($"Enable Auto Range (T:Enable)") {
    frame False, Default {
      call "Configure Measurement Manual Range.gvi"(VISA resource name=w1, Function (0: Volts)=$"Function (0: Volts)", Manual Range (1.0)=$"Manual Range (1.0)", error in (no error)=w2) -> (VISA resource name out=w3, error out=w4)
    }
    frame True {
      w3 = w1
      w4 = w2
    }
  }
  call "Error Query.gvi"(VISA resource name=w3, error in (no error)=w4) -> (VISA resource name out=w5, error out=w6)
  $"VISA resource name out" <- w5
  $"error out" <- w6
