vi "Configure Output List.gvi"   [LabVIEW NXG 5.0.0]
# Define a list of values for the source to output.
inputs:
  "VISA resource name": "VISA Instr", required
    # A reference to the instrument in use.  The reference to the resource name is created in the Initialize VI.  Therefore, before calling this VI, you need to call the Initialize VI.  To run this VI interactively, select the previously initialized resource name from the pull-down menu.  To run this VI programmatically, wire the VISA resource name out terminal of the Initialize VI to subsequent VISA resource name input terminals.  You chain instrument driver VIs together by wiring the VISA resource name out terminal to subsequent VISA resource name input terminals.
  "Output List": f64[]
  "Source Mode (0: Voltage)": u16 = "Voltage"(0)  # Activates the desired sourcing mode for the upcoming sweep. The Voltage Pulse and Current Pulse settings are only compatible with the 2461.
  "error in (no error)": error
outputs:
  "VISA resource name out": "VISA Instr"  # A copy of the reference to the instrument in use. The reference to the resource name is created in the Initialize VI. Wire the VISA resource name out terminal of the Initialize VI to subsequent VISA resource name input terminals. You chain instrument driver VIs together by wiring the VISA resource name out terminal to subsequent VISA resource name input terminals.
  "error out": error
uses:
  NI::VISA::Write (Instr, String).gvi
  Labview_NXG_Keithley_SMU_2450_2460_2461::Utility::Error Query.gvi
diagram:
  Number To Engineering String(number=$"Output List") -> (Eng-format string=w1)
  w2 = "SOUR:LIST:VOLT\nSOUR:LIST:CURR\nSOUR:PULS:LIST:VOLT\nSOUR:PULS:LIST:CURR"
  Pick Line(line index=$"Source Mode (0: Voltage)", multi-line string=w2) -> (output string=w3)
  s1 = $"error in (no error)"  # shift register
  s2 = w1  # shift register
  while (iteration -> i1) {
    Is Equal To 0(x=i1) -> w4
    Select(s=w4, t=" ", f=":APP ") -> w5
    s3 = ""  # shift register
    s4 = s2  # shift register
    while (iteration -> i2) {
      Array Index(array=s4) -> (out0[0]=w6)
      Concatenate Strings(s3, ",", w6) -> w7
      Delete From Array(inArray=s4, length (1)=1, index0=0) -> w8
      Array Size(array=w8) -> (size(s)=w9)
      Is Equal To 0(x=w9) -> w10
      Is Equal(x=9, y=i2) -> w11
      Logical Or(w10, w11) -> w12
      next s3 = w7
      next s4 = w8
      stop if w12
    }
    Replace Substring(length (len. of substring)=1, string=s3) -> (result string=w13)
    Concatenate Strings(w3, w5, w13) -> w14
    call "Write (Instr, String).gvi"(session in=$"VISA resource name", error in=s1, write buffer=w14) -> (session out=w15, error out=w16)
    Array Size(array=s4) -> (size(s)=w17)
    Is Equal To 0(x=w17) -> w18
    next s1 = w16
    next s2 = s4
    stop if w18
  }
  call "Error Query.gvi"(VISA resource name=w15, error in (no error)=s1) -> (VISA resource name out=w19, error out=w20)
  $"VISA resource name out" <- w19
  $"error out" <- w20
