vi "Configure Output Sweep.gvi"   [LabVIEW NXG 5.0.0]
# This VI sets up a linear/logarithmic sweep for a set number of measurement points.
inputs:
  "Sweep Spacing (0: Linear)": u16 = "Linear"(0)  # The measurement scale for the sweep to follow: Linear Logarithimic. Note: A logarithmic setting will cause the instrument to fail if the sweep contains a nonpositive boundry.
  "Source Delay (0)": f64 = 1  # The amount of time in seconds between each point in the sweep.
  "VISA resource name": "VISA Instr", required
    # A reference to the instrument in use.  The reference to the resource name is created in the Initialize VI.  Therefore, before calling this VI, you need to call the Initialize VI.  To run this VI interactively, select the previously initialized resource name from the pull-down menu.  To run this VI programmatically, wire the VISA resource name out terminal of the Initialize VI to subsequent VISA resource name input terminals.  You chain instrument driver VIs together by wiring the VISA resource name out terminal to subsequent VISA resource name input terminals.
  "Number of Points (5)": u32 = 5  # Determines the number of stopping points in the sweep range. For example, if the sweep is from 0 to 1 and this control is set to 3, the sweep will consist of values of 0, 0.5, and 1.
  "Start Amplitude (1)": f64 = 1  # The minimum amplitude of the sweep.
  "Stop Amplitude (2)": f64 = 2  # The maximum amplitude of the sweep.
  "error in (no error)": error
  "Source Mode (0: Voltage)": u16 = "Voltage"(0)  # Activates the desired sourcing mode for the upcoming sweep.
  "Dual Sweep (F:Disable)": bool  # Determines if the sweep runs from start to stop and then from stop to start:
outputs:
  "VISA resource name out": "VISA Instr"  # A copy of the reference to the instrument in use. The reference to the resource name is created in the Initialize VI. Wire the VISA resource name out terminal of the Initialize VI to subsequent VISA resource name input terminals. You chain instrument driver VIs together by wiring the VISA resource name out terminal to subsequent VISA resource name input terminals.
  "error out": error
uses:
  NI::VISA::Write (Instr, String).gvi
  Labview_NXG_Keithley_SMU_2450_2460_2461::Utility::Error Query.gvi
diagram:
  Pick Line(line index=$"Source Mode (0: Voltage)", multi-line string="SOUR:FUNC VOLT;\nSOUR:FUNC CURR;") -> (output string=w1)
  Pick Line(line index=$"Source Mode (0: Voltage)", multi-line string="VOLT\nCURR") -> (output string=w2)
  Pick Line(line index=$"Sweep Spacing (0: Linear)", multi-line string=":SOUR:SWE:%s:LIN %g,%g,%d,%g\n:SOUR:SWE:%s:LOG %g,%g,%d,%g") -> (output string=w3)
  Format Into String(formatString=w3, initString=w1, w2, $"Start Amplitude (1)", $"Stop Amplitude (2)", $"Number of Points (5)", $"Source Delay (0)") -> w4
  Select(s=$"Dual Sweep (F:Disable)", t=",1,BEST,ON,ON;", f=";") -> w5
  Concatenate Strings(w4, w5) -> w6
  call "Write (Instr, String).gvi"(session in=$"VISA resource name", error in=$"error in (no error)", write buffer=w6) -> (session out=w7, error out=w8)
  call "Error Query.gvi"(VISA resource name=w7, error in (no error)=w8) -> (VISA resource name out=w9, error out=w10)
  $"VISA resource name out" <- w9
  $"error out" <- w10
