vi "Configure Output.gvi"   [LabVIEW NXG 5.0.0]
# Configures whether the output is in terms of current or voltage, the amplitude of the output, and compliance settings.
inputs:
  "VISA resource name": "VISA Instr", required
    # A reference to the instrument in use.  The reference to the resource name is created in the Initialize VI.  Therefore, before calling this VI, you need to call the Initialize VI.  To run this VI interactively, select the previously initialized resource name from the pull-down menu.  To run this VI programmatically, wire the VISA resource name out terminal of the Initialize VI to subsequent VISA resource name input terminals.  You chain instrument driver VIs together by wiring the VISA resource name out terminal to subsequent VISA resource name input terminals.
  "Source Level (0)": f64  # The desired output level for the device. The source value unit is dependent on the Source Mode. Valid Range: Voltage: +/- 210V Current: +/- 1A
  "Source Mode (0: Voltage)": u16 = "Voltage"(0)  # Selects the voltage or current source mode to be configured.
  "Source Limit Level (0.1)": f64 = 0.1  # Sets the maximum value for the value not regulated by the Source Mode control. For instance, if the instrument was suppling a voltage, the Limit value would be in amps. Valid Range: Voltage: +/- 210V Current: +/- 1A
  "error in (no error)": error
outputs:
  "VISA resource name out": "VISA Instr"  # A copy of the reference to the instrument in use. The reference to the resource name is created in the Initialize VI. Wire the VISA resource name out terminal of the Initialize VI to subsequent VISA resource name input terminals. You chain instrument driver VIs together by wiring the VISA resource name out terminal to subsequent VISA resource name input terminals.
  "error out": error
uses:
  Labview_NXG_Keithley_SMU_2450_2460_2461::Configure::Configure Source Level.gvi
  Labview_NXG_Keithley_SMU_2450_2460_2461::Configure::Configure Source Limit Level.gvi
  Labview_NXG_Keithley_SMU_2450_2460_2461::Utility::Error Query.gvi
diagram:
  # SOUR:FUNC VOLT;:SOUR:VOLT
  # SOUR:FUNC CURR;:SOUR:CURR
  # :SOUR:VOLT:ILIM
  # :SOUR:CURR:VLIM
  call "Configure Source Level.gvi"(VISA resource name=$"VISA resource name", Function (0: Volts)=$"Source Mode (0: Voltage)", Source Level (1.0)=$"Source Level (0)", error in (no error)=$"error in (no error)") -> (VISA resource name out=w1, error out=w2)
  call "Configure Source Limit Level.gvi"(VISA resource name=w1, Function (0: Volts)=$"Source Mode (0: Voltage)", Source Limit (1.0)=$"Source Limit Level (0.1)", error in (no error)=w2) -> (VISA resource name out=w3, error out=w4)
  call "Error Query.gvi"(VISA resource name=w3, error in (no error)=w4) -> (VISA resource name out=w5, error out=w6)
  $"VISA resource name out" <- w5
  $"error out" <- w6
