vi "Configure Pulse Limit.gvi"   [LabVIEW NXG 5.0.0]
# This command sets the source limit for pulse outputs. The Model 2461 cannot source pulse levels
# that exceed this limit.
# When the function set is Voltage, the limit applies to Current.
# When the function set is Current, the limit applies to Voltage.
# The values that can be set for this command are limited by the setting for the overvoltage protection
# limit. Also, if an interlock is not installed, the values are limited.
# This value can also be limited by the measurement range. If a specific measurement range is set, the
# limit must be more than 1 percent of the measurement range. If you set the measurement range to be
# automatically selected, the measurement range is selected based on the pulse and bias limits.
# If you change the source range to a level that is not appropriate for this limit, the instrument changes
# the source limit to a limit that is appropriate to the range and a warning is generated.
# Limits are absolute values.
# This function is only compatible with the 2461.
inputs:
  "VISA resource name": "VISA Instr" = "USB0::0x05E6::0x2461::04090176::INSTR"
    # A reference to the instrument in use.  The reference to the resource name is created in the Initialize VI.  Therefore, before calling this VI, you need to call the Initialize VI.  To run this VI interactively, select the previously initialized resource name from the pull-down menu.  To run this VI programmatically, wire the VISA resource name out terminal of the Initialize VI to subsequent VISA resource name input terminals.  You chain instrument driver VIs together by wiring the VISA resource name out terminal to subsequent VISA resource name input terminals.
  "Function (0:Voltage)": u16 = "Voltage"(0)  # This selects the function that the Pulse Limit will apply to.
  "Limit": f64  # If the funtion is set to Voltage, then the limit applies to the maximum Pulse Current. If the function is set to voltage, the limit applies to the maximum Pulse Voltage.
  "error in (no error)": error
outputs:
  "VISA resource name out": "VISA Instr"  # A copy of the reference to the instrument in use. The reference to the resource name is created in the Initialize VI. Wire the VISA resource name out terminal of the Initialize VI to subsequent VISA resource name input terminals. You chain instrument driver VIs together by wiring the VISA resource name out terminal to subsequent VISA resource name input terminals.
  "error out": error
uses:
  NI::VISA::Write (Instr, String).gvi
  Labview_NXG_Keithley_SMU_2450_2460_2461::Utility::Error Query.gvi
diagram:
  Pick Line(line index=$"Function (0:Voltage)", multi-line string="VOLT\nCURR") -> (output string=w1)
  Pick Line(line index=$"Function (0:Voltage)", multi-line string="ILIM\nVLIM") -> (output string=w2)
  Format Into String(formatString=":SOUR:PULS:%s:%s:LEV %f;", w1, w2, $Limit) -> w3
  call "Write (Instr, String).gvi"(session in=$"VISA resource name", error in=$"error in (no error)", write buffer=w3) -> (session out=w4, error out=w5)
  call "Error Query.gvi"(VISA resource name=w4, error in (no error)=w5) -> (VISA resource name out=w6, error out=w7)
  $"VISA resource name out" <- w6
  $"error out" <- w7
