vi "Configure Pulse List Sweep.gvi"   [LabVIEW NXG 5.0.0]
# This command sets up a pulse sweep based on a configuration list, which allows you to customize the sweep.
# This function is only compatible with the 2461.
inputs:
  "Buffer Name (defbuffer1)": string  # The name of the data buffer used to store the readings of the sweep.
  "Enable Measure (True)": bool = TRUE  # Enable or disable measurements at the top of each pulse: • Enable: ON (default) • Disable: OFF
  "Fail Abort (True)": bool = TRUE  # Determines if the sweep is stopped immediately if a limit is exceeded; options are: • Abort the sweep if the source bias or pulse limit is exceeded: ON • Complete the sweep if the source limit is exceeded: OFF
  "VISA resource name": "VISA Instr" = "USB0::0x05E6::0x2461::04090181::INSTR"
    # A reference to the instrument in use.  The reference to the resource name is created in the Initialize VI.  Therefore, before calling this VI, you need to call the Initialize VI.  To run this VI interactively, select the previously initialized resource name from the pull-down menu.  To run this VI programmatically, wire the VISA resource name out terminal of the Initialize VI to subsequent VISA resource name input terminals.  You chain instrument driver VIs together by wiring the VISA resource name out terminal to subsequent VISA resource name input terminals.
  "Delay (0)": f64  # The amount of time that the instrument stays at bias level before each pulse (in seconds): 0 to 10,000 s
  "Count (1)": i32 = 1  # The number of times to run the sweep; default is 1: • Infinite loop: 0 • Finite loop: 1 to 999
  "Pulse Width": f64  # The delay between measurement points; default is 0 for no delay or you can set a specific delay value from 50 ìs to 10,000 seconds.
  "Pulse Off Time": f64  # The delay between measurement points; default is 0 for no delay or you can set a specific delay value from 50 ìs to 10,000 seconds.
  "error in (no error)": error
  "Start Index": u32 = 1  # The index in the configuration list where the sweep starts; default is 1
  "Source Mode (0: Voltage)": u16 = "Voltage"(0)  # Activates the desired sourcing mode for the upcoming sweep.
outputs:
  "VISA resource name out": "VISA Instr"  # A copy of the reference to the instrument in use. The reference to the resource name is created in the Initialize VI. Wire the VISA resource name out terminal of the Initialize VI to subsequent VISA resource name input terminals. You chain instrument driver VIs together by wiring the VISA resource name out terminal to subsequent VISA resource name input terminals.
  "error out": error
uses:
  NI::VISA::Write (Instr, String).gvi
  Labview_NXG_Keithley_SMU_2450_2460_2461::Utility::Error Query.gvi
diagram:
  w1 = ":SOUR:PULS:SWE:%s:LIST %f, %s, \"%s\", %d, %d, %f, %f, %s, \"%s\"; "
  Pick Line(line index=$"Source Mode (0: Voltage)", multi-line string="VoltPulseCustomSweepList\nCurrPulseCustomSweepList") -> (output string=w2)
  Pick Line(line index=$"Source Mode (0: Voltage)", multi-line string="VOLT\nCURR") -> (output string=w3)
  Select(s=$"Enable Measure (True)", t="ON", f="OFF") -> w4
  Is Equal(x="", y=$"Buffer Name (defbuffer1)") -> w5
  Select(s=w5, t="defbuffer1", f=$"Buffer Name (defbuffer1)") -> w6
  Select(s=$"Fail Abort (True)", t="ON", f="OFF") -> w7
  Format Into String(formatString=w1, w3, $"Pulse Width", w4, w6, $"Start Index", $"Count (1)", $"Delay (0)", $"Pulse Off Time", w7, w2) -> w8
  call "Write (Instr, String).gvi"(session in=$"VISA resource name", error in=$"error in (no error)", write buffer=w8) -> (session out=w9, error out=w10)
  call "Error Query.gvi"(VISA resource name=w9, error in (no error)=w10) -> (VISA resource name out=w11, error out=w12)
  $"VISA resource name out" <- w11
  $"error out" <- w12
