vi "Configure Pulse Sweep.gvi"   [LabVIEW NXG 5.0.0]
# This command sets up a linear or log based pulse sweep for a fixed number of pulse points.
# This function is only compatible with the 2461.
inputs:
  "Enable Measure": bool = TRUE  # Enable or disable measurements at the top of each pulse: • Enable: ON (default) • Disable: OFF
  "VISA resource name": "VISA Instr" = "USB0::0x05E6::0x2461::04090176::INSTR"
    # A reference to the instrument in use.  The reference to the resource name is created in the Initialize VI.  Therefore, before calling this VI, you need to call the Initialize VI.  To run this VI interactively, select the previously initialized resource name from the pull-down menu.  To run this VI programmatically, wire the VISA resource name out terminal of the Initialize VI to subsequent VISA resource name input terminals.  You chain instrument driver VIs together by wiring the VISA resource name out terminal to subsequent VISA resource name input terminals.
  "Function (0:Voltage)": u16 = "Voltage"(0)  # The source function creates a Pulse Sweep as follows: • Voltage pulse train: VOLTage • Current pulse train: CURRent
  "Sweep Parameters": T2 = {"Bias Level (0)"=0, "Start (0)"=0, "Stop (0)"=0, "Sweep Type (0:Linear)"=0, "Bias Limit (.1)"=0.1, "Points (2)"=2}
  "Pulse Parameters": T1 = {"Pulse Off Time (0.01)"=0.01, "Pulse Width (.05)"=0.05, "Delay (0)"=0, "Pulse Limit (.1)"=0.1}
  "error in (no error)": error
  "Buffer Name": string = "defbuffer1"  # A string that indicates the reading buffer; the default buffers (defbuffer1 or defbuffer2) or the name of a user-defined buffer.
outputs:
  "VISA resource name out": "VISA Instr"  # A copy of the reference to the instrument in use. The reference to the resource name is created in the Initialize VI. Wire the VISA resource name out terminal of the Initialize VI to subsequent VISA resource name input terminals. You chain instrument driver VIs together by wiring the VISA resource name out terminal to subsequent VISA resource name input terminals.
  "error out": error
types:
  T1 = cluster{"Pulse Off Time (0.01)": f64, "Pulse Width (.05)": f64, "Delay (0)": f64, "Pulse Limit (.1)": f64}
  T2 = cluster{"Bias Level (0)": f64, "Start (0)": f64, "Stop (0)": f64, "Sweep Type (0:Linear)": u16, "Bias Limit (.1)": f64, "Points (2)": u16}
uses:
  NI::VISA::Write (Instr, String).gvi
  Labview_NXG_Keithley_SMU_2450_2460_2461::Utility::Error Query.gvi
diagram:
  Property Node(instance in=$"Pulse Parameters") -> ("Pulse Off Time (0.01)"=w1, "Pulse Width (.05)"=w2, "Delay (0)"=w3, "Pulse Limit (.1)"=w4)
  Property Node(instance in=$"Sweep Parameters") -> ("Bias Level (0)"=w5, "Start (0)"=w6, "Stop (0)"=w7, "Sweep Type (0:Linear)"=w8, "Bias Limit (.1)"=w9, "Points (2)"=w10)
  Select(s=$"Enable Measure", t="ON", f="OFF") -> w11
  Pick Line(line index=$"Function (0:Voltage)", multi-line string="VOLT\nCURR") -> (output string=w12)
  Pick Line(line index=w8, multi-line string="LIN\nLOG") -> (output string=w13)
  w14 = ":SOUR:PULS:SWE:%s:%s %f, %f, %f, %u, %f, %s, \"%s\", %f, %f, %u, %f, %f;"
  Format Into String(formatString=w14, w12, w13, w5, w6, w7, w10, w2, w11, $"Buffer Name", w3, w1, 1, w9, w4) -> w15
  call "Write (Instr, String).gvi"(session in=$"VISA resource name", error in=$"error in (no error)", write buffer=w15) -> (session out=w16, error out=w17)
  call "Error Query.gvi"(VISA resource name=w16, error in (no error)=w17) -> (VISA resource name out=w18, error out=w19)
  $"VISA resource name out" <- w18
  $"error out" <- w19
