vi "Configure Pulse Train.gvi"   [LabVIEW NXG 5.0.0]
# This command defines a sequence of source pulses and to generate the pulse train.
# This function is only compatible with the 2461.
inputs:
  "Delay": f64  # If the funtion is set to Voltage, then the limit applies to the maximum Pulse Current. If the function is set to voltage, the limit applies to the maximum Pulse Voltage.
  "Bias Limit": f64 = 0.1  # The current or voltage limit for the defined bias level: • Current: 10 nA to 7.35 A • Voltage: 2 mV to 105 V
  "Pulse Limit": f64 = 0.15  # The current or voltage limit for the defined pulse level: • Current: 10 nA to 10.5 A • Voltage: 2 mV to 105 V
  "Enable Measure": bool = TRUE  # Enable or disable measurements at the top of each pulse: • Enable: ON (default) • Disable: OFF
  "VISA resource name": "VISA Instr" = "USB0::0x05E6::0x2461::04090176::INSTR"
    # A reference to the instrument in use.  The reference to the resource name is created in the Initialize VI.  Therefore, before calling this VI, you need to call the Initialize VI.  To run this VI interactively, select the previously initialized resource name from the pull-down menu.  To run this VI programmatically, wire the VISA resource name out terminal of the Initialize VI to subsequent VISA resource name input terminals.  You chain instrument driver VIs together by wiring the VISA resource name out terminal to subsequent VISA resource name input terminals.
  "Pulse Amplitude": f64 = 1  # The amplitude current or voltage from zero (not from the bias level): • Current: -10.5 A to 10.5 A • Voltage: -105 V to 105 V
  "Pulse Width": f64 = 0.1  # The time at the amplitude level for each pulse: • Extended operating area: 10 A at 100 V, 5 % duty cycle, maximum pulse width: 1 ms, minimum pulse width 150 ìs (load dependent) • Normal operating area (DC): 99.99 % duty cycle, maximum pulse width 10,000 s, minimum pulse width 150 ìs
  "Pulse Off Time": f64 = 0.1  # The amount of time that the instrument stays at bias level after each pulse (in seconds): 0 to 10,000 s
  "Pulse Count": f64 = 1  # The number of pulses in the pulse train; default is 1: • Infinite loop: 0 • Finite loop: 1 to 268435455
  "error in (no error)": error
  "Bias Level": f64  # Output level the instrument sources before the first pulse and returns to between pulses (delay and off time): • Current: -7.35 A to 7.35 A • Voltage: -105 V to 105 V
  "Function (0:Voltage)": u16 = "Voltage"(0)  # The source function creates a Pulse Train as follows: • Voltage pulse train: VOLTage • Current pulse train: CURRent
  "Buffer Name": string = "defbuffer1"  # A string that indicates the reading buffer; the default buffers (defbuffer1 or defbuffer2) or the name of a user-defined buffer; if no buffer is specified, defbuffer1 is used.
  "Fail Abort": bool = TRUE  # Determines if the pulse train is stopped immediately if a limit is exceeded; options are: • Abort the pulse train if the source pulse limit is exceeded: ON (default) • Complete the pulse train if the source limit is exceeded: OFF
outputs:
  "VISA resource name out": "VISA Instr"  # A copy of the reference to the instrument in use. The reference to the resource name is created in the Initialize VI. Wire the VISA resource name out terminal of the Initialize VI to subsequent VISA resource name input terminals. You chain instrument driver VIs together by wiring the VISA resource name out terminal to subsequent VISA resource name input terminals.
  "error out": error
uses:
  NI::VISA::Write (Instr, String).gvi
  Labview_NXG_Keithley_SMU_2450_2460_2461::Utility::Error Query.gvi
diagram:
  Pick Line(line index=$"Function (0:Voltage)", multi-line string="VOLT\nCURR") -> (output string=w1)
  Select(s=$"Enable Measure", t="ON", f="OFF") -> w2
  Select(s=$"Fail Abort", t="ON", f="OFF") -> w3
  w4 = ":SOUR:PULS:TR:%s %f, %f, %f, %u, %s, \"%s\", %f, %f, %f, %f, %s;"
  Format Into String(formatString=w4, w1, $"Bias Level", $"Pulse Amplitude", $"Pulse Width", $"Pulse Count", w2, $"Buffer Name", $Delay, $"Pulse Off Time", $"Bias Limit", $"Pulse Limit", w3) -> w5
  call "Write (Instr, String).gvi"(session in=$"VISA resource name", error in=$"error in (no error)", write buffer=w5) -> (session out=w6, error out=w7)
  call "Error Query.gvi"(VISA resource name=w6, error in (no error)=w7) -> (VISA resource name out=w8, error out=w9)
  $"VISA resource name out" <- w8
  $"error out" <- w9
