vi "Configure Relative Offset.gvi"   [LabVIEW NXG 5.0.0]
# This command specifies the offset mode and relative offset value for the measurement.
inputs:
  "Function (0: Volts)": u16 = "Volts"(0)  # The function on which to configure offset compensation settings. The Digitize Voltage and Digitize Current functions are only compatible with the 2461.
  "VISA resource name": "VISA Instr", required
    # A reference to the instrument in use.  The reference to the resource name is created in the Initialize VI.  Therefore, before calling this VI, you need to call the Initialize VI.  To run this VI interactively, select the previously initialized resource name from the pull-down menu.  To run this VI programmatically, wire the VISA resource name out terminal of the Initialize VI to subsequent VISA resource name input terminals.  You chain instrument driver VIs together by wiring the VISA resource name out terminal to subsequent VISA resource name input terminals.
  "Offset Mode (0: First Reading)": u16 = "First Reading"(0)  # Determines whether the adjustment is provided manually or by the first measurement taken by the device.
  "Manual Offset (0)": f64  # The value of the manual offset. This value is only used if the Offset Mode is set to Manual. The relative offset value: • Current: -1 to 1 • Resistance: –200000000 to 200000000 • Voltage: -200 to 200
  "error in (no error)": error
  "Enable Releative Offset (T: Enable)": bool = TRUE  # Enable or disables offset compensation for the selected function.
outputs:
  "VISA resource name out": "VISA Instr"  # A copy of the reference to the instrument in use. The reference to the resource name is created in the Initialize VI. Wire the VISA resource name out terminal of the Initialize VI to subsequent VISA resource name input terminals. You chain instrument driver VIs together by wiring the VISA resource name out terminal to subsequent VISA resource name input terminals.
  "error out": error
uses:
  NI::VISA::Write (Instr, String).gvi
  Labview_NXG_Keithley_SMU_2450_2460_2461::Utility::Error Query.gvi
diagram:
  w1 = ":VOLT\n:CURR\n:RES\n:DIG:VOLT\n:DIG:CURR"  # Function
  Pick Line(line index=$"Function (0: Volts)", multi-line string=w1) -> (output string=w2)
  case ($"Enable Releative Offset (T: Enable)") {
    frame False, Default {
      Format Into String(formatString="%s:REL:STAT OFF;", w2) -> w3
    }
    frame True {
      case ($"Offset Mode (0: First Reading)") {
        frame 0, Default {
          Format Into String(formatString="%s:REL:ACQ;%s:REL:STAT ON;", w2, w2) -> w3
        }
        frame 1 {
          Format Into String(formatString="%.;%s:REL %g;%s:REL:STAT ON;", w2, $"Manual Offset (0)", w2) -> w3
        }
      }
    }
  }
  call "Write (Instr, String).gvi"(session in=$"VISA resource name", error in=$"error in (no error)", write buffer=w3) -> (session out=w4, error out=w5)
  call "Error Query.gvi"(VISA resource name=w4, error in (no error)=w5) -> (VISA resource name out=w6, error out=w7)
  $"VISA resource name out" <- w6
  $"error out" <- w7
