vi "Configure Settling Delay.gvi"   [LabVIEW NXG 5.0.0]
# Configures the delay between the setting of the source and the taking of the measurement.
inputs:
  "VISA resource name": "VISA Instr", required
    # A reference to the instrument in use.  The reference to the resource name is created in the Initialize VI.  Therefore, before calling this VI, you need to call the Initialize VI.  To run this VI interactively, select the previously initialized resource name from the pull-down menu.  To run this VI programmatically, wire the VISA resource name out terminal of the Initialize VI to subsequent VISA resource name input terminals.  You chain instrument driver VIs together by wiring the VISA resource name out terminal to subsequent VISA resource name input terminals.
  "Auto Delay (T: Enable)": bool = TRUE  # Automatically delays the acquisition after the source is adjusted in a multipoint operation or after the initiate in a single point operation.
  "Manual Delay (0 sec)": f64  # The manually set amount of time to delay after the source is adjusted in a multipoint operation or after the initiate in a single point operation. Valid Range: The delay in seconds (0 to 4).
  "error in (no error)": error
  "Function (0: Volts)": u16 = "Volts"(0)  # Selects the voltage or current source mode to be configured.
outputs:
  "VISA resource name out": "VISA Instr"  # A copy of the reference to the instrument in use. The reference to the resource name is created in the Initialize VI. Wire the VISA resource name out terminal of the Initialize VI to subsequent VISA resource name input terminals. You chain instrument driver VIs together by wiring the VISA resource name out terminal to subsequent VISA resource name input terminals.
  "error out": error
uses:
  NI::VISA::Write (Instr, String).gvi
  Labview_NXG_Keithley_SMU_2450_2460_2461::Utility::Error Query.gvi
diagram:
  w1 = "VOLT\nCURR"  # Function
  Pick Line(line index=$"Function (0: Volts)", multi-line string=w1) -> (output string=w2)
  Select(s=$"Auto Delay (T: Enable)", t="ON", f="OFF") -> w3
  Format Into String(formatString=":SOUR:%s:DEL:AUTO %s;", w2, w3) -> w4
  case ($"Auto Delay (T: Enable)") {
    frame False, Default {
      Format Into String(formatString=":SOUR:%s:DEL %g;", initString=w4, w2, $"Manual Delay (0 sec)") -> w5
    }
    frame True {
      w5 = w4
    }
  }
  call "Write (Instr, String).gvi"(session in=$"VISA resource name", error in=$"error in (no error)", write buffer=w5) -> (session out=w6, error out=w7)
  call "Error Query.gvi"(VISA resource name=w6, error in (no error)=w7) -> (VISA resource name out=w8, error out=w9)
  $"VISA resource name out" <- w8
  $"error out" <- w9
