vi "Configure Source Range.gvi"   [LabVIEW NXG 5.0.0]
# Configures the source range on the instrument.
inputs:
  "VISA resource name": "VISA Instr", required
    # A reference to the instrument in use.  The reference to the resource name is created in the Initialize VI.  Therefore, before calling this VI, you need to call the Initialize VI.  To run this VI interactively, select the previously initialized resource name from the pull-down menu.  To run this VI programmatically, wire the VISA resource name out terminal of the Initialize VI to subsequent VISA resource name input terminals.  You chain instrument driver VIs together by wiring the VISA resource name out terminal to subsequent VISA resource name input terminals.
  "Function (0: Volts)": u16 = "Volts"(0)  # Selects the voltage or current source mode to be configured.
  "Source Range (1.0)": f64 = 1  # Set the desired output range for the device. Valid Ranges: • Current: -1 A to 1 A • Voltage: -200 V to 200 V
  "error in (no error)": error
outputs:
  "VISA resource name out": "VISA Instr"  # A copy of the reference to the instrument in use. The reference to the resource name is created in the Initialize VI. Wire the VISA resource name out terminal of the Initialize VI to subsequent VISA resource name input terminals. You chain instrument driver VIs together by wiring the VISA resource name out terminal to subsequent VISA resource name input terminals.
  "error out": error
uses:
  NI::VISA::Write (Instr, String).gvi
  Labview_NXG_Keithley_SMU_2450_2460_2461::Utility::Error Query.gvi
diagram:
  w1 = ":SOUR:%s:RANG %g;"  # Manual Range
  w2 = "VOLT\nCURR"  # Function
  Pick Line(line index=$"Function (0: Volts)", multi-line string=w2) -> (output string=w3)
  Format Into String(formatString=w1, w3, $"Source Range (1.0)") -> w4
  call "Write (Instr, String).gvi"(session in=$"VISA resource name", error in=$"error in (no error)", write buffer=w4) -> (session out=w5, error out=w6)
  call "Error Query.gvi"(VISA resource name=w5, error in (no error)=w6) -> (VISA resource name out=w7, error out=w8)
  $"VISA resource name out" <- w7
  $"error out" <- w8
