vi "Configure Specific Limit Test.gvi"   [LabVIEW NXG 5.0.0]
# Configures limit testing settings, such as the enabling or disabling limit test, setting upper and lower limit.
inputs:
  "Function (0: Volts)": u16 = "Volts"(0)  # The function which is to be measured. Note: Voltage, Current, and Resistance measurements are always taken regardless of any VI calls.
  "VISA resource name": "VISA Instr", required
    # A reference to the instrument in use.  The reference to the resource name is created in the Initialize VI.  Therefore, before calling this VI, you need to call the Initialize VI.  To run this VI interactively, select the previously initialized resource name from the pull-down menu.  To run this VI programmatically, wire the VISA resource name out terminal of the Initialize VI to subsequent VISA resource name input terminals.  You chain instrument driver VIs together by wiring the VISA resource name out terminal to subsequent VISA resource name input terminals.
  "Limit Test Number (2)": u16 = 2  # The number of the test to configure. Note: Test #1 is reserved for compliance checking and Test #4 is reserved for the contact check option. Please use the Configure Special Limit Tests VI to configure those two tests.
  "Lower Limit (0)": f64  # The low end of valid range for the given test.
  "Upper Limit (1)": f64 = 1  # The high end of the valid range for the given test.
  "error in (no error)": error
  "Enable Limit Test (T:Enable)": bool = TRUE  # Enable or disable the selected limit test. Note: A limit test doesn't require a test with a lower number to be enabled before being allowed to be enabled.
outputs:
  "VISA resource name out": "VISA Instr"  # A copy of the reference to the instrument in use. The reference to the resource name is created in the Initialize VI. Wire the VISA resource name out terminal of the Initialize VI to subsequent VISA resource name input terminals. You chain instrument driver VIs together by wiring the VISA resource name out terminal to subsequent VISA resource name input terminals.
  "error out": error
uses:
  Labview_NXG_Keithley_SMU_2450_2460_2461::Configure::Enable Limit Test.gvi
  Labview_NXG_Keithley_SMU_2450_2460_2461::Configure::Configure Limit Test Upper Limit.gvi
  Labview_NXG_Keithley_SMU_2450_2460_2461::Configure::Configure Limit Test Lower Limit.gvi
diagram:
  call "Enable Limit Test.gvi"(VISA resource name=$"VISA resource name", Limit Test Number (2)=$"Limit Test Number (2)", Enable Limit Test (T:Enable)=$"Enable Limit Test (T:Enable)", Function (0: Volts)=$"Function (0: Volts)", error in (no error)=$"error in (no error)") -> (VISA resource name out=w1, error out=w2)
  call "Configure Limit Test Upper Limit.gvi"(VISA resource name=w1, Limit Test Number (1)=$"Limit Test Number (2)", Upper Limit (1)=$"Upper Limit (1)", Function (0: Volts)=$"Function (0: Volts)", error in (no error)=w2) -> (VISA resource name out=w3, error out=w4)
  # :CALCulate2:<function>:LIMit<y>:STATe <b>
  # :CALCulate2:<function>:LIMit<y>:LOWer[:DATA] <n>
  # :CALCulate2:<function>:LIMit<y>:UPPer[:DATA] <n>
  call "Configure Limit Test Lower Limit.gvi"(VISA resource name=w3, Limit Test Number (1)=$"Limit Test Number (2)", Lower Limit (-1.0)=$"Lower Limit (0)", Function (0: Volts)=$"Function (0: Volts)", error in (no error)=w4) -> (VISA resource name out=w5, error out=w6)
  $"VISA resource name out" <- w5
  $"error out" <- w6
