vi "Configure Trigger Model Blender Mode.gvi"   [LabVIEW NXG 5.0.0]
# This VI selects whether the blender performs OR operations or AND operations.
inputs:
  "VISA resource name": "VISA Instr"
    # A reference to the instrument in use.  The reference to the resource name is created in the Initialize VI.  Therefore, before calling this VI, you need to call the Initialize VI.  To run this VI interactively, select the previously initialized resource name from the pull-down menu.  To run this VI programmatically, wire the VISA resource name out terminal of the Initialize VI to subsequent VISA resource name input terminals.  You chain instrument driver VIs together by wiring the VISA resource name out terminal to subsequent VISA resource name input terminals.
  "Blender Number (1-2)": i32 = 1  # This control selects which blender logic state will be configured.
  "Orenable Mode (AND)": u16 = "AND"(0)  # This is the logic operation selected for a blender to be active. The orenable mode: • OR • AND
  "error in (no error)": error
outputs:
  "VISA resource name out": "VISA Instr"  # A copy of the reference to the instrument in use. The reference to the resource name is created in the Initialize VI. Wire the VISA resource name out terminal of the Initialize VI to subsequent VISA resource name input terminals. You chain instrument driver VIs together by wiring the VISA resource name out terminal to subsequent VISA resource name input terminals.
  "error out": error
uses:
  NI::VISA::Write (Instr, String).gvi
  Labview_NXG_Keithley_SMU_2450_2460_2461::Utility::Error Query.gvi
diagram:
  Pick Line(line index=$"Orenable Mode (AND)", multi-line string="AND\nOR") -> (output string=w1)
  Format Into String(formatString=":TRIG:BLEN%d:MODE %s", initString="", $"Blender Number (1-2)", w1) -> w2
  call "Write (Instr, String).gvi"(session in=$"VISA resource name", error in=$"error in (no error)", write buffer=w2) -> (session out=w3, error out=w4)
  call "Error Query.gvi"(VISA resource name=w3, error in (no error)=w4) -> (VISA resource name out=w5, error out=w6)
  $"VISA resource name out" <- w5
  $"error out" <- w6
