vi "Configure Trigger Model Digital Input Mode.gvi"   [LabVIEW NXG 5.0.0]
# This VI sets the logic on which the trigger event detector and the output trigger generator operate on the given trigger line.
inputs:
  "VISA resource name": "VISA Instr", required
    # A reference to the instrument in use.  The reference to the resource name is created in the Initialize VI.  Therefore, before calling this VI, you need to call the Initialize VI.  To run this VI interactively, select the previously initialized resource name from the pull-down menu.  To run this VI programmatically, wire the VISA resource name out terminal of the Initialize VI to subsequent VISA resource name input terminals.  You chain instrument driver VIs together by wiring the VISA resource name out terminal to subsequent VISA resource name input terminals.
  "Digital I/O line (1)": i32 = 1  # Digital I/O trigger line (1 to 6).
  "Trigger Mode (Falling)": u16 = "Falling"(0)  # Set <triggerLogic> to one of the following values: Trigger mode values: Falling: Detects falling-edge triggers as input when the line is configured as an input or open drain. Rising: Detects rising-edge triggers as input when the line is configured as an open drain. Either: Detects rising- or falling-edge triggers as input when the line is configured as an input or open drain.
  "error in (no error)": error
outputs:
  "VISA resource name out": "VISA Instr"  # A copy of the reference to the instrument in use. The reference to the resource name is created in the Initialize VI. Wire the VISA resource name out terminal of the Initialize VI to subsequent VISA resource name input terminals. You chain instrument driver VIs together by wiring the VISA resource name out terminal to subsequent VISA resource name input terminals.
  "error out": error
uses:
  NI::VISA::Write (Instr, String).gvi
  Labview_NXG_Keithley_SMU_2450_2460_2461::Utility::Error Query.gvi
diagram:
  Pick Line(line index=$"Trigger Mode (Falling)", multi-line string="FALL\nRIS\nEITH") -> (output string=w1)
  Format Into String(formatString=":TRIG:DIG%d:IN:EDGE %s", initString="", $"Digital I/O line (1)", w1) -> w2
  call "Write (Instr, String).gvi"(session in=$"VISA resource name", error in=$"error in (no error)", write buffer=w2) -> (session out=w3, error out=w4)
  call "Error Query.gvi"(VISA resource name=w3, error in (no error)=w4) -> (VISA resource name out=w5, error out=w6)
  $"VISA resource name out" <- w5
  $"error out" <- w6
