vi "Configure Trigger Model LAN Output Logic Mode.gvi"   [LabVIEW NXG 5.0.0]
# This VI sets the logic on which the trigger event detector and the output trigger generator operate on the given trigger line.
inputs:
  "VISA resource name": "VISA Instr"
    # A reference to the instrument in use.  The reference to the resource name is created in the Initialize VI.  Therefore, before calling this VI, you need to call the Initialize VI.  To run this VI interactively, select the previously initialized resource name from the pull-down menu.  To run this VI programmatically, wire the VISA resource name out terminal of the Initialize VI to subsequent VISA resource name input terminals.  You chain instrument driver VIs together by wiring the VISA resource name out terminal to subsequent VISA resource name input terminals.
  "LAN Event Number (1)": i32 = 1  # The LAN event number (1 to 8).
  "Logic Type (Negative)": u16 = "Negative"(1)  # Lan Trigger Logic can be either Positive or Negative.
  "error in (no error)": error
outputs:
  "VISA resource name out": "VISA Instr"  # A copy of the reference to the instrument in use. The reference to the resource name is created in the Initialize VI. Wire the VISA resource name out terminal of the Initialize VI to subsequent VISA resource name input terminals. You chain instrument driver VIs together by wiring the VISA resource name out terminal to subsequent VISA resource name input terminals.
  "error out": error
uses:
  NI::VISA::Write (Instr, String).gvi
  Labview_NXG_Keithley_SMU_2450_2460_2461::Utility::Error Query.gvi
diagram:
  # :TRIGger:LAN<n>:OUT:LOGic <logicType>
  Pick Line(line index=$"Logic Type (Negative)", multi-line string="POS\nNEG") -> (output string=w1)
  Format Into String(formatString=":TRIG:LAN%d:OUT:LOG %s", initString="", $"LAN Event Number (1)", w1) -> w2
  call "Write (Instr, String).gvi"(session in=$"VISA resource name", error in=$"error in (no error)", write buffer=w2) -> (session out=w3, error out=w4)
  call "Error Query.gvi"(VISA resource name=w3, error in (no error)=w4) -> (VISA resource name out=w5, error out=w6)
  $"VISA resource name out" <- w5
  $"error out" <- w6
