vi "Configure Trigger Model LAN Output Protocol.gvi"   [LabVIEW NXG 5.0.0]
# This VI sets the LAN protocol to use for sending trigger messages.
inputs:
  "VISA resource name": "VISA Instr", required
    # A reference to the instrument in use.  The reference to the resource name is created in the Initialize VI.  Therefore, before calling this VI, you need to call the Initialize VI.  To run this VI interactively, select the previously initialized resource name from the pull-down menu.  To run this VI programmatically, wire the VISA resource name out terminal of the Initialize VI to subsequent VISA resource name input terminals.  You chain instrument driver VIs together by wiring the VISA resource name out terminal to subsequent VISA resource name input terminals.
  "LAN Event Number (1)": i32 = 1  # The LAN event number (1 to 8).
  "Protocol (TCP)": u16 = "TCP"(0)  # The protocol to use for messages from the trigger: • TCP • UDP • MULTicast The LAN trigger listens for trigger messages on all the supported protocols. However, it uses the designated protocol for sending outgoing messages. After you change this setting, you must re-connect the LAN trigger event generator before you can send outgoing event messages. When multicast is selected, the trigger IP address is ignored and event messages are sent to the multicast address 224.0.23.159.
  "error in (no error)": error
outputs:
  "VISA resource name out": "VISA Instr"  # A copy of the reference to the instrument in use. The reference to the resource name is created in the Initialize VI. Wire the VISA resource name out terminal of the Initialize VI to subsequent VISA resource name input terminals. You chain instrument driver VIs together by wiring the VISA resource name out terminal to subsequent VISA resource name input terminals.
  "error out": error
uses:
  NI::VISA::Write (Instr, String).gvi
  Labview_NXG_Keithley_SMU_2450_2460_2461::Utility::Error Query.gvi
diagram:
  Pick Line(line index=$"Protocol (TCP)", multi-line string="TCP\nUDP\nMULT") -> (output string=w1)
  Format Into String(formatString=":TRIG:LAN%d:OUT:PROT %s", initString="", $"LAN Event Number (1)", w1) -> w2
  call "Write (Instr, String).gvi"(session in=$"VISA resource name", error in=$"error in (no error)", write buffer=w2) -> (session out=w3, error out=w4)
  call "Error Query.gvi"(VISA resource name=w3, error in (no error)=w4) -> (VISA resource name out=w5, error out=w6)
  $"VISA resource name out" <- w5
  $"error out" <- w6
