vi "Configure Trigger Model LAN Trigger Mode.gvi"   [LabVIEW NXG 5.0.0]
# This VI sets the trigger operation and detection mode of the specified LAN event.
inputs:
  "VISA resource name": "VISA Instr", required
    # A reference to the instrument in use.  The reference to the resource name is created in the Initialize VI.  Therefore, before calling this VI, you need to call the Initialize VI.  To run this VI interactively, select the previously initialized resource name from the pull-down menu.  To run this VI programmatically, wire the VISA resource name out terminal of the Initialize VI to subsequent VISA resource name input terminals.  You chain instrument driver VIs together by wiring the VISA resource name out terminal to subsequent VISA resource name input terminals.
  "LAN Event Number (1)": i32 = 1  # The LAN event number (1 to 8).
  "Trigger Mode (Either)": u16 = "Either"(0)  # Trigger mode values: Falling: Detects falling-edge triggers as input when the line is configured as an input or open drain. Rising: Detects rising-edge triggers as input when the line is configured as an open drain. Either: Detects rising- or falling-edge triggers as input when the line is configured as an input or open drain.
  "error in (no error)": error
outputs:
  "VISA resource name out": "VISA Instr"  # A copy of the reference to the instrument in use. The reference to the resource name is created in the Initialize VI. Wire the VISA resource name out terminal of the Initialize VI to subsequent VISA resource name input terminals. You chain instrument driver VIs together by wiring the VISA resource name out terminal to subsequent VISA resource name input terminals.
  "error out": error
uses:
  NI::VISA::Write (Instr, String).gvi
  Labview_NXG_Keithley_SMU_2450_2460_2461::Utility::Error Query.gvi
diagram:
  Pick Line(line index=$"Trigger Mode (Either)", multi-line string="EITH\nFALL\nRIS") -> (output string=w1)
  Format Into String(formatString=":TRIG:LAN%d:IN:EDGE %s", initString="", $"LAN Event Number (1)", w1) -> w2
  call "Write (Instr, String).gvi"(session in=$"VISA resource name", error in=$"error in (no error)", write buffer=w2) -> (session out=w3, error out=w4)
  # :TRIGger:LAN<n>:IN:EDGE <mode>
  call "Error Query.gvi"(VISA resource name=w3, error in (no error)=w4) -> (VISA resource name out=w5, error out=w6)
  $"VISA resource name out" <- w5
  $"error out" <- w6
