vi "Configure Trigger Model Measure Block.gvi"   [LabVIEW NXG 5.0.0]
# This VI defines a trigger block that makes a measurement.The trigger model waits for the measurement to complete.The instrument places the measurement into the specified reading buffer. If no buffer is specified, the reading is placed into the default buffer (defbuffer1).
inputs:
  "VISA resource name": "VISA Instr", required
    # A reference to the instrument in use.  The reference to the resource name is created in the Initialize VI.  Therefore, before calling this VI, you need to call the Initialize VI.  To run this VI interactively, select the previously initialized resource name from the pull-down menu.  To run this VI programmatically, wire the VISA resource name out terminal of the Initialize VI to subsequent VISA resource name input terminals.  You chain instrument driver VIs together by wiring the VISA resource name out terminal to subsequent VISA resource name input terminals.
  "Block Number (1)": i32 = 1  # The sequence of the block in the trigger flow model.
  "Buffer Name (defbuffer1)": string = "defbuffer1"  # The name of the buffer measurements will be stored in.
  "error in (no error)": error
outputs:
  "VISA resource name out": "VISA Instr"  # A copy of the reference to the instrument in use. The reference to the resource name is created in the Initialize VI. Wire the VISA resource name out terminal of the Initialize VI to subsequent VISA resource name input terminals. You chain instrument driver VIs together by wiring the VISA resource name out terminal to subsequent VISA resource name input terminals.
  "error out": error
uses:
  NI::G Core::Strings::Append True Or False String.gvi
  NI::VISA::Write (Instr, String).gvi
  Labview_NXG_Keithley_SMU_2450_2460_2461::Utility::Error Query.gvi
diagram:
  Format Into String(formatString=":TRIG:BLOC:MEAS %d", initString="", $"Block Number (1)") -> w1
  Format Into String(formatString=",\"%s\";", $"Buffer Name (defbuffer1)") -> w2
  Is Equal(x="", y=$"Buffer Name (defbuffer1)") -> w3
  call "Append True Or False String.gvi"(string=w1, true string=";", false string=w2, selector=w3) -> (output string=w4)
  call "Write (Instr, String).gvi"(session in=$"VISA resource name", error in=$"error in (no error)", write buffer=w4) -> (session out=w5, error out=w6)
  call "Error Query.gvi"(VISA resource name=w5, error in (no error)=w6) -> (VISA resource name out=w7, error out=w8)
  $"VISA resource name out" <- w7
  $"error out" <- w8
