vi "Configure Trigger Model Once Excluded Block.gvi"   [LabVIEW NXG 5.0.0]
# This VI causes the trigger model to go to a specified building block every time the trigger model encounters it, except for the first time
inputs:
  "VISA resource name": "VISA Instr", required
    # A reference to the instrument in use.  The reference to the resource name is created in the Initialize VI.  Therefore, before calling this VI, you need to call the Initialize VI.  To run this VI interactively, select the previously initialized resource name from the pull-down menu.  To run this VI programmatically, wire the VISA resource name out terminal of the Initialize VI to subsequent VISA resource name input terminals.  You chain instrument driver VIs together by wiring the VISA resource name out terminal to subsequent VISA resource name input terminals.
  "Block Number (1)": i32 = 1  # The sequence of the block in the trigger flow model.
  "Branch Path (1)": i32 = 1  # The block number of the trigger model block to execute when the trigger model encounters this block after the first encounter.
  "error in (no error)": error
outputs:
  "VISA resource name out": "VISA Instr"  # A copy of the reference to the instrument in use. The reference to the resource name is created in the Initialize VI. Wire the VISA resource name out terminal of the Initialize VI to subsequent VISA resource name input terminals. You chain instrument driver VIs together by wiring the VISA resource name out terminal to subsequent VISA resource name input terminals.
  "error out": error
uses:
  NI::VISA::Write (Instr, String).gvi
  Labview_NXG_Keithley_SMU_2450_2460_2461::Utility::Error Query.gvi
diagram:
  Format Into String(formatString=":TRIG:BLOC:BRAN:ONCE:EXCL %d,%d;", initString="", $"Block Number (1)", $"Branch Path (1)") -> w1
  call "Write (Instr, String).gvi"(session in=$"VISA resource name", error in=$"error in (no error)", write buffer=w1) -> (session out=w2, error out=w3)
  call "Error Query.gvi"(VISA resource name=w2, error in (no error)=w3) -> (VISA resource name out=w4, error out=w5)
  $"VISA resource name out" <- w4
  $"error out" <- w5
