vi "Configure Trigger Model Recall Configuration List Block.gvi"   [LabVIEW NXG 5.0.0]
# This VI recalls the system settings that are stored in a measure or source configuration list.
inputs:
  "VISA resource name": "VISA Instr"
    # A reference to the instrument in use.  The reference to the resource name is created in the Initialize VI.  Therefore, before calling this VI, you need to call the Initialize VI.  To run this VI interactively, select the previously initialized resource name from the pull-down menu.  To run this VI programmatically, wire the VISA resource name out terminal of the Initialize VI to subsequent VISA resource name input terminals.  You chain instrument driver VIs together by wiring the VISA resource name out terminal to subsequent VISA resource name input terminals.
  "Block Number (1)": i32 = 1  # The sequence of the block in the trigger flow model.
  "Configuration List Name": string  # The measure or source configuration list to recall.
  "Enable Index (False)": bool  # If enabled, this will allow the specific point in the configuration list to be applied. If disabled, the first point in the configuration list is recalled.
  "Index (1)": i32 = 1  # The point in the configuration list to recall.
  "error in (no error)": error
outputs:
  "VISA resource name out": "VISA Instr"  # A copy of the reference to the instrument in use. The reference to the resource name is created in the Initialize VI. Wire the VISA resource name out terminal of the Initialize VI to subsequent VISA resource name input terminals. You chain instrument driver VIs together by wiring the VISA resource name out terminal to subsequent VISA resource name input terminals.
  "error out": error
uses:
  NI::G Core::Strings::Append True Or False String.gvi
  NI::VISA::Write (Instr, String).gvi
  Labview_NXG_Keithley_SMU_2450_2460_2461::Utility::Error Query.gvi
diagram:
  Format Into String(formatString=":TRIG:BLOC:CONF:REC %d,\"%s\"", initString="", $"Block Number (1)", $"Configuration List Name") -> w1
  Format Into String(formatString=",%d;", $"Index (1)") -> w2
  call "Append True Or False String.gvi"(string=w1, true string=w2, false string=";", selector=$"Enable Index (False)") -> (output string=w3)
  call "Write (Instr, String).gvi"(session in=$"VISA resource name", error in=$"error in (no error)", write buffer=w3) -> (session out=w4, error out=w5)
  call "Error Query.gvi"(VISA resource name=w4, error in (no error)=w5) -> (VISA resource name out=w6, error out=w7)
  $"VISA resource name out" <- w6
  $"error out" <- w7
