vi "Configure Trigger Model.gvi"   [LabVIEW NXG 5.0.0]
# Configures the trigger model similar to 2400 model.
inputs:
  "VISA resource name": "VISA Instr"
    # A reference to the instrument in use.  The reference to the resource name is created in the Initialize VI.  Therefore, before calling this VI, you need to call the Initialize VI.  To run this VI interactively, select the previously initialized resource name from the pull-down menu.  To run this VI programmatically, wire the VISA resource name out terminal of the Initialize VI to subsequent VISA resource name input terminals.  You chain instrument driver VIs together by wiring the VISA resource name out terminal to subsequent VISA resource name input terminals.
  "Buffer Name (defbuffer1)": string = "defbuffer1"  # The name of the buffer that measurements will be stored to.
  "Number of Times to repeat (1)": i32 = 1  # The number of times the instrument will arm before returning to the idle state.
  "Timer Interval (1us)": f64 = 5e-05  # The interval of time to wait before arming the trigger.
  "Trigger Count (1)": i32 = 1  # The number of triggers to be performed for each trigger arming.
  "error in (no error)": error
  "Trigger Delay (1 us)": f64 = 5e-05  # The amount of time to delay after the trigger has been acquired Valid Range: 0 to 999.99 seconds.
outputs:
  "VISA resource name out": "VISA Instr"  # A copy of the reference to the instrument in use. The reference to the resource name is created in the Initialize VI. Wire the VISA resource name out terminal of the Initialize VI to subsequent VISA resource name input terminals. You chain instrument driver VIs together by wiring the VISA resource name out terminal to subsequent VISA resource name input terminals.
  "error out": error
uses:
  NI::VISA::Write (Instr, String).gvi
  Labview_NXG_Keithley_SMU_2450_2460_2461::Utility::Error Query.gvi
diagram:
  w1 = """:TRIG:BLOC:BUFF:CLE 1,"%s";
:TRIG:BLOC:BRAN:ONCE 2,4;
:TRIG:BLOC:DEL:CONS 3,%g;
:TRIG:BLOC:DEL:CONS 4,%g;
:TRIG:BLOC:MEAS 5,"%s";
:TRIG:BLOC:BRAN:COUN 6,%d,4;
:TRIG:BLOC:BRAN:COUN 7,%d,2;"""
  # :TRIGger:BLOCk:BUFFer:CLEar <blockNumber>, <bufferName>
  # :TRIGger:BLOCk:DELay:CONStant<block Number>, <seconds>
  # TRIGger:BLOCk:MEASure <blockNumber>, <bufferName
  Is Equal To 0(x=$"Timer Interval (1us)") -> w2
  Select(s=w2, t=5e-05, f=$"Timer Interval (1us)") -> w3
  Is Equal To 0(x=$"Trigger Delay (1 us)") -> w4
  Select(s=w4, t=5e-05, f=$"Trigger Delay (1 us)") -> w5
  Is Equal(x="", y=$"Buffer Name (defbuffer1)") -> w6
  Select(s=w6, t="defbuffer1", f=$"Buffer Name (defbuffer1)") -> w7
  Format Into String(formatString=w1, w7, w3, w5, w7, $"Trigger Count (1)", $"Number of Times to repeat (1)") -> w8
  call "Write (Instr, String).gvi"(session in=$"VISA resource name", error in=$"error in (no error)", write buffer=w8) -> (session out=w9, error out=w10)
  call "Error Query.gvi"(VISA resource name=w9, error in (no error)=w10) -> (VISA resource name out=w11, error out=w12)
  $"VISA resource name out" <- w11
  $"error out" <- w12
  # :TRIGger:BLOCk:BRANch:ONCE:EXCLuded <blockNumber>, <branchPath>
  # :TRIGger:BLOCk:BRANch:COUNter <blockNumber>, <targetCount>, <branchPath>
