vi "Delete Configuration List.gvi"   [LabVIEW NXG 5.0.0]
# Deletes a Measure or Source Configuration List
inputs:
  "VISA resource name": "VISA Instr"
    # A reference to the instrument in use.  The reference to the resource name is created in the Initialize VI.  Therefore, before calling this VI, you need to call the Initialize VI.  To run this VI interactively, select the previously initialized resource name from the pull-down menu.  To run this VI programmatically, wire the VISA resource name out terminal of the Initialize VI to subsequent VISA resource name input terminals.  You chain instrument driver VIs together by wiring the VISA resource name out terminal to subsequent VISA resource name input terminals.
  "Configuration List Type (0: Measure)": u16 = "Measure"(0)  # Select the type of Configuration List : Source or Measure
  "Configuration List Name": string  # The name of the configuration list to delete.
  "Delete Configuration Point (T:Yes)": bool = TRUE  # If Delete Configuration Point is True it deletes only the configuration point specified in the Configuration List. If Delete Configuration Point is False it deletes the entire Configuration List Specified.
  "Configuration Point Index (1)": u32 = 1  # The index in the configuration list that will be deleted.
  "error in (no error)": error
outputs:
  "VISA resource name out": "VISA Instr"  # A copy of the reference to the instrument in use. The reference to the resource name is created in the Initialize VI. Wire the VISA resource name out terminal of the Initialize VI to subsequent VISA resource name input terminals. You chain instrument driver VIs together by wiring the VISA resource name out terminal to subsequent VISA resource name input terminals.
  "error out": error
uses:
  NI::G Core::Strings::Append True Or False String.gvi
  NI::VISA::Write (Instr, String).gvi
  Labview_NXG_Keithley_SMU_2450_2460_2461::Utility::Error Query.gvi
diagram:
  w1 = "SENS\nSOUR"  # Function
  Pick Line(line index=$"Configuration List Type (0: Measure)", multi-line string=w1) -> (output string=w2)
  Format Into String(formatString=":%s:CONF:LIST:DEL \"%s\"", w2, $"Configuration List Name") -> w3
  Format Into String(formatString=",%d;", $"Configuration Point Index (1)") -> w4
  call "Append True Or False String.gvi"(string=w3, true string=w4, false string=";", selector=$"Delete Configuration Point (T:Yes)") -> (output string=w5)
  call "Write (Instr, String).gvi"(session in=$"VISA resource name", error in=$"error in (no error)", write buffer=w5) -> (session out=w6, error out=w7)
  call "Error Query.gvi"(VISA resource name=w6, error in (no error)=w7) -> (VISA resource name out=w8, error out=w9)
  $"VISA resource name out" <- w8
  $"error out" <- w9
