vi "Digitizer Aperture.gvi"   [LabVIEW NXG 5.0.0]
# This command determines the aperture setting for the selected function.
# The Digitizer Voltage and Digitizer Current functions are only compatible with the 2461.
inputs:
  "VISA resource name": "VISA Instr" = "USB0::0x05E6::0x2461::04090176::INSTR"
    # A reference to the instrument in use.  The reference to the resource name is created in the Initialize VI.  Therefore, before calling this VI, you need to call the Initialize VI.  To run this VI interactively, select the previously initialized resource name from the pull-down menu.  To run this VI programmatically, wire the VISA resource name out terminal of the Initialize VI to subsequent VISA resource name input terminals.  You chain instrument driver VIs together by wiring the VISA resource name out terminal to subsequent VISA resource name input terminals.
  "Digitize Function (Voltage)": u16 = "Voltage"(0)  # Set this command to the type of digitize measurement you want to set the aperture for.
  "Aperture (.000001)": f64 = 1e-05  # This attribute determines the aperture setting for the selected function. Range: 1us to 1ms; set in 1us increments.
  "Auto Aperture": bool = TRUE  # This attribute set the aperture setting for the selected function to Auto aperture.
  "error in (no error)": error
outputs:
  "VISA resource name out": "VISA Instr"  # A copy of the reference to the instrument in use. The reference to the resource name is created in the Initialize VI. Wire the VISA resource name out terminal of the Initialize VI to subsequent VISA resource name input terminals. You chain instrument driver VIs together by wiring the VISA resource name out terminal to subsequent VISA resource name input terminals.
  "error out": error
uses:
  NI::VISA::Write (Instr, String).gvi
  Labview_NXG_Keithley_SMU_2450_2460_2461::Utility::Error Query.gvi
diagram:
  case ($"Auto Aperture") {
    frame False, Default {
      Pick Line(line index=$"Digitize Function (Voltage)", multi-line string="DIG:VOLT:APER \nDIG:CURR:APER ") -> (output string=w2)
      Format Value(format string="%s ", string=w2, value=$"Aperture (.000001)") -> (output string=w1)
    }
    frame True {
      Pick Line(line index=$"Digitize Function (Voltage)", multi-line string="DIG:VOLT:APER AUTO \nDIG:CURR:APER AUTO") -> (output string=w1)
    }
  }
  call "Write (Instr, String).gvi"(session in=$"VISA resource name", error in=$"error in (no error)", write buffer=w1) -> (session out=w3, error out=w4)
  call "Error Query.gvi"(VISA resource name=w3, error in (no error)=w4) -> (VISA resource name out=w5, error out=w6)
  $"VISA resource name out" <- w5
  $"error out" <- w6
