vi "Digitizer Sample Rate.gvi"   [LabVIEW NXG 5.0.0]
# This command defines the precise acquisition rate at which the digitizing measurements are made.
# The Digitizer Voltage and Digitizer Current functions are only compatible with the 2461.
inputs:
  "VISA resource name": "VISA Instr" = "USB0::0x05E6::0x2461::04090176::INSTR"
    # A reference to the instrument in use.  The reference to the resource name is created in the Initialize VI.  Therefore, before calling this VI, you need to call the Initialize VI.  To run this VI interactively, select the previously initialized resource name from the pull-down menu.  To run this VI programmatically, wire the VISA resource name out terminal of the Initialize VI to subsequent VISA resource name input terminals.  You chain instrument driver VIs together by wiring the VISA resource name out terminal to subsequent VISA resource name input terminals.
  "Digitize Function (Voltage)": u16 = "Digitize Voltage"(0)  # The digitize function: • Digitize current: DIGitize:CURRent • Digitize voltage: DIGitize:VOLTage
  "Sample Rate (100000)": u32 = 100000  # Sample Rate: 1,000 to 1,000,000 readings per second The sample rate determines how fast the Model 2461 acquires a digitized reading. Set the sample rate before setting the aperture. If the aperture setting is too high for the selected sample rate, it is automatically adjusted to the highest aperture that can be used with the sample rate.
  "error in (no error)": error
outputs:
  "VISA resource name out": "VISA Instr"  # A copy of the reference to the instrument in use. The reference to the resource name is created in the Initialize VI. Wire the VISA resource name out terminal of the Initialize VI to subsequent VISA resource name input terminals. You chain instrument driver VIs together by wiring the VISA resource name out terminal to subsequent VISA resource name input terminals.
  "error out": error
uses:
  NI::VISA::Write (Instr, String).gvi
  Labview_NXG_Keithley_SMU_2450_2460_2461::Utility::Error Query.gvi
diagram:
  Pick Line(line index=$"Digitize Function (Voltage)", multi-line string="DIG:VOLT:SRATE \nDIG:CURR:SRATE ") -> (output string=w1)
  Format Into String(formatString="%d", initString=w1, $"Sample Rate (100000)") -> w2
  call "Write (Instr, String).gvi"(session in=$"VISA resource name", error in=$"error in (no error)", write buffer=w2) -> (session out=w3, error out=w4)
  call "Error Query.gvi"(VISA resource name=w3, error in (no error)=w4) -> (VISA resource name out=w5, error out=w6)
  $"VISA resource name out" <- w5
  $"error out" <- w6
