vi "Enable Math Operation.gvi"   [LabVIEW NXG 5.0.0]
# Enables or Disables math operation.
inputs:
  "VISA resource name": "VISA Instr", required
    # A reference to the instrument in use.  The reference to the resource name is created in the Initialize VI.  Therefore, before calling this VI, you need to call the Initialize VI.  To run this VI interactively, select the previously initialized resource name from the pull-down menu.  To run this VI programmatically, wire the VISA resource name out terminal of the Initialize VI to subsequent VISA resource name input terminals.  You chain instrument driver VIs together by wiring the VISA resource name out terminal to subsequent VISA resource name input terminals.
  "Function (0: Volts)": u16 = "Volts"(0)  # The function which is to be measured. Note: Voltage, Current, and Resistance measurements are always taken regardless of any VI calls. The Digitize Voltage and Digitize Current functions are only compatible with the 2461.
  "Enable Math Operations (T:Enable)": bool  # Enable math operations: ON or 1. Disable math operations: OFF or 0.
  "error in (no error)": error
outputs:
  "VISA resource name out": "VISA Instr"  # A copy of the reference to the instrument in use. The reference to the resource name is created in the Initialize VI. Wire the VISA resource name out terminal of the Initialize VI to subsequent VISA resource name input terminals. You chain instrument driver VIs together by wiring the VISA resource name out terminal to subsequent VISA resource name input terminals.
  "error out": error
uses:
  NI::VISA::Write (Instr, String).gvi
  Labview_NXG_Keithley_SMU_2450_2460_2461::Utility::Error Query.gvi
diagram:
  w1 = "VOLT\nCURR\nRES\nDIG:VOLT\nDIG:CURR"  # Function
  Pick Line(line index=$"Function (0: Volts)", multi-line string=w1) -> (output string=w2)
  Select(s=$"Enable Math Operations (T:Enable)", t="ON", f="OFF") -> w3
  Format Into String(formatString=":CALC1:%s:MATH:STAT %s;", w2, w3) -> w4
  call "Write (Instr, String).gvi"(session in=$"VISA resource name", error in=$"error in (no error)", write buffer=w4) -> (session out=w5, error out=w6)
  call "Error Query.gvi"(VISA resource name=w5, error in (no error)=w6) -> (VISA resource name out=w7, error out=w8)
  $"VISA resource name out" <- w7
  $"error out" <- w8
