vi "Enable Source Read Back.gvi"   [LabVIEW NXG 5.0.0]
# Enable or disable source read back on the instrument for the selected function.
inputs:
  "VISA resource name": "VISA Instr", required
    # A reference to the instrument in use.  The reference to the resource name is created in the Initialize VI.  Therefore, before calling this VI, you need to call the Initialize VI.  To run this VI interactively, select the previously initialized resource name from the pull-down menu.  To run this VI programmatically, wire the VISA resource name out terminal of the Initialize VI to subsequent VISA resource name input terminals.  You chain instrument driver VIs together by wiring the VISA resource name out terminal to subsequent VISA resource name input terminals.
  "Function (0: Volts)": u16 = "Volts"(0)  # Selects the voltage or current source mode to be configured.
  "Enable Read Back (T:Enable)": bool = TRUE  # Enables or disables Source Read Back on the instrument.
  "error in (no error)": error
outputs:
  "VISA resource name out": "VISA Instr"  # A copy of the reference to the instrument in use. The reference to the resource name is created in the Initialize VI. Wire the VISA resource name out terminal of the Initialize VI to subsequent VISA resource name input terminals. You chain instrument driver VIs together by wiring the VISA resource name out terminal to subsequent VISA resource name input terminals.
  "error out": error
uses:
  NI::VISA::Write (Instr, String).gvi
  Labview_NXG_Keithley_SMU_2450_2460_2461::Utility::Error Query.gvi
diagram:
  w1 = ":SOUR:%s:READ:BACK %s;"  # Auto Range
  w2 = "VOLT\nCURR"  # Function
  Pick Line(line index=$"Function (0: Volts)", multi-line string=w2) -> (output string=w3)
  Select(s=$"Enable Read Back (T:Enable)", t="ON", f="OFF") -> w4
  Format Into String(formatString=w1, w3, w4) -> w5
  call "Write (Instr, String).gvi"(session in=$"VISA resource name", error in=$"error in (no error)", write buffer=w5) -> (session out=w6, error out=w7)
  call "Error Query.gvi"(VISA resource name=w6, error in (no error)=w7) -> (VISA resource name out=w8, error out=w9)
  $"VISA resource name out" <- w8
  $"error out" <- w9
