vi "Get All Delay Info.gvi"   [LabVIEW NXG 5.0.0]
inputs:
  "VISA Resource Name In": "VISA Instr"
  "Error In": error
outputs:
  "Delay Info Cluster": T1
  "VISA resource name out": "VISA Instr"
  "Error Out": error
types:
  T1 = cluster{"Trigger Delay": f64, "Auto delay Enabled? Volts": bool, "Auto delay Enabled? Curr": bool, "Delay Time Volts": f64, "Delay Time Curr": f64, "Voltage Measure Delay": f64, "Curr Measure Delay": f64, "Auto Zero Enabled? Volts": bool, "Auto Zero Enabled? Curr": bool}
uses:
  Labview_NXG_Keithley_SMU_2450_2460_2461::Configure::Get Trigger Timer Delay.gvi
  Labview_NXG_Keithley_SMU_2450_2460_2461::Configure::Get Source Auto Delay State.gvi
  Labview_NXG_Keithley_SMU_2450_2460_2461::Configure::Get Source User Delay.gvi
  Labview_NXG_Keithley_SMU_2450_2460_2461::Configure::Get Measure User Delay.gvi
  Labview_NXG_Keithley_SMU_2450_2460_2461::Configure::Get Autozero State.gvi
diagram:
  case ($"Error In") {
    frame Error, Default {
      w1 = $"Error In"
      w2 = $"VISA Resource Name In"
      w3 = default
    }
    frame No Error {
      call "Get Trigger Timer Delay.gvi"(VISA resource name=$"VISA Resource Name In", error in (no error)=$"Error In") -> (VISA resource name out=w4, Delay=w5, error out=w6)
      call "Get Source Auto Delay State.gvi"(VISA resource name=w4, Function (0: Volts)="Volts"(0), error in (no error)=w6) -> (VISA resource name out=w7, Auto Delay Enabled?=w8, error out=w9)
      call "Get Source Auto Delay State.gvi"(VISA resource name=w7, Function (0: Volts)="Current"(1), error in (no error)=w9) -> (VISA resource name out=w10, Auto Delay Enabled?=w11, error out=w12)
      call "Get Source User Delay.gvi"(VISA resource name=w10, Function (0: Volts)="Volts"(0), error in (no error)=w12) -> (VISA resource name out=w13, Delay Time=w14, error out=w15)
      call "Get Source User Delay.gvi"(VISA resource name=w13, Function (0: Volts)="Current"(1), error in (no error)=w15) -> (VISA resource name out=w16, Delay Time=w17, error out=w18)
      call "Get Measure User Delay.gvi"(VISA resource name=w16, Function (0: Volts)="Volts"(0), error in (no error)=w18) -> (VISA resource name out=w19, Delay Time=w20, error out=w21)
      call "Get Measure User Delay.gvi"(VISA resource name=w19, Function (0: Volts)="Current"(1), error in (no error)=w21) -> (VISA resource name out=w22, Delay Time=w23, error out=w24)
      call "Get Autozero State.gvi"(VISA resource name=w22, Function (0: Volts)="Volts"(0), error in (no error)=w24) -> (VISA resource name out=w25, Auto Zero Enabled?=w26, error out=w27)
      call "Get Autozero State.gvi"(VISA resource name=w25, Function (0: Volts)="Current"(1), error in (no error)=w27) -> (VISA resource name out=w2, Auto Zero Enabled?=w28, error out=w1)
      Property Node(instance in=T1 {all zero or empty}, "Trigger Delay"=w5, "Auto delay Enabled? Volts"=w8, "Auto delay Enabled? Curr"=w11, "Delay Time Volts"=w14, "Delay Time Curr"=w17, "Voltage Measure Delay"=w20, "Curr Measure Delay"=w23, "Auto Zero Enabled? Volts"=w26, "Auto Zero Enabled? Curr"=w28) -> (instance out=w3)
    }
  }
  $"VISA resource name out" <- w2
  $"Error Out" <- w1
  $"Delay Info Cluster" <- w3
