vi "Get Buffer Size.gvi"   [LabVIEW NXG 5.0.0]
# This indicates the number of readings a buffer can store.
inputs:
  "VISA resource name": "VISA Instr", required
    # A reference to the instrument in use.  The reference to the resource name is created in the Initialize VI.  Therefore, before calling this VI, you need to call the Initialize VI.  To run this VI interactively, select the previously initialized resource name from the pull-down menu.  To run this VI programmatically, wire the VISA resource name out terminal of the Initialize VI to subsequent VISA resource name input terminals.  You chain instrument driver VIs together by wiring the VISA resource name out terminal to subsequent VISA resource name input terminals.
  "Buffer Name (defbuffer1)": string = "defbuffer1"  # The name of the buffer to query for its size.
  "error in (no error)": error
outputs:
  "VISA resource name out": "VISA Instr"  # A copy of the reference to the instrument in use. The reference to the resource name is created in the Initialize VI. Wire the VISA resource name out terminal of the Initialize VI to subsequent VISA resource name input terminals. You chain instrument driver VIs together by wiring the VISA resource name out terminal to subsequent VISA resource name input terminals.
  "Buffer Size": i32  # The number of readings that can be stored in the specified buffer.
  "error out": error
uses:
  NI::VISA::Write (Instr, String).gvi
  NI::VISA::Read (Instr, String).gvi
  Labview_NXG_Keithley_SMU_2450_2460_2461::Utility::Error Query.gvi
diagram:
  Is Equal(x="", y=$"Buffer Name (defbuffer1)") -> w1
  Select(s=w1, t="defbuffer1", f=$"Buffer Name (defbuffer1)") -> w2
  Format Into String(formatString=":TRAC:POIN? \"%s\"", w2) -> w3
  call "Write (Instr, String).gvi"(session in=$"VISA resource name", error in=$"error in (no error)", write buffer=w3) -> (session out=w4, error out=w5)
  call "Read (Instr, String).gvi"(session in=w4, error in=w5, byte count=128) -> (session out=w6, error out=w7, read buffer=w8)
  Decimal String To Number(string=w8) -> (number=w9)
  $"Buffer Size" <- w9
  call "Error Query.gvi"(VISA resource name=w6, error in (no error)=w7) -> (VISA resource name out=w10, error out=w11)
  $"VISA resource name out" <- w10
  $"error out" <- w11
