vi "Get Conact Check State.gvi"   [LabVIEW NXG 5.0.0]
# Use this function to check for excessive contact resistance at any of the connections to the device
# under test (DUT). This function will return an error if Contact Check is not enabled.
# The Digitizer Voltage and Digitizer Current functions are only compatible with the 2461.
inputs:
  "VISA resource name": "VISA Instr" = "USB0::0x05E6::0x2461::04090176::INSTR"
    # A reference to the instrument in use.  The reference to the resource name is created in the Initialize VI.  Therefore, before calling this VI, you need to call the Initialize VI.  To run this VI interactively, select the previously initialized resource name from the pull-down menu.  To run this VI programmatically, wire the VISA resource name out terminal of the Initialize VI to subsequent VISA resource name input terminals.  You chain instrument driver VIs together by wiring the VISA resource name out terminal to subsequent VISA resource name input terminals.
  "Connections (0: ANY)": u16 = "ANY"(0)  # ANY: Check if contact check operations passed. ALL: Check if contact check operations passed, with the ability to determine which connection failed; high, low or guard.
  "error in (no error)": error
outputs:
  "All Contact Checks Pass": bool  # The result of the contact check operation: • true: All connections passed the contact check • false: One or more connections failed the contact check
  "VISA resource name out": "VISA Instr"  # A copy of the reference to the instrument in use. The reference to the resource name is created in the Initialize VI. Wire the VISA resource name out terminal of the Initialize VI to subsequent VISA resource name input terminals. You chain instrument driver VIs together by wiring the VISA resource name out terminal to subsequent VISA resource name input terminals.
  "Low Check Pass": bool  # The result of the contact check operation for the low connection: • true: The connection did not exceed the threshold resistance value • false: The connection exceeded the threshold resistance value
  "Guard Check Pass": bool  # The result of the contact check operation for the guard connection: • true: The connection did not exceed the threshold resistance value • false: The connection exceeded the threshold resistance value
  "error out": error
  "Hi Check Pass": bool  # The result of the contact check operation for the high connection: • true: The connection did not exceed the threshold resistance value • false: The connection exceeded the threshold resistance value
uses:
  NI::VISA::Write (Instr, String).gvi
  NI::VISA::Read (Instr, String).gvi
  NI::G Core::Strings::Trim Whitespace.gvi
  Labview_NXG_Keithley_SMU_2450_2460_2461::Utility::Error Query.gvi
diagram:
  Pick Line(line index=$"Connections (0: ANY)", multi-line string=":SYStem:CCHeck?;\n:SYStem:CCHeck:ALL?") -> (output string=w1)
  call "Write (Instr, String).gvi"(session in=$"VISA resource name", error in=$"error in (no error)", write buffer=w1) -> (session out=w2, error out=w3)
  case ($"Connections (0: ANY)") {
    frame 0, Default {
      call "Read (Instr, String).gvi"(session in=w2, error in=w3, byte count=128) -> (session out=w7, error out=w8, read buffer=w10)
      call "Trim Whitespace.gvi"(string=w10) -> (trimmed string=w11)
      Is Equal(x=w11, y="1") -> w9
      w4 = FALSE
      w5 = FALSE
      w6 = FALSE
    }
    frame 1 {
      call "Read (Instr, String).gvi"(session in=w2, error in=w3, byte count=128) -> (session out=w7, error out=w8, read buffer=w12)
      call "Trim Whitespace.gvi"(string=w12) -> (trimmed string=w13)
      Scan From String(formatString="%1s,%1s,%1s", inputString=w13) -> (out0=w14, out1=w15, out2=w16)
      Is Equal(x=w14, y="1") -> w4
      Is Equal(x=w15, y="1") -> w5
      Is Equal(x=w16, y="1") -> w6
      w9 = FALSE
    }
  }
  $"Hi Check Pass" <- w4
  $"Low Check Pass" <- w5
  $"Guard Check Pass" <- w6
  $"All Contact Checks Pass" <- w9
  call "Error Query.gvi"(VISA resource name=w7, error in (no error)=w8) -> (VISA resource name out=w17, error out=w18)
  $"VISA resource name out" <- w17
  $"error out" <- w18
