vi "Get High Capacitance State.gvi"   [LabVIEW NXG 5.0.0]
# Gets state of High Capacitance mode on the instrument for both V and I.
inputs:
  "VISA resource name": "VISA Instr", required
    # A reference to the instrument in use.  The reference to the resource name is created in the Initialize VI.  Therefore, before calling this VI, you need to call the Initialize VI.  To run this VI interactively, select the previously initialized resource name from the pull-down menu.  To run this VI programmatically, wire the VISA resource name out terminal of the Initialize VI to subsequent VISA resource name input terminals.  You chain instrument driver VIs together by wiring the VISA resource name out terminal to subsequent VISA resource name input terminals.
  "error in (no error)": error
outputs:
  "VISA resource name out": "VISA Instr"  # A copy of the reference to the instrument in use. The reference to the resource name is created in the Initialize VI. Wire the VISA resource name out terminal of the Initialize VI to subsequent VISA resource name input terminals. You chain instrument driver VIs together by wiring the VISA resource name out terminal to subsequent VISA resource name input terminals.
  "Voltage High Capacitance Enabled?": bool  # The High Capacitance mode state for voltage source. True: Enabled. False: Disabled.
  "Current High Capacitance Enabled?": bool  # The High Capacitance mode state for current source. True: Enabled. False: Disabled.
  "error out": error
uses:
  NI::VISA::Write (Instr, String).gvi
  NI::VISA::Read (Instr, String).gvi
  Labview_NXG_Keithley_SMU_2450_2460_2461::Utility::Error Query.gvi
diagram:
  w1 = ":SOUR:CURR:HIGH:CAP?"  # Current Auto Range
  w2 = ":SOUR:VOLT:HIGH:CAP?"  # Voltage Auto Range
  call "Write (Instr, String).gvi"(session in=$"VISA resource name", error in=$"error in (no error)", write buffer=w2) -> (session out=w3, error out=w4)
  call "Read (Instr, String).gvi"(session in=w3, error in=w4, byte count=128) -> (session out=w5, error out=w6, read buffer=w7)
  call "Write (Instr, String).gvi"(session in=w5, error in=w6, write buffer=w1) -> (session out=w8, error out=w9)
  call "Read (Instr, String).gvi"(session in=w8, error in=w9, byte count=128) -> (session out=w10, error out=w11, read buffer=w12)
  call "Error Query.gvi"(VISA resource name=w10, error in (no error)=w11) -> (VISA resource name out=w13, error out=w14)
  $"VISA resource name out" <- w13
  $"error out" <- w14
  Is Equal(x=w12, y="1\n") -> w15
  $"Current High Capacitance Enabled?" <- w15
  Is Equal(x=w7, y="1\n") -> w16
  $"Voltage High Capacitance Enabled?" <- w16
