vi "Get LAN Connect State.gvi"   [LabVIEW NXG 5.0.0]
# Returns the state of the LAN trigger Out event.
inputs:
  "VISA resource name": "VISA Instr", required
    # A reference to the instrument in use.  The reference to the resource name is created in the Initialize VI.  Therefore, before calling this VI, you need to call the Initialize VI.  To run this VI interactively, select the previously initialized resource name from the pull-down menu.  To run this VI programmatically, wire the VISA resource name out terminal of the Initialize VI to subsequent VISA resource name input terminals.  You chain instrument driver VIs together by wiring the VISA resource name out terminal to subsequent VISA resource name input terminals.
  "LAN Event Number (1)": i32 = 1  # The LAN event number (1 to 8).
  "error in (no error)": error
outputs:
  "VISA resource name out": "VISA Instr"  # A copy of the reference to the instrument in use. The reference to the resource name is created in the Initialize VI. Wire the VISA resource name out terminal of the Initialize VI to subsequent VISA resource name input terminals. You chain instrument driver VIs together by wiring the VISA resource name out terminal to subsequent VISA resource name input terminals.
  "LAN Connect Enabled?": bool  # Do not send event messages: OFF or 0. Prepare to send event messages: ON or 1.
  "error out": error
uses:
  NI::VISA::Write (Instr, String).gvi
  NI::VISA::Read (Instr, String).gvi
  Labview_NXG_Keithley_SMU_2450_2460_2461::Utility::Error Query.gvi
diagram:
  Format Into String(formatString=":TRIG:LAN%d:OUT:CONN:STAT?", initString="", $"LAN Event Number (1)") -> w1
  call "Write (Instr, String).gvi"(session in=$"VISA resource name", error in=$"error in (no error)", write buffer=w1) -> (session out=w2, error out=w3)
  call "Read (Instr, String).gvi"(session in=w2, error in=w3, byte count=128) -> (session out=w4, error out=w5, read buffer=w6)
  call "Error Query.gvi"(VISA resource name=w4, error in (no error)=w5) -> (VISA resource name out=w7, error out=w8)
  $"VISA resource name out" <- w7
  $"error out" <- w8
  Is Equal(x=w6, y="1\n") -> w9
  $"LAN Connect Enabled?" <- w9
