vi "Get Limit Test Upper Limit.gvi"   [LabVIEW NXG 5.0.0]
# This VI returns the upper limit for limit tests.
inputs:
  "VISA resource name": "VISA Instr" = "USB0::0x05E6::0x2461::04090176::INSTR", required
    # A reference to the instrument in use.  The reference to the resource name is created in the Initialize VI.  Therefore, before calling this VI, you need to call the Initialize VI.  To run this VI interactively, select the previously initialized resource name from the pull-down menu.  To run this VI programmatically, wire the VISA resource name out terminal of the Initialize VI to subsequent VISA resource name input terminals.  You chain instrument driver VIs together by wiring the VISA resource name out terminal to subsequent VISA resource name input terminals.
  "Limit Test Number (2)": u16 = 2  # The number of the test to configure. Note: Test #1 is reserved for compliance checking and Test #4 is reserved for the contact check option. Please use the Configure Special Limit Tests VI to configure those two tests.
  "Function (0: Volts)": u16 = "Volts"(0)  # The function which is to be measured. Note: Voltage, Current, and Resistance measurements are always taken regardless of any VI calls. The Digitize Voltage and Digitize Current functions are only compatible with the 2461.
  "error in (no error)": error
outputs:
  "VISA resource name out": "VISA Instr"  # A copy of the reference to the instrument in use. The reference to the resource name is created in the Initialize VI. Wire the VISA resource name out terminal of the Initialize VI to subsequent VISA resource name input terminals. You chain instrument driver VIs together by wiring the VISA resource name out terminal to subsequent VISA resource name input terminals.
  "Upper Limit": f64  # The value of the upper limit (-999999900000 to +999999900000).
  "error out": error
uses:
  NI::VISA::Write (Instr, String).gvi
  NI::VISA::Read (Instr, String).gvi
  Labview_NXG_Keithley_SMU_2450_2460_2461::Utility::Error Query.gvi
diagram:
  w1 = "VOLT\nCURR\nRES\nDIG:VOLT\nDIG:CURR"  # Function
  Pick Line(line index=$"Function (0: Volts)", multi-line string=w1) -> (output string=w2)
  Format Into String(formatString=":CALC2:%s:LIM%d:UPP?", w2, $"Limit Test Number (2)") -> w3
  call "Write (Instr, String).gvi"(session in=$"VISA resource name", error in=$"error in (no error)", write buffer=w3) -> (session out=w4, error out=w5)
  call "Read (Instr, String).gvi"(session in=w4, error in=w5, byte count=128) -> (session out=w6, error out=w7, read buffer=w8)
  Floating Point String To Number(string=w8) -> (number=w9)
  $"Upper Limit" <- w9
  call "Error Query.gvi"(VISA resource name=w6, error in (no error)=w7) -> (VISA resource name out=w10, error out=w11)
  $"VISA resource name out" <- w10
  $"error out" <- w11
