vi "Get Measure User Delay.gvi"   [LabVIEW NXG 5.0.0]
# This command sets a measure user-defined delay that can be used in the trigger model.
inputs:
  "VISA resource name": "VISA Instr", required
    # A reference to the instrument in use.  The reference to the resource name is created in the Initialize VI.  Therefore, before calling this VI, you need to call the Initialize VI.  To run this VI interactively, select the previously initialized resource name from the pull-down menu.  To run this VI programmatically, wire the VISA resource name out terminal of the Initialize VI to subsequent VISA resource name input terminals.  You chain instrument driver VIs together by wiring the VISA resource name out terminal to subsequent VISA resource name input terminals.
  "Function (0: Volts)": u16 = "Volts"(0)  # The function on which to configure measurement settings. Note: Voltage, Current, and Resistance measurements are always taken regardless of any VI calls.
  "User Delay (1)": i32 = 1  # The number that identifies this user delay (1 to 5) or USER_DELAY_M1 to USER_DELAY_M5
  "error in (no error)": error
outputs:
  "VISA resource name out": "VISA Instr"  # A copy of the reference to the instrument in use. The reference to the resource name is created in the Initialize VI. Wire the VISA resource name out terminal of the Initialize VI to subsequent VISA resource name input terminals. You chain instrument driver VIs together by wiring the VISA resource name out terminal to subsequent VISA resource name input terminals.
  "Delay Time": f64  # The measure user delay in seconds.
  "error out": error
uses:
  NI::VISA::Write (Instr, String).gvi
  NI::VISA::Read (Instr, String).gvi
  Labview_NXG_Keithley_SMU_2450_2460_2461::Utility::Error Query.gvi
diagram:
  # [:SENSe[1]]:<function>:DELay:USER<n>?
  w1 = "VOLT\nCURR\nRES\nDIG:VOLT\nDIG:CURR"  # Function
  Pick Line(line index=$"Function (0: Volts)", multi-line string=w1) -> (output string=w2)
  Format Into String(formatString=":%s:DEL:USER%d?", w2, $"User Delay (1)") -> w3
  call "Write (Instr, String).gvi"(session in=$"VISA resource name", error in=$"error in (no error)", write buffer=w3) -> (session out=w4, error out=w5)
  call "Read (Instr, String).gvi"(session in=w4, error in=w5, byte count=1024) -> (session out=w6, error out=w7, read buffer=w8)
  Floating Point String To Number(string=w8) -> (number=w9)
  $"Delay Time" <- w9
  call "Error Query.gvi"(VISA resource name=w6, error in (no error)=w7) -> (VISA resource name out=w10, error out=w11)
  $"VISA resource name out" <- w10
  $"error out" <- w11
