vi "Get Measurement Manual Range.gvi"   [LabVIEW NXG 5.0.0]
# Returns the measurement range for V, I and R on the instrument.
inputs:
  "VISA resource name": "VISA Instr"
    # A reference to the instrument in use.  The reference to the resource name is created in the Initialize VI.  Therefore, before calling this VI, you need to call the Initialize VI.  To run this VI interactively, select the previously initialized resource name from the pull-down menu.  To run this VI programmatically, wire the VISA resource name out terminal of the Initialize VI to subsequent VISA resource name input terminals.  You chain instrument driver VIs together by wiring the VISA resource name out terminal to subsequent VISA resource name input terminals.
  "error in (no error)": error
outputs:
  "VISA resource name out": "VISA Instr"  # A copy of the reference to the instrument in use. The reference to the resource name is created in the Initialize VI. Wire the VISA resource name out terminal of the Initialize VI to subsequent VISA resource name input terminals. You chain instrument driver VIs together by wiring the VISA resource name out terminal to subsequent VISA resource name input terminals.
  "Voltage Range out": f64  # The present range the voltage measure function.
  "Current Range out": f64  # The present range the current measure function.
  "Resistance Range out": f64  # The present range the resistance measure function.
  "error out": error
uses:
  NI::VISA::Write (Instr, String).gvi
  NI::VISA::Read (Instr, String).gvi
  Labview_NXG_Keithley_SMU_2450_2460_2461::Utility::Error Query.gvi
diagram:
  w1 = ":RES:RANG?"  # REsistance Range
  w2 = ":CURR:RANG?"  # Current Range
  w3 = ":VOLT:RANG?"  # Voltage Range
  call "Write (Instr, String).gvi"(session in=$"VISA resource name", error in=$"error in (no error)", write buffer=w3) -> (session out=w4, error out=w5)
  call "Read (Instr, String).gvi"(session in=w4, error in=w5, byte count=128) -> (session out=w6, error out=w7, read buffer=w8)
  call "Write (Instr, String).gvi"(session in=w6, error in=w7, write buffer=w2) -> (session out=w9, error out=w10)
  call "Read (Instr, String).gvi"(session in=w9, error in=w10, byte count=128) -> (session out=w11, error out=w12, read buffer=w13)
  call "Write (Instr, String).gvi"(session in=w11, error in=w12, write buffer=w1) -> (session out=w14, error out=w15)
  call "Read (Instr, String).gvi"(session in=w14, error in=w15, byte count=128) -> (session out=w16, error out=w17, read buffer=w18)
  call "Error Query.gvi"(VISA resource name=w16, error in (no error)=w17) -> (VISA resource name out=w19, error out=w20)
  $"VISA resource name out" <- w19
  $"error out" <- w20
  Floating Point String To Number(string=w18) -> (number=w21)
  $"Resistance Range out" <- w21
  Floating Point String To Number(string=w13) -> (number=w22)
  $"Current Range out" <- w22
  Floating Point String To Number(string=w8) -> (number=w23)
  $"Voltage Range out" <- w23
