vi "Get Source Configuration List Catalog.gvi"   [LabVIEW NXG 5.0.0]
# This gets the Source configuration list catalog.
# This gets one name each time. This returns NULL to indicate that there are no more names to return. If this returns NULL the first time then no measure configuration lists have been created for the instrument.
inputs:
  "VISA resource name": "VISA Instr", required
    # A reference to the instrument in use.  The reference to the resource name is created in the Initialize VI.  Therefore, before calling this VI, you need to call the Initialize VI.  To run this VI interactively, select the previously initialized resource name from the pull-down menu.  To run this VI programmatically, wire the VISA resource name out terminal of the Initialize VI to subsequent VISA resource name input terminals.  You chain instrument driver VIs together by wiring the VISA resource name out terminal to subsequent VISA resource name input terminals.
  "error in (no error)": error
outputs:
  "VISA resource name out": "VISA Instr"  # A copy of the reference to the instrument in use. The reference to the resource name is created in the Initialize VI. Wire the VISA resource name out terminal of the Initialize VI to subsequent VISA resource name input terminals. You chain instrument driver VIs together by wiring the VISA resource name out terminal to subsequent VISA resource name input terminals.
  "Source Configuration List Catalog": string  # The name representing the source configuration list.
  "error out": error
uses:
  NI::VISA::Write (Instr, String).gvi
  NI::VISA::Read (Instr, String).gvi
  Labview_NXG_Keithley_SMU_2450_2460_2461::Utility::Error Query.gvi
diagram:
  call "Write (Instr, String).gvi"(session in=$"VISA resource name", error in=$"error in (no error)", write buffer=":SOUR:CONF:LIST:CAT?") -> (session out=w1, error out=w2)
  call "Read (Instr, String).gvi"(session in=w1, error in=w2, byte count=1024) -> (session out=w3, error out=w4, read buffer=w5)
  call "Error Query.gvi"(VISA resource name=w3, error in (no error)=w4) -> (VISA resource name out=w6, error out=w7)
  $"VISA resource name out" <- w6
  $"error out" <- w7
  $"Source Configuration List Catalog" <- w5
