vi "Get Source Configuration List Settings.gvi"   [LabVIEW NXG 5.0.0]
# This command returns a list of TSP commands that represent the parameters that are stored in the specified source configuration list point.
inputs:
  "VISA resource name": "VISA Instr", required
    # A reference to the instrument in use.  The reference to the resource name is created in the Initialize VI.  Therefore, before calling this VI, you need to call the Initialize VI.  To run this VI interactively, select the previously initialized resource name from the pull-down menu.  To run this VI programmatically, wire the VISA resource name out terminal of the Initialize VI to subsequent VISA resource name input terminals.  You chain instrument driver VIs together by wiring the VISA resource name out terminal to subsequent VISA resource name input terminals.
  "Configuration List Name": string  # A string that represents the name of a source configuration list.
  "Configuration Point index (1)": u32 = 1  # A specific configuration point in the configuration list.
  "Specify Seperator Character (T:Yes)": bool = TRUE  # If Specify Configuration Character is Yes, it you can select, comma, semicolon or new line characters to separate configuration settings returned. If Specify Configuration Character is No, a comma is used as a separation character.
  "Separator Character (0: Comma)": u16 = "Comma"(0)  # Allows you to specify either comma, semicolon or new line character between configuration list elements.
  "error in (no error)": error
outputs:
  "VISA resource name out": "VISA Instr"  # A copy of the reference to the instrument in use. The reference to the resource name is created in the Initialize VI. Wire the VISA resource name out terminal of the Initialize VI to subsequent VISA resource name input terminals. You chain instrument driver VIs together by wiring the VISA resource name out terminal to subsequent VISA resource name input terminals.
  "Source Configuration List settings": string  # The elements of the configuration list index selected.
  "error out": error
uses:
  NI::G Core::Strings::Append True Or False String.gvi
  NI::VISA::Write (Instr, String).gvi
  NI::VISA::Read (Instr, String).gvi
  Labview_NXG_Keithley_SMU_2450_2460_2461::Utility::Error Query.gvi
diagram:
  Format Into String(formatString=":SOUR:CONF:LIST:QUER? \"%s\",%d", $"Configuration List Name", $"Configuration Point index (1)") -> w1
  Increment(x=$"Separator Character (0: Comma)") -> w2
  Format Into String(formatString=",%d;", w2) -> w3
  call "Append True Or False String.gvi"(string=w1, true string=w3, false string=";", selector=$"Specify Seperator Character (T:Yes)") -> (output string=w4)
  call "Write (Instr, String).gvi"(session in=$"VISA resource name", error in=$"error in (no error)", write buffer=w4) -> (session out=w5, error out=w6)
  call "Read (Instr, String).gvi"(session in=w5, error in=w6, byte count=1024) -> (session out=w7, error out=w8, read buffer=w9)
  call "Error Query.gvi"(VISA resource name=w7, error in (no error)=w8) -> (VISA resource name out=w10, error out=w11)
  $"VISA resource name out" <- w10
  # [:SOURce[1]]:CONFigure:LIST:QUERy? <name>, <index>
  # [:SOURce[1]]:CONFigure:LIST:QUERy? <name>, <index>, <separatorCharacter>
  $"error out" <- w11
  $"Source Configuration List settings" <- w9
