vi "Get Source Configuration List Size.gvi"   [LabVIEW NXG 5.0.0]
# This Vi returns the size (number of configuration points) of a source configuration list
inputs:
  "VISA resource name": "VISA Instr", required
    # A reference to the instrument in use.  The reference to the resource name is created in the Initialize VI.  Therefore, before calling this VI, you need to call the Initialize VI.  To run this VI interactively, select the previously initialized resource name from the pull-down menu.  To run this VI programmatically, wire the VISA resource name out terminal of the Initialize VI to subsequent VISA resource name input terminals.  You chain instrument driver VIs together by wiring the VISA resource name out terminal to subsequent VISA resource name input terminals.
  "Configuration List Name": string  # The name of the configuration list whose size you wish to check.
  "error in (no error)": error
outputs:
  "VISA resource name out": "VISA Instr"  # A copy of the reference to the instrument in use. The reference to the resource name is created in the Initialize VI. Wire the VISA resource name out terminal of the Initialize VI to subsequent VISA resource name input terminals. You chain instrument driver VIs together by wiring the VISA resource name out terminal to subsequent VISA resource name input terminals.
  "Source Configuration List Size": i32  # The size of the specified configuration list.
  "error out": error
uses:
  NI::VISA::Write (Instr, String).gvi
  NI::VISA::Read (Instr, String).gvi
  Labview_NXG_Keithley_SMU_2450_2460_2461::Utility::Error Query.gvi
diagram:
  Format Into String(formatString=":SOUR:CONF:LIST:SIZE? \"%s\"", $"Configuration List Name") -> w1
  call "Write (Instr, String).gvi"(session in=$"VISA resource name", error in=$"error in (no error)", write buffer=w1) -> (session out=w2, error out=w3)
  call "Read (Instr, String).gvi"(session in=w2, error in=w3, byte count=1024) -> (session out=w4, error out=w5, read buffer=w6)
  call "Error Query.gvi"(VISA resource name=w4, error in (no error)=w5) -> (VISA resource name out=w7, error out=w8)
  $"VISA resource name out" <- w7
  $"error out" <- w8
  Decimal String To Number(string=w6) -> (number=w9)
  $"Source Configuration List Size" <- w9
