vi "Get Source Delay.gvi"   [LabVIEW NXG 5.0.0]
# This Vi gets source delay value for the selected source function.
inputs:
  "VISA resource name": "VISA Instr", required
    # A reference to the instrument in use.  The reference to the resource name is created in the Initialize VI.  Therefore, before calling this VI, you need to call the Initialize VI.  To run this VI interactively, select the previously initialized resource name from the pull-down menu.  To run this VI programmatically, wire the VISA resource name out terminal of the Initialize VI to subsequent VISA resource name input terminals.  You chain instrument driver VIs together by wiring the VISA resource name out terminal to subsequent VISA resource name input terminals.
  "Function (0: Volts)": u16 = "Volts"(0)  # Selects the voltage or current source mode to be configured.
  "error in (no error)": error
outputs:
  "VISA resource name out": "VISA Instr"  # A copy of the reference to the instrument in use. The reference to the resource name is created in the Initialize VI. Wire the VISA resource name out terminal of the Initialize VI to subsequent VISA resource name input terminals. You chain instrument driver VIs together by wiring the VISA resource name out terminal to subsequent VISA resource name input terminals.
  "Source Delay": f64  # The delay in seconds for the specified source function.
  "error out": error
uses:
  NI::VISA::Write (Instr, String).gvi
  NI::VISA::Read (Instr, String).gvi
  Labview_NXG_Keithley_SMU_2450_2460_2461::Utility::Error Query.gvi
diagram:
  w1 = "VOLT\nCURR"  # Function
  Pick Line(line index=$"Function (0: Volts)", multi-line string=w1) -> (output string=w2)
  Format Into String(formatString=":SOUR:%s:DEL?", w2) -> w3
  call "Write (Instr, String).gvi"(session in=$"VISA resource name", error in=$"error in (no error)", write buffer=w3) -> (session out=w4, error out=w5)
  w6 = 128  # bytes
  call "Read (Instr, String).gvi"(session in=w4, error in=w5, byte count=w6) -> (session out=w7, error out=w8, read buffer=w9)
  call "Error Query.gvi"(VISA resource name=w7, error in (no error)=w8) -> (VISA resource name out=w10, error out=w11)
  $"VISA resource name out" <- w10
  $"error out" <- w11
  Floating Point String To Number(string=w9) -> (number=w12)
  $"Source Delay" <- w12
