vi "Get Source Level.gvi"   [LabVIEW NXG 5.0.0]
# This command returns the fixed amplitude for both the V & I source function.
inputs:
  "VISA resource name": "VISA Instr", required
    # A reference to the instrument in use.  The reference to the resource name is created in the Initialize VI.  Therefore, before calling this VI, you need to call the Initialize VI.  To run this VI interactively, select the previously initialized resource name from the pull-down menu.  To run this VI programmatically, wire the VISA resource name out terminal of the Initialize VI to subsequent VISA resource name input terminals.  You chain instrument driver VIs together by wiring the VISA resource name out terminal to subsequent VISA resource name input terminals.
  "error in (no error)": error
outputs:
  "VISA resource name out": "VISA Instr"  # A copy of the reference to the instrument in use. The reference to the resource name is created in the Initialize VI. Wire the VISA resource name out terminal of the Initialize VI to subsequent VISA resource name input terminals. You chain instrument driver VIs together by wiring the VISA resource name out terminal to subsequent VISA resource name input terminals.
  "Voltage Level Out": f64  # The voltage level specified when the instrument is sourcing volts.
  "Current Level Out": f64  # The current level specified when the instrument is sourcing current.
  "error out": error
uses:
  NI::VISA::Write (Instr, String).gvi
  NI::VISA::Read (Instr, String).gvi
  Labview_NXG_Keithley_SMU_2450_2460_2461::Utility::Error Query.gvi
diagram:
  w1 = ":SOUR:CURR?"  # Current Range
  w2 = ":SOUR:VOLT?"  # Voltage Range
  call "Write (Instr, String).gvi"(session in=$"VISA resource name", error in=$"error in (no error)", write buffer=w2) -> (session out=w3, error out=w4)
  call "Read (Instr, String).gvi"(session in=w3, error in=w4, byte count=128) -> (session out=w5, error out=w6, read buffer=w7)
  call "Write (Instr, String).gvi"(session in=w5, error in=w6, write buffer=w1) -> (session out=w8, error out=w9)
  call "Read (Instr, String).gvi"(session in=w8, error in=w9, byte count=128) -> (session out=w10, error out=w11, read buffer=w12)
  call "Error Query.gvi"(VISA resource name=w10, error in (no error)=w11) -> (VISA resource name out=w13, error out=w14)
  $"VISA resource name out" <- w13
  $"error out" <- w14
  Floating Point String To Number(string=w12) -> (number=w15)
  $"Current Level Out" <- w15
  Floating Point String To Number(string=w7) -> (number=w16)
  $"Voltage Level Out" <- w16
