vi "Get Source List Points.gvi"   [LabVIEW NXG 5.0.0]
# This command queries the length of the source list for the selected source function.
inputs:
  "VISA resource name": "VISA Instr", required
    # A reference to the instrument in use.  The reference to the resource name is created in the Initialize VI.  Therefore, before calling this VI, you need to call the Initialize VI.  To run this VI interactively, select the previously initialized resource name from the pull-down menu.  To run this VI programmatically, wire the VISA resource name out terminal of the Initialize VI to subsequent VISA resource name input terminals.  You chain instrument driver VIs together by wiring the VISA resource name out terminal to subsequent VISA resource name input terminals.
  "error in (no error)": error
outputs:
  "VISA resource name out": "VISA Instr"  # A copy of the reference to the instrument in use. The reference to the resource name is created in the Initialize VI. Wire the VISA resource name out terminal of the Initialize VI to subsequent VISA resource name input terminals. You chain instrument driver VIs together by wiring the VISA resource name out terminal to subsequent VISA resource name input terminals.
  "Source Voltage Points": i32  # The number of voltage source values in the list.
  "Source Current Points": i32  # The number of current source values in the list.
  "error out": error
uses:
  NI::VISA::Write (Instr, String).gvi
  NI::VISA::Read (Instr, String).gvi
  Labview_NXG_Keithley_SMU_2450_2460_2461::Utility::Error Query.gvi
diagram:
  call "Write (Instr, String).gvi"(session in=$"VISA resource name", error in=$"error in (no error)", write buffer=":SOUR:LIST:VOLT:POIN?") -> (session out=w1, error out=w2)
  call "Read (Instr, String).gvi"(session in=w1, error in=w2, byte count=128) -> (session out=w3, error out=w4, read buffer=w5)
  Decimal String To Number(string=w5) -> (number=w6)
  $"Source Voltage Points" <- w6
  call "Write (Instr, String).gvi"(session in=w3, error in=w4, write buffer=":SOUR:LIST:CURR:POIN?") -> (session out=w7, error out=w8)
  call "Read (Instr, String).gvi"(session in=w7, error in=w8, byte count=128) -> (session out=w9, error out=w10, read buffer=w11)
  Decimal String To Number(string=w11) -> (number=w12)
  $"Source Current Points" <- w12
  call "Error Query.gvi"(VISA resource name=w9, error in (no error)=w10) -> (VISA resource name out=w13, error out=w14)
  $"VISA resource name out" <- w13
  $"error out" <- w14
