vi "Get Time.gvi"   [LabVIEW NXG 5.0.0]
# This gets the System Time in absoulte or current time formats.
inputs:
  "VISA resource name": "VISA Instr", required
    # A reference to the instrument in use.  The reference to the resource name is created in the Initialize VI.  Therefore, before calling this VI, you need to call the Initialize VI.  To run this VI interactively, select the previously initialized resource name from the pull-down menu.  To run this VI programmatically, wire the VISA resource name out terminal of the Initialize VI to subsequent VISA resource name input terminals.  You chain instrument driver VIs together by wiring the VISA resource name out terminal to subsequent VISA resource name input terminals.
  "Time Format (True)": bool  # This determines if the returned time will be in absolute format or the current time stamp. True: Returns Current Time. False: Returns Absolute Time.
  "error in (no error)": error
outputs:
  "VISA resource name out": "VISA Instr"  # A copy of the reference to the instrument in use. The reference to the resource name is created in the Initialize VI. Wire the VISA resource name out terminal of the Initialize VI to subsequent VISA resource name input terminals. You chain instrument driver VIs together by wiring the VISA resource name out terminal to subsequent VISA resource name input terminals.
  "Absolute Time": f64  # This is the present timestamp value in seconds since January 1, 1970 to the nearest second.
  "Current Time": string  # This is the present timestamp in the format: <weekday> <month> <day> <hour>:<minute>:<second> <year>.
  "error out": error
uses:
  NI::VISA::Write (Instr, String).gvi
  NI::VISA::Read (Instr, String).gvi
  Labview_NXG_Keithley_SMU_2450_2460_2461::Utility::Error Query.gvi
diagram:
  case ($"Time Format (True)") {
    frame False, Default {
      w1 = ":SYST:TIME?"
    }
    frame True {
      w1 = ":SYST:TIME? 1"
    }
  }
  call "Write (Instr, String).gvi"(session in=$"VISA resource name", error in=$"error in (no error)", write buffer=w1) -> (session out=w2, error out=w3)
  call "Read (Instr, String).gvi"(session in=w2, error in=w3, byte count=1024) -> (session out=w4, error out=w5, read buffer=w6)
  call "Error Query.gvi"(VISA resource name=w4, error in (no error)=w5) -> (VISA resource name out=w7, error out=w8)
  $"VISA resource name out" <- w7
  $"error out" <- w8
  case ($"Time Format (True)") {
    frame False, Default {
      Floating Point String To Number(string=w6) -> (number=w10)
      w9 = ""
    }
    frame True {
      w9 = w6
      w10 = 0
    }
  }
  $"Current Time" <- w9
  $"Absolute Time" <- w10
