vi "Get Trigger Model State.gvi"   [LabVIEW NXG 5.0.0]
# This Vi returns the present state of the trigger model.
inputs:
  "VISA resource name": "VISA Instr", required
    # A reference to the instrument in use.  The reference to the resource name is created in the Initialize VI.  Therefore, before calling this VI, you need to call the Initialize VI.  To run this VI interactively, select the previously initialized resource name from the pull-down menu.  To run this VI programmatically, wire the VISA resource name out terminal of the Initialize VI to subsequent VISA resource name input terminals.  You chain instrument driver VIs together by wiring the VISA resource name out terminal to subsequent VISA resource name input terminals.
  "error in (no error)": error
outputs:
  "VISA resource name out": "VISA Instr"  # A copy of the reference to the instrument in use. The reference to the resource name is created in the Initialize VI. Wire the VISA resource name out terminal of the Initialize VI to subsequent VISA resource name input terminals. You chain instrument driver VIs together by wiring the VISA resource name out terminal to subsequent VISA resource name input terminals.
  "Trigger Mode State": string
    # The trigger model states are:
    # • Idle: The trigger model is stopped
    # • Running: The trigger model is running
    # • Waiting: The trigger model has been in the same wait block for more than 100 ms
    # • Empty: The trigger model is selected, but no blocks are defined
    # • Erroneous: The configurable trigger model is selected, but there are errors in the settings
    # • Building: Blocks have been added.
    # • Failed: The trigger model is stopped because of an error.
    # • Aborting: The trigger model is stopping because of a user request.
  "Block Number": string  # The current block number of the trigger flow model.
  "error out": error
uses:
  NI::VISA::Write (Instr, String).gvi
  NI::VISA::Read (Instr, String).gvi
  Labview_NXG_Keithley_SMU_2450_2460_2461::Utility::Error Query.gvi
diagram:
  call "Write (Instr, String).gvi"(session in=$"VISA resource name", error in=$"error in (no error)", write buffer=":TRIG:STAT?") -> (session out=w1, error out=w2)
  call "Read (Instr, String).gvi"(session in=w1, error in=w2, byte count=128) -> (session out=w3, error out=w4, read buffer=w5)
  Search Or Split String(search string/char=";", string=w5) -> (match + rest of string=w6, substring before match=w7)
  $"Trigger Mode State" <- w7
  String Subset(offset (0)=1, string=w6) -> w8
  Search Or Split String(search string/char=";", string=w8) -> (match + rest of string=w9)
  String Subset(offset (0)=1, string=w9) -> w10
  $"Block Number" <- w10
  call "Error Query.gvi"(VISA resource name=w3, error in (no error)=w4) -> (VISA resource name out=w11, error out=w12)
  $"VISA resource name out" <- w11
  $"error out" <- w12
