vi "Load Trigger Model Configuration Lists.gvi"   [LabVIEW NXG 5.0.0]
# This Vi loads a predefined trigger model configuration that uses source and measure configuration lists and optionally a delay and buffer name.
inputs:
  "Buffer Name (defbuffer1)": string = "defbuffer1"  # If the Enable Buffer Name control is set to true, then this specifies the buffer for readings. If Enable Buffer Name is false, then the buffer that is used is defbuffer1.
  "VISA resource name": "VISA Instr"
    # A reference to the instrument in use.  The reference to the resource name is created in the Initialize VI.  Therefore, before calling this VI, you need to call the Initialize VI.  To run this VI interactively, select the previously initialized resource name from the pull-down menu.  To run this VI programmatically, wire the VISA resource name out terminal of the Initialize VI to subsequent VISA resource name input terminals.  You chain instrument driver VIs together by wiring the VISA resource name out terminal to subsequent VISA resource name input terminals.
  "Measure Configuration List": string  # The configuration list that contains the measurement settings to be used for this trigger model.
  "Source Configuration List": string = "MyMeasList"  # The configuration list that contains the source settings to be used for this trigger model.
  "Enable Delay (T:False)": bool  # This enables or disables the delay specified in the Delay control.
  "Delay (0.000050)": f64 = 5e-05  # If Enable Delay is true, then this specifies the delay time before the measurement (seconds); default is 0.
  "error in (no error)": error
  "Enable Buffer Name (T:False)": bool  # This enables or disabled the use of the buffer name specified in Buffer name.
outputs:
  "VISA resource name out": "VISA Instr"  # A copy of the reference to the instrument in use. The reference to the resource name is created in the Initialize VI. Wire the VISA resource name out terminal of the Initialize VI to subsequent VISA resource name input terminals. You chain instrument driver VIs together by wiring the VISA resource name out terminal to subsequent VISA resource name input terminals.
  "error out": error
uses:
  NI::VISA::Write (Instr, String).gvi
  Labview_NXG_Keithley_SMU_2450_2460_2461::Utility::Error Query.gvi
diagram:
  Format Into String(formatString=":TRIG:LOAD:CONF:LIST \"%s\", \"%s\"", initString="", $"Measure Configuration List", $"Source Configuration List") -> w1
  case ($"Enable Delay (T:False)") {
    frame False, Default {
      w2 = w1
    }
    frame True {
      Concatenate Strings(w1, ",") -> w3
      Format Into String(initString=w3, $"Delay (0.000050)") -> w2
    }
  }
  Logical And($"Enable Delay (T:False)", $"Enable Buffer Name (T:False)") -> w4
  case (w4) {
    frame False, Default {
      w5 = w2
    }
    frame True {
      Is Equal(x="", y=$"Buffer Name (defbuffer1)") -> w6
      Select(s=w6, t="defbuffer1", f=$"Buffer Name (defbuffer1)") -> w7
      Format Into String(formatString=" %s, \"%s\"", w2, w7) -> w5
    }
  }
  call "Write (Instr, String).gvi"(session in=$"VISA resource name", error in=$"error in (no error)", write buffer=w5) -> (session out=w8, error out=w9)
  call "Error Query.gvi"(VISA resource name=w8, error in (no error)=w9) -> (VISA resource name out=w10, error out=w11)
  $"VISA resource name out" <- w10
  $"error out" <- w11
