vi "Save Message from Event Log.gvi"   [LabVIEW NXG 5.0.0]
# This saves the event log to a file on a USB flash drive.
inputs:
  "VISA resource name": "VISA Instr", required
    # A reference to the instrument in use.  The reference to the resource name is created in the Initialize VI.  Therefore, before calling this VI, you need to call the Initialize VI.  To run this VI interactively, select the previously initialized resource name from the pull-down menu.  To run this VI programmatically, wire the VISA resource name out terminal of the Initialize VI to subsequent VISA resource name input terminals.  You chain instrument driver VIs together by wiring the VISA resource name out terminal to subsequent VISA resource name input terminals.
  "File Name": string  # A string that holds the name of the file to be saved.
  "Event Type (0: Error)": u16 = "Error"(0)  # Limits the event log entries that are saved to the following types: • ERRor: Saves only error entries • WARNing: Saves only warning entries • INFOrmational: Saves only informational messages • ALL: Saves all event log entries
  "error in (no error)": error
outputs:
  "VISA resource name out": "VISA Instr"  # A copy of the reference to the instrument in use. The reference to the resource name is created in the Initialize VI. Wire the VISA resource name out terminal of the Initialize VI to subsequent VISA resource name input terminals. You chain instrument driver VIs together by wiring the VISA resource name out terminal to subsequent VISA resource name input terminals.
  "error out": error
uses:
  NI::VISA::Write (Instr, String).gvi
  Labview_NXG_Keithley_SMU_2450_2460_2461::Utility::Error Query.gvi
diagram:
  w1 = "ERR\nWARN\nINFO\nALL"  # Function
  Pick Line(line index=$"Event Type (0: Error)", multi-line string=w1) -> (output string=w2)
  Format Into String(formatString=":SYST:EVEN:SAVE \"%s\",%s", $"File Name", w2) -> w3
  call "Write (Instr, String).gvi"(session in=$"VISA resource name", error in=$"error in (no error)", write buffer=w3) -> (session out=w4, error out=w5)
  call "Error Query.gvi"(VISA resource name=w4, error in (no error)=w5) -> (VISA resource name out=w6, error out=w7)
  $"VISA resource name out" <- w6
  $"error out" <- w7
