vi "Set Absolute Time.gvi"   [LabVIEW NXG 5.0.0]
# This sets the absolute time of the instrument.
inputs:
  "VISA resource name": "VISA Instr", required
    # A reference to the instrument in use.  The reference to the resource name is created in the Initialize VI.  Therefore, before calling this VI, you need to call the Initialize VI.  To run this VI interactively, select the previously initialized resource name from the pull-down menu.  To run this VI programmatically, wire the VISA resource name out terminal of the Initialize VI to subsequent VISA resource name input terminals.  You chain instrument driver VIs together by wiring the VISA resource name out terminal to subsequent VISA resource name input terminals.
  "System Time": T1 = {"Year"=1970, "Month"=1, "Day"=1, "Hours"=0, "Minutes"=0, "Seconds"=0}
  "error in (no error)": error
outputs:
  "VISA resource name out": "VISA Instr"  # A copy of the reference to the instrument in use. The reference to the resource name is created in the Initialize VI. Wire the VISA resource name out terminal of the Initialize VI to subsequent VISA resource name input terminals. You chain instrument driver VIs together by wiring the VISA resource name out terminal to subsequent VISA resource name input terminals.
  "error out": error
types:
  T1 = cluster{"Year": i32, "Month": i32, "Day": i32, "Hours": i32, "Minutes": i32, "Seconds": i32}
uses:
  NI::VISA::Write (Instr, String).gvi
  Labview_NXG_Keithley_SMU_2450_2460_2461::Utility::Error Query.gvi
diagram:
  Property Node(instance in=$"System Time") -> ("Year"=w1, "Month"=w2, "Day"=w3, "Hours"=w4, "Minutes"=w5, "Seconds"=w6)
  Format Into String(formatString=":SYST:TIME %d,%d,%d,%d,%d,%d;", w1, w2, w3, w4, w5, w6) -> w7
  call "Write (Instr, String).gvi"(session in=$"VISA resource name", error in=$"error in (no error)", write buffer=w7) -> (session out=w8, error out=w9)
  call "Error Query.gvi"(VISA resource name=w8, error in (no error)=w9) -> (VISA resource name out=w10, error out=w11)
  $"VISA resource name out" <- w10
  $"error out" <- w11
