vi "Set Measurement Count.gvi"   [LabVIEW NXG 5.0.0]
# This sets the number of measurements to be performed when a measurement is requested.
inputs:
  "VISA resource name": "VISA Instr" = "USB0::0x05E6::0x2461::04090181::INSTR", required
    # A reference to the instrument in use.  The reference to the resource name is created in the Initialize VI.  Therefore, before calling this VI, you need to call the Initialize VI.  To run this VI interactively, select the previously initialized resource name from the pull-down menu.  To run this VI programmatically, wire the VISA resource name out terminal of the Initialize VI to subsequent VISA resource name input terminals.  You chain instrument driver VIs together by wiring the VISA resource name out terminal to subsequent VISA resource name input terminals.
  "Measurement Count": i32 = 1  # The number of measurements for the Charge Balanced ADC: (1 to 300,000). The number of measurements for the Digitizer ADC: (1 to 55,000,000).
  "error in (no error)": error
outputs:
  "VISA resource name out": "VISA Instr"  # A copy of the reference to the instrument in use. The reference to the resource name is created in the Initialize VI. Wire the VISA resource name out terminal of the Initialize VI to subsequent VISA resource name input terminals. You chain instrument driver VIs together by wiring the VISA resource name out terminal to subsequent VISA resource name input terminals.
  "error out": error
panel controls:
  "Digitizer (False)": bool  # This control determines if the measure count is being specified for the Charge Balance ADC or the Digitizing ADC. Default Value (False). The Digitizer functions are only compatible with the 2461.
uses:
  NI::VISA::Write (Instr, String).gvi
  Labview_NXG_Keithley_SMU_2450_2460_2461::Utility::Error Query.gvi
diagram:
  case ($"Digitizer (False)") {
    frame False, Default {
      Format Into String(formatString=":COUN %d;", $"Measurement Count") -> w1
    }
    frame True {
      Format Into String(formatString="DIG:COUN %d;", $"Measurement Count") -> w1
    }
  }
  call "Write (Instr, String).gvi"(session in=$"VISA resource name", error in=$"error in (no error)", write buffer=w1) -> (session out=w2, error out=w3)
  call "Error Query.gvi"(VISA resource name=w2, error in (no error)=w3) -> (VISA resource name out=w4, error out=w5)
  $"VISA resource name out" <- w4
  $"error out" <- w5
