vi "Set Pulse Amplitude.gvi"   [LabVIEW NXG 5.0.0]
# This command sets the output level of the voltage or current source pulse when pulsing.
# The sign of the source level dictates the polarity of the source. Positive values generate positive
# voltage or current from the high terminal of the source relative to the low terminal. Negative values
# generate negative voltage or current from the high terminal of the source relative to the low terminal.
# If a manual source range is selected, the level cannot exceed the specified range. For example, if the
# voltage source is on the 2 V range, you cannot set the voltage source amplitude to 3 V. When auto
# range is selected, the amplitude can be set to any level supported by the instrument because it will
# select the correct range automatically when pulsing.
# This function is only compatible with the 2461.
inputs:
  "VISA resource name": "VISA Instr" = "USB0::0x05E6::0x2461::04090176::INSTR"
    # A reference to the instrument in use.  The reference to the resource name is created in the Initialize VI.  Therefore, before calling this VI, you need to call the Initialize VI.  To run this VI interactively, select the previously initialized resource name from the pull-down menu.  To run this VI programmatically, wire the VISA resource name out terminal of the Initialize VI to subsequent VISA resource name input terminals.  You chain instrument driver VIs together by wiring the VISA resource name out terminal to subsequent VISA resource name input terminals.
  "Function (0:Voltage)": u16 = "Voltage"(0)  # This selects the function that the Pulse Amplitude will apply to.
  "Amplitude": f64 = 1  # The amplitude of the Pulse.
  "error in (no error)": error
outputs:
  "VISA resource name out": "VISA Instr"  # A copy of the reference to the instrument in use. The reference to the resource name is created in the Initialize VI. Wire the VISA resource name out terminal of the Initialize VI to subsequent VISA resource name input terminals. You chain instrument driver VIs together by wiring the VISA resource name out terminal to subsequent VISA resource name input terminals.
  "error out": error
uses:
  NI::VISA::Write (Instr, String).gvi
  Labview_NXG_Keithley_SMU_2450_2460_2461::Utility::Error Query.gvi
diagram:
  Pick Line(line index=$"Function (0:Voltage)", multi-line string="VOLT\nCURR") -> (output string=w1)
  Format Into String(formatString=":SOUR:PULS:%s:LEV %f;", w1, $Amplitude) -> w2
  call "Write (Instr, String).gvi"(session in=$"VISA resource name", error in=$"error in (no error)", write buffer=w2) -> (session out=w3, error out=w4)
  call "Error Query.gvi"(VISA resource name=w3, error in (no error)=w4) -> (VISA resource name out=w5, error out=w6)
  $"VISA resource name out" <- w5
  $"error out" <- w6
