vi "Setting Powered ON Setup.gvi"   [LabVIEW NXG 5.0.0]
# This selects the defaults that are used when instrument is powered on.
inputs:
  "VISA resource name": "VISA Instr", required
    # A reference to the instrument in use.  The reference to the resource name is created in the Initialize VI.  Therefore, before calling this VI, you need to call the Initialize VI.  To run this VI interactively, select the previously initialized resource name from the pull-down menu.  To run this VI programmatically, wire the VISA resource name out terminal of the Initialize VI to subsequent VISA resource name input terminals.  You chain instrument driver VIs together by wiring the VISA resource name out terminal to subsequent VISA resource name input terminals.
  "Powered ON Setup (RST)": u16 = "RST"(0)  # Which setup to restore on power up: • Power-up to *RST defaults: RST • Stored setup 0: SAV0 • Stored setup 1: SAV1 • Stored setup 2: SAV2 • Stored setup 3: SAV3 • Stored setup 4: SAV4
  "error in (no error)": error
outputs:
  "VISA resource name out": "VISA Instr"  # A copy of the reference to the instrument in use. The reference to the resource name is created in the Initialize VI. Wire the VISA resource name out terminal of the Initialize VI to subsequent VISA resource name input terminals. You chain instrument driver VIs together by wiring the VISA resource name out terminal to subsequent VISA resource name input terminals.
  "error out": error
uses:
  NI::VISA::Write (Instr, String).gvi
  Labview_NXG_Keithley_SMU_2450_2460_2461::Utility::Error Query.gvi
diagram:
  Pick Line(line index=$"Powered ON Setup (RST)", multi-line string="RST\nSAV0\nSAV1\nSAV2\nSAV3\nSAV4") -> (output string=w1)
  Format Into String(formatString=":SYST:POS %s;", w1) -> w2
  call "Write (Instr, String).gvi"(session in=$"VISA resource name", error in=$"error in (no error)", write buffer=w2) -> (session out=w3, error out=w4)
  call "Error Query.gvi"(VISA resource name=w3, error in (no error)=w4) -> (VISA resource name out=w5, error out=w6)
  $"VISA resource name out" <- w5
  $"error out" <- w6
