vi "Turn off Delays and Autozero (High Speed).gvi"   [LabVIEW NXG 5.0.0]
inputs:
  "Visa Resource Name In": "VISA Instr"
  "Error In": error
outputs:
  "VISA Resource Name Out": "VISA Instr"
  "Error Out": error
uses:
  Labview_NXG_Keithley_SMU_2450_2460_2461::Configure::Configure Autozero.gvi
  Labview_NXG_Keithley_SMU_2450_2460_2461::Configure::Set Source Auto Delay State.gvi
diagram:
  case ($"Error In") {
    frame Error, Default {
      w1 = $"Visa Resource Name In"
      w2 = $"Error In"
    }
    frame No Error {
      call "Configure Autozero.gvi"(VISA resource name=$"Visa Resource Name In", Function (0: Volts)="Volts"(0), Autozero (0: On)="Off"(1), error in (no error)=$"Error In") -> (VISA resource name out=w3, error out=w4)
      call "Configure Autozero.gvi"(VISA resource name=w3, Function (0: Volts)="Current"(1), Autozero (0: On)="Off"(1), error in (no error)=w4) -> (VISA resource name out=w5, error out=w6)
      call "Configure Autozero.gvi"(VISA resource name=w5, Function (0: Volts)="Resistance"(2), Autozero (0: On)="Off"(1), error in (no error)=w6) -> (VISA resource name out=w7, error out=w8)
      call "Set Source Auto Delay State.gvi"(VISA resource name=w7, Function (0: Volts)="Volts"(0), Auto Delay Enable?=FALSE, error in (no error)=w8) -> (VISA resource name out=w9, error out=w10)
      call "Set Source Auto Delay State.gvi"(VISA resource name=w9, Function (0: Volts)="Current"(1), Auto Delay Enable?=FALSE, error in (no error)=w10) -> (VISA resource name out=w1, error out=w2)
    }
  }
  $"VISA Resource Name Out" <- w1
  $"Error Out" <- w2
