vi "Fetch Read Buffer Statistics.gvi"   [LabVIEW NXG 5.0.0]
# This gives the statistical information associated with the specified buffer.
inputs:
  "VISA resource name": "VISA Instr", required
    # A reference to the instrument in use.  The reference to the resource name is created in the Initialize VI.  Therefore, before calling this VI, you need to call the Initialize VI.  To run this VI interactively, select the previously initialized resource name from the pull-down menu.  To run this VI programmatically, wire the VISA resource name out terminal of the Initialize VI to subsequent VISA resource name input terminals.  You chain instrument driver VIs together by wiring the VISA resource name out terminal to subsequent VISA resource name input terminals.
  "Buffer Name (defbuffer1)": string = "defbuffer1"  # The name of the buffer to perform operations on.
  "Statistical Operation (0: Mean)": u16 = "Mean"(0)  # The statistical operation to perform on the data.
  "error in (no error)": error
outputs:
  "VISA resource name out": "VISA Instr"  # A copy of the reference to the instrument in use. The reference to the resource name is created in the Initialize VI. Wire the VISA resource name out terminal of the Initialize VI to subsequent VISA resource name input terminals. You chain instrument driver VIs together by wiring the VISA resource name out terminal to subsequent VISA resource name input terminals.
  "Data Out": f64  # The result of the Statistical Operation performed on the provided buffer.
  "error out": error
uses:
  NI::VISA::Write (Instr, String).gvi
  NI::VISA::Read (Instr, String).gvi
  Labview_NXG_Keithley_SMU_2450_2460_2461::Utility::Error Query.gvi
diagram:
  # SCPI 2450
  Pick Line(line index=$"Statistical Operation (0: Mean)", multi-line string="AVER\nSTDD\nMAX\nMIN\nPK2P") -> (output string=w1)
  Is Equal(x="", y=$"Buffer Name (defbuffer1)") -> w2
  Select(s=w2, t="defbuffer1", f=$"Buffer Name (defbuffer1)") -> w3
  Format Into String(formatString="TRAC:STAT:%s? \"%s\"", w1, w3) -> w4
  call "Write (Instr, String).gvi"(session in=$"VISA resource name", error in=$"error in (no error)", write buffer=w4) -> (session out=w5, error out=w6)
  call "Read (Instr, String).gvi"(session in=w5, error in=w6, byte count=1024) -> (session out=w7, error out=w8, read buffer=w9)
  # :TRACe:STATs:AVERage? <bufferName>
  # :TRACe:STATistics:MAXimum? <bufferName>
  # :TRACe:STATistics:MINimum? <bufferName>
  # :TRACe:STATistics:PK2Pk? <bufferName>
  # :TRACe:STATistics:STDDev? <bufferName>
  Floating Point String To Number(string=w9) -> (number=w10)
  $"Data Out" <- w10
  call "Error Query.gvi"(VISA resource name=w7, error in (no error)=w8) -> (VISA resource name out=w11, error out=w12)
  $"VISA resource name out" <- w11
  $"error out" <- w12
