vi "Fetch (Measurements).gvi"   [LabVIEW NXG 5.0.0]
# Fetches data for voltage, current, resistance, timestamp, and status.  These readings are then provided in separate arrays for each type of reading.
# Buffer Element can be a single parameter or multiple parameters.Parameters have to be separated by comma followed by space.(eg - READ, SEC, DATE)
# Note Use this VI only with other low-level VIs.  The high-level VIs automatically incorporate this functionality.  This VI does not check the instrument status.   If you want to check the instrument status, call the Error Query VI at the conclusion of the sequence.
inputs:
  "VISA resource name": "VISA Instr", required
    # A reference to the instrument in use.  The reference to the resource name is created in the Initialize VI.  Therefore, before calling this VI, you need to call the Initialize VI.  To run this VI interactively, select the previously initialized resource name from the pull-down menu.  To run this VI programmatically, wire the VISA resource name out terminal of the Initialize VI to subsequent VISA resource name input terminals.  You chain instrument driver VIs together by wiring the VISA resource name out terminal to subsequent VISA resource name input terminals.
  "Timeout (10000 ms)": i32 = 10000  # The maximum length of time, in milliseconds, in which to allow the multi-point read operation to complete. Valid Range: 0 - 4,294,967,295 ms
  "Buffer Name (defbuffer1)": string = "defbuffer1"  # A string that indicates the reading buffer; the default buffers (defbuffer1 or defbuffer2) or the name of a user-defined buffer; if no buffer is specified, this parameter defaults to defbuffer1.
  "Buffer Elements": string = "READ"  # Shold be comma separated value Eg ; READ, REL, DATE Or Single MEasurement Eg : READ
  "error in (no error)": error
outputs:
  "VISA resource name out": "VISA Instr"  # A copy of the reference to the instrument in use. The reference to the resource name is created in the Initialize VI. Wire the VISA resource name out terminal of the Initialize VI to subsequent VISA resource name input terminals. You chain instrument driver VIs together by wiring the VISA resource name out terminal to subsequent VISA resource name input terminals.
  "Data out": string  # The results of the request using the parameter in the Buffer Elements control.
  "error out": error
uses:
  NI::VISA::Write (Instr, String).gvi
  NI::VISA::Read (Instr, String).gvi
  Labview_NXG_Keithley_SMU_2450_2460_2461::Utility::Error Query.gvi
diagram:
  # NOTE :
  # Buffer Elements :
  # DATE
  # FORM
  # FRAC
  # READ
  # REL
  # SEC
  # SOUR
  # SOURFORM
  # SOURSTAT
  # SOURUNIT
  # STAT
  # TIME
  # TsT
  # UNIT
  # SCPI 2450
  w1 = ":FETCH?"  # Fetch Measurement
  Is Equal(x="", y=$"Buffer Name (defbuffer1)") -> w2
  Select(s=w2, t="defbuffer1", f=$"Buffer Name (defbuffer1)") -> w3
  Concatenate Strings(w1, " ", "\"", w3, "\"", ", ", $"Buffer Elements") -> w4
  call "Write (Instr, String).gvi"(session in=$"VISA resource name", error in=$"error in (no error)", write buffer=w4) -> (session out=w5, error out=w6)
  Property Node(instance in=w5, "Timeout"=$"Timeout (10000 ms)", error in=w6) -> ("Timeout"=w7, error out=w8, instance out=w9)
  w10 = 600000  # Bytes
  call "Read (Instr, String).gvi"(session in=w9, error in=w8, byte count=w10) -> (session out=w11, error out=w12, read buffer=w13)
  $"Data out" <- w13
  # The binary block mode for data transfer is set in Initialize.  This VI will fail if Initialize is not run first.
  Property Node(instance in=w11, "Timeout"=w7, error in=w12) -> (error out=w14, instance out=w15)
  call "Error Query.gvi"(VISA resource name=w15, error in (no error)=w14) -> (VISA resource name out=w16, error out=w17)
  $"VISA resource name out" <- w16
  $"error out" <- w17
