vi "Measure Lowlevel.gvi"   [LabVIEW NXG 5.0.0]
# Measures data for voltage, current and resistance.
# Buffer Element can be a single parameter or multiple parameters.Parameters have to be separated by comma followed by space.(eg - READ, SEC, DATE)
inputs:
  "VISA resource name": "VISA Instr", required
    # A reference to the instrument in use.  The reference to the resource name is created in the Initialize VI.  Therefore, before calling this VI, you need to call the Initialize VI.  To run this VI interactively, select the previously initialized resource name from the pull-down menu.  To run this VI programmatically, wire the VISA resource name out terminal of the Initialize VI to subsequent VISA resource name input terminals.  You chain instrument driver VIs together by wiring the VISA resource name out terminal to subsequent VISA resource name input terminals.
  "Timeout (10000 ms)": i32 = 10000  # The maximum length of time, in milliseconds, in which to allow the multi-point read operation to complete. Valid Range: 0 - 4,294,967,295 ms
  "Buffer Name (defbuffer1)": string = "defbuffer1"  # The name of the buffer to perform operations on.
  "Function (0: Volts)": u16 = "Volts"(0)  # The function which is to be measured. Note: Voltage, Current, and Resistance measurements are always taken regardless of any VI calls. The Digitizer Voltage and Digitizer Current functions are only compatible with the 2461.
  "error in (no error)": error
  "Buffer Elements": string = "READ"  # Shold be comma separated value Eg ; READ, REL, DATE Or Single MEasurement Eg : READ
outputs:
  "VISA resource name out": "VISA Instr"  # A copy of the reference to the instrument in use. The reference to the resource name is created in the Initialize VI. Wire the VISA resource name out terminal of the Initialize VI to subsequent VISA resource name input terminals. You chain instrument driver VIs together by wiring the VISA resource name out terminal to subsequent VISA resource name input terminals.
  "Data out": string  # The result of the operation performed on the provided buffer.
  "error out": error
uses:
  NI::VISA::Write (Instr, String).gvi
  NI::VISA::Read (Instr, String).gvi
  Labview_NXG_Keithley_SMU_2450_2460_2461::Utility::Error Query.gvi
diagram:
  Is Greater(x=$"Function (0: Volts)", y=1) -> w1
  case (w1) {
    frame False, Default {
      w2 = ":MEAS:%s? \"%s\", %s"
    }
    frame True {
      w2 = ":MEAS:DIG:%s? \"%s\", %s"
    }
  }
  w3 = "VOLT\nCURR\nVOLT\nCURR"  # Function
  Pick Line(line index=$"Function (0: Volts)", multi-line string=w3) -> (output string=w4)
  Is Equal(x="", y=$"Buffer Name (defbuffer1)") -> w5
  Select(s=w5, t="defbuffer1", f=$"Buffer Name (defbuffer1)") -> w6
  Format Into String(formatString=w2, w4, w6, $"Buffer Elements") -> w7
  call "Write (Instr, String).gvi"(session in=$"VISA resource name", error in=$"error in (no error)", write buffer=w7) -> (session out=w8, error out=w9)
  # NOTE :
  # Buffer Elements :
  # DATE
  # FORM
  # FRAC
  # READ
  # REL
  # SEC
  # SOUR
  # SOURFORM
  # SOURSTAT
  # SOURUNIT
  # STAT
  # TIME
  # TsT
  # UNIT
  Property Node(instance in=w8, "Timeout"=$"Timeout (10000 ms)", error in=w9) -> ("Timeout"=w10, error out=w11, instance out=w12)
  w13 = 600000  # Bytes
  call "Read (Instr, String).gvi"(session in=w12, error in=w11, byte count=w13) -> (session out=w14, error out=w15, read buffer=w16)
  $"Data out" <- w16
  # The binary block mode for data transfer is set in Initialize.  This VI will fail if Initialize is not run first.
  Property Node(instance in=w14, "Timeout"=w10, error in=w15) -> (error out=w17, instance out=w18)
  call "Error Query.gvi"(VISA resource name=w18, error in (no error)=w17) -> (VISA resource name out=w19, error out=w20)
  $"VISA resource name out" <- w19
  $"error out" <- w20
