vi "Query Limit Test Data.gvi"   [LabVIEW NXG 5.0.0]
# This command queries the results of a limit test.
# Note: Using this VI will overwrite all triggering settings with settings for a single point taken immediately.  For control over the trigger, use the Low Level API.
inputs:
  "VISA resource name": "VISA Instr", required
    # A reference to the instrument in use.  The reference to the resource name is created in the Initialize VI.  Therefore, before calling this VI, you need to call the Initialize VI.  To run this VI interactively, select the previously initialized resource name from the pull-down menu.  To run this VI programmatically, wire the VISA resource name out terminal of the Initialize VI to subsequent VISA resource name input terminals.  You chain instrument driver VIs together by wiring the VISA resource name out terminal to subsequent VISA resource name input terminals.
  "Test Number (2)": u16 = 2  # The test result to retrieve. Valid Range: 1 - 15, with 4 dependent on the instrument being equipped with the contact check option.
  "Function (0: Volts)": u16 = "Volts"(0)  # The function which is to be measured. Note: Voltage, Current, and Resistance measurements are always taken regardless of any VI calls.
  "error in (no error)": error
outputs:
  "VISA resource name out": "VISA Instr"  # A copy of the reference to the instrument in use. The reference to the resource name is created in the Initialize VI. Wire the VISA resource name out terminal of the Initialize VI to subsequent VISA resource name input terminals. You chain instrument driver VIs together by wiring the VISA resource name out terminal to subsequent VISA resource name input terminals.
  "Test Passed": bool  # The value of the test result. True means the test passed.
  "Test Results": string  # The results of the test can be one of the following: HIGH - The measurement was higher than the highest limit set. LOW - The measurement was lower than the lowest limit set. NONE - The test passed.
  "error out": error
uses:
  NI::VISA::Write (Instr, String).gvi
  NI::VISA::Read (Instr, String).gvi
  Labview_NXG_Keithley_SMU_2450_2460_2461::Utility::Error Query.gvi
diagram:
  w1 = "VOLT\nCURR\nRES"  # Function
  Pick Line(line index=$"Function (0: Volts)", multi-line string=w1) -> (output string=w2)
  Format Into String(formatString="CALC2:%s:LIM%d:FAIL?", w2, $"Test Number (2)") -> w3
  call "Write (Instr, String).gvi"(session in=$"VISA resource name", error in=$"error in (no error)", write buffer=w3) -> (session out=w4, error out=w5)
  call "Read (Instr, String).gvi"(session in=w4, error in=w5, byte count=12) -> (session out=w6, error out=w7, read buffer=w8)
  Is Equal(x="NONE\n", y=w8) -> w9
  # :CALCulate2:CURRent[:DC]:LIMit<y>:FAIL?
  # :CALCulate2:RESistance:LIMit<y>:FAIL?
  # :CALCulate2:VOLTage[:DC]:LIMit<y>:FAIL?
  $"Test Passed" <- w9
  $"Test Results" <- w8
  call "Error Query.gvi"(VISA resource name=w6, error in (no error)=w7) -> (VISA resource name out=w10, error out=w11)
  $"VISA resource name out" <- w10
  $"error out" <- w11
