vi "Read (Digitize).gvi"   [LabVIEW NXG 5.0.0]
# This query makes a digitize measurement, places it in a reading buffer, and returns the latest reading.
# You must set the instrument to a digitize function before sending this command.
# This query makes the number of readings specified by [:SENSe[1]]:DIGitize:COUNt. If multiple
# readings are made, all readings are available in the reading buffer. However, only the last reading is
# returned as a reading with the command. To get multiple readings, use the :TRACe:DATA?
# command.
# When specifying buffer elements, you can:
# • Specify buffer elements in any order.
# • Include any or all of the buffer elements listed below in a single list. You can repeat elements as
# long as the number of elements in the list is less than 14.
# • Use a comma to delineate multiple elements for a data point.
# This function is only compatible with the 2461.
inputs:
  "VISA resource name": "VISA Instr" = "USB0::0x05E6::0x2461::04090176::INSTR"
    # A reference to the instrument in use.  The reference to the resource name is created in the Initialize VI.  Therefore, before calling this VI, you need to call the Initialize VI.  To run this VI interactively, select the previously initialized resource name from the pull-down menu.  To run this VI programmatically, wire the VISA resource name out terminal of the Initialize VI to subsequent VISA resource name input terminals.  You chain instrument driver VIs together by wiring the VISA resource name out terminal to subsequent VISA resource name input terminals.
  "Timeout (10000 ms)": i32 = 10000  # The maximum length of time, in milliseconds, in which to allow the read operation to complete. Valid Range: 0 - 4,294,967,295 ms
  "Buffer Name (defbuffer1)": string = "defbuffer1"  # The name of the buffer where the reading is stored; if nothing is specified, the reading that is stored in defbuffer1.
  "Buffer Elements": string = "READ"
    # The options for <bufferElements> are as follows:
    # DATE: The date when the data point was measured.
    # FORMatted: The measured value as it appears on the front panel.
    # FRACtional: The fractional seconds for the data point when the data point was measured.
    # READing: The measurement reading based on the SENS:FUNC setting; if no buffer elements are defined, this option is used.
    # RELative: The relative time when the data point was measured.
    # SEConds: The seconds in UTC (Coordinated Universal Time) format when the data point was measured.
    # SOURce: The source value; if readback is ON, then it is the readback value, otherwise it is the programmed source value (see :SOURce[1]:<function>:READ:BACK (on page 6-75)).
    # SOURFORMatted: The source value as it appears on the display.
    # SOURSTATus: The status information associated with sourcing.
    # SOURUNIT: The unit of value associated with the source value.
    # STATus: The status information associated with the measurement.
    # TIME: The time for the data point.
    # TSTamp: The timestamp for the data point.
    # UNIT: The unit of measure associated with the measurement.
  "error in (no error)": error
outputs:
  "VISA resource name out": "VISA Instr"  # A copy of the reference to the instrument in use. The reference to the resource name is created in the Initialize VI. Wire the VISA resource name out terminal of the Initialize VI to subsequent VISA resource name input terminals. You chain instrument driver VIs together by wiring the VISA resource name out terminal to subsequent VISA resource name input terminals.
  "Data out": string  # The results of the request using the parameter in the Buffer Elements control.
  "error out": error
uses:
  NI::VISA::Write (Instr, String).gvi
  NI::VISA::Read (Instr, String).gvi
  Labview_NXG_Keithley_SMU_2450_2460_2461::Utility::Error Query.gvi
diagram:
  # SCPI 2450
  w1 = ":READ:DIG?"  # Read Measurement
  Is Equal(x="", y=$"Buffer Name (defbuffer1)") -> w2
  Select(s=w2, t="defbuffer1", f=$"Buffer Name (defbuffer1)") -> w3
  # :READ? "<BufferName>", <Buffer Element>
  Concatenate Strings(w1, " ", "\"", w3, "\"", ", ", $"Buffer Elements") -> w4
  call "Write (Instr, String).gvi"(session in=$"VISA resource name", error in=$"error in (no error)", write buffer=w4) -> (session out=w5, error out=w6)
  # NOTE :
  # Buffer Elements :
  # DATE
  # FORM
  # FRAC
  # READ
  # REL
  # SEC
  # SOUR
  # SOURFORM
  # SOURSTAT
  # SOURUNIT
  # STAT
  # TIME
  # TsT
  # UNIT
  Property Node(instance in=w5, "Timeout"=$"Timeout (10000 ms)", error in=w6) -> ("Timeout"=w7, error out=w8, instance out=w9)
  w10 = 600000  # Bytes
  call "Read (Instr, String).gvi"(session in=w9, error in=w8, byte count=w10) -> (session out=w11, error out=w12, read buffer=w13)
  $"Data out" <- w13
  Property Node(instance in=w11, "Timeout"=w7, error in=w12) -> (error out=w14, instance out=w15)
  call "Error Query.gvi"(VISA resource name=w15, error in (no error)=w14) -> (VISA resource name out=w16, error out=w17)
  $"VISA resource name out" <- w16
  $"error out" <- w17
