vi "Single Measurement.gvi"   [LabVIEW NXG 5.0.0]
panel controls:
  "VISA resource name": "VISA Instr"
    # A reference to the instrument in use.  The reference to the resource name is created in the Initialize VI.  Therefore, before calling this VI, you need to call the Initialize VI.  To run this VI interactively, select the previously initialized resource name from the pull-down menu.  To run this VI programmatically, wire the VISA resource name out terminal of the Initialize VI to subsequent VISA resource name input terminals.  You chain instrument driver VIs together by wiring the VISA resource name out terminal to subsequent VISA resource name input terminals.
  "error in (no error)": error
  "What to Measure": i32 = "Voltage"(0)
  "Timeout (10000 ms)": i32 = 10000  # The maximum length of time, in milliseconds, in which to allow the read operation to complete. Valid Range: 0 - 4,294,967,295 ms
  "Buffer Name (defbuffer1)": string = "defbuffer1"  # The name of the buffer where the reading is stored; if nothing is specified, the reading that is stored in defbuffer1.
  "Buffer Elements": string = "READ"
    # The options for <bufferElements> are as follows:
    # DATE: The date when the data point was measured.
    # FORMatted: The measured value as it appears on the front panel.
    # FRACtional: The fractional seconds for the data point when the data point was measured.
    # READing: The measurement reading based on the SENS:FUNC setting; if no buffer elements are defined, this option is used.
    # RELative: The relative time when the data point was measured.
    # SEConds: The seconds in UTC (Coordinated Universal Time) format when the data point was measured.
    # SOURce: The source value; if readback is ON, then it is the readback value, otherwise it is the programmed source value (see :SOURce[1]:<function>:READ:BACK (on page 6-75)).
    # SOURFORMatted: The source value as it appears on the display.
    # SOURSTATus: The status information associated with sourcing.
    # SOURUNIT: The unit of value associated with the source value.
    # STATus: The status information associated with the measurement.
    # TIME: The time for the data point.
    # TSTamp: The timestamp for the data point.
    # UNIT: The unit of measure associated with the measurement.
panel indicators:
  "error out": error
  "VISA resource name out": "VISA Instr"  # A copy of the reference to the instrument in use. The reference to the resource name is created in the Initialize VI. Wire the VISA resource name out terminal of the Initialize VI to subsequent VISA resource name input terminals. You chain instrument driver VIs together by wiring the VISA resource name out terminal to subsequent VISA resource name input terminals.
  "Data Out": string
uses:
  NI::VISA::Write (Instr, String).gvi
  NI::VISA::Read (Instr, String).gvi
  Labview_NXG_Keithley_SMU_2450_2460_2461::Utility::Error Query.gvi
diagram:
  # This SubVI Takes a single measurement and returns it as a string
  case ($"error in (no error)") {
    frame Error, Default {
      w1 = $"error in (no error)"
      w2 = default
      w3 = $"VISA resource name"
    }
    frame No Error {
      Array Index(array=["VOLT", "CURR", "RES"]) -> (out0[$"What to Measure"]=w4)
      Is Equal(x="", y=$"Buffer Name (defbuffer1)") -> w5
      Select(s=w5, t="defbuffer1", f=$"Buffer Name (defbuffer1)") -> w6
      Concatenate Strings(":MEAS:", w4, " ", "\"", w6, "\"", ", ", $"Buffer Elements") -> w7
      call "Write (Instr, String).gvi"(session in=$"VISA resource name", error in=$"error in (no error)", write buffer=w7) -> (session out=w8, error out=w9)
      Property Node(instance in=w8, "Timeout"=$"Timeout (10000 ms)", error in=w9) -> (error out=w10, instance out=w11)
      call "Read (Instr, String).gvi"(session in=w11, error in=w10, byte count=60000) -> (session out=w12, error out=w13, read buffer=w2)
      call "Error Query.gvi"(VISA resource name=w12, error in (no error)=w13) -> (VISA resource name out=w3, error out=w1)
    }
  }
  $"VISA resource name out" <- w3
  $"error out" <- w1
  $"Data Out" <- w2
