vi "Keithley 2450 Output List and Acquire.gvi"   [LabVIEW NXG 5.0.0]
# Outputs a sequence of voltages based on a list and takes readings at each point.
panel controls:
  "Limit Level (0.1)": f64 = 0.1  # Sets the maximum value for the value not regulated by the Source Mode control. For instance, if the instrument was suppling a voltage, the compliance value would be in amps.
  "VISA resource name": "VISA Instr"
    # Specifies which instrument to use.  Instruments that are powered on and connected to your computer are visible in the VISA resource name pull-down menu.  Select the resource name from the VISA resource name pull-down menu.  If your instrument does not appear in this list, enter the instrument descriptor using the following format:
    # Interface Type[board index]::Address::INSTR.
    # Examples:
    # GPIB:  GPIB::22::INSTR,  GPIB board 0, primary address 22
    # Serial:  COM1
    # VISA Alias:  "SampleInstr" - Alias names are configured in MAX
    # Refer to the LabVIEW Help for more information about specifying a VISA resource name.
  "Output List": f64[] = [0.1, 0.2, 0.3]
  "Source Mode (0: Voltage)": u16 = "Voltage"(0)  # Selects the voltage or current source mode to be configured.
panel indicators:
  "Waveform Graph": f64[][]
uses:
  Labview_NXG_Keithley_SMU_2450_2460_2461::Miscelaneous::Initialize.gvi
  Labview_NXG_Keithley_SMU_2450_2460_2461::Configure::Configure Measurement Function.gvi
  Labview_NXG_Keithley_SMU_2450_2460_2461::Configure::Configure Measurement Range.gvi
  Labview_NXG_Keithley_SMU_2450_2460_2461::Configure::Configure Source Function.gvi
  Labview_NXG_Keithley_SMU_2450_2460_2461::Configure::Configure Source Limit Level.gvi
  Labview_NXG_Keithley_SMU_2450_2460_2461::Configure::Configure Output List.gvi
  Labview_NXG_Keithley_SMU_2450_2460_2461::Action Status::Enable Output.gvi
  Labview_NXG_Keithley_SMU_2450_2460_2461::Configure::Configure List Mode Sweep.gvi
  Labview_NXG_Keithley_SMU_2450_2460_2461::Data::Low Level::Initiate.gvi
  Labview_NXG_Keithley_SMU_2450_2460_2461::Data::Low Level::Wait for Operation Complete.gvi
  Labview_NXG_Keithley_SMU_2450_2460_2461::Data::Read (Multiple Points).gvi
  Labview_NXG_Keithley_SMU_2450_2460_2461::Miscelaneous::Close.gvi
  NI::G Core::Error::Display Error.gvi
diagram:
  # Configure the measurements and output.  Configure Output must be called to set the compliance level.
  case ($"Source Mode (0: Voltage)") {
    frame 0, Default {
      w2 = "Current"(1)  # Function (0: Volts)
      w1 = w2
    }
    frame 1 {
      w3 = "Volts"(0)  # Function (0: Volts)
      w1 = w3
    }
  }
  call "Initialize.gvi"(VISA resource name=$"VISA resource name") -> (VISA resource name out=w4, error out=w5)
  call "Configure Measurement Function.gvi"(VISA resource name=w4, Function (0: Volts)="Volts"(0), error in (no error)=w5) -> (VISA resource name out=w6, error out=w7)
  call "Configure Measurement Range.gvi"(VISA resource name=w6, error in (no error)=w7) -> (VISA resource name out=w8, error out=w9)
  # Configure the list with the amplitude array and source settings.
  call "Configure Measurement Range.gvi"(VISA resource name=w8, error in (no error)=w9) -> (VISA resource name out=w10, error out=w11)
  call "Configure Source Function.gvi"(VISA resource name=w10, Function (0: Volts)=$"Source Mode (0: Voltage)", error in (no error)=w11) -> (VISA resource name out=w12, error out=w13)
  call "Configure Measurement Function.gvi"(VISA resource name=w12, Function (0: Volts)=w1, error in (no error)=w13) -> (VISA resource name out=w14, error out=w15)
  call "Configure Source Limit Level.gvi"(VISA resource name=w14, Function (0: Volts)="Volts"(0), Source Limit (1.0)=$"Limit Level (0.1)", error in (no error)=w15) -> (VISA resource name out=w16, error out=w17)
  # Read the raw data.  For the output list to work correctly, the Output Mode must be set to List.  Also, the size of the list needs to be passed to Sample Count.
  call "Configure Output List.gvi"(VISA resource name=w16, Output List=$"Output List", Source Mode (0: Voltage)=$"Source Mode (0: Voltage)", error in (no error)=w17) -> (VISA resource name out=w18, error out=w19)
  call "Enable Output.gvi"(VISA resource name=w18, error in (no error)=w19) -> (VISA resource name out=w20, error out=w21)
  call "Configure List Mode Sweep.gvi"(VISA resource name=w20, Start Index=1, Delay (0)=0, error in (no error)=w21, Source Mode (0: Voltage)=$"Source Mode (0: Voltage)") -> (VISA resource name out=w22, error out=w23)
  call "Initiate.gvi"(VISA resource name=w22, error in (no error)=w23) -> (VISA resource name out=w24, error out=w25)
  call "Wait for Operation Complete.gvi"(VISA resource name=w24, Timeout (10000 ms)=100000, error in (no error)=w25) -> (VISA resource name out=w26, error out=w27)
  Array Size(array=$"Output List") -> (size(s)=w28)
  To Unsigned 32 Bit Integer(number=w28) -> w29
  case ($"Source Mode (0: Voltage)") {
    frame 0, Default {
      sequence {
        frame 0 {
          Wait(time to wait=2000)
        }
        frame 1 {
          call "Read (Multiple Points).gvi"(VISA resource name=w26, Start Index (1)=1, End Index (1)=w29, error in (no error)=w27, Buffer Elements="SOUR, READ") -> (VISA resource name out=w30, Data out=w32, error out=w31)
        }
      }
    }
    frame 1 {
      sequence {
        frame 0 {
          Wait(time to wait=2000)
        }
        frame 1 {
          call "Read (Multiple Points).gvi"(VISA resource name=w26, Start Index (1)=1, End Index (1)=w29, error in (no error)=w27, Buffer Elements="READ, SOUR") -> (VISA resource name out=w30, Data out=w32, error out=w31)
        }
      }
    }
  }
  Spreadsheet String To Array(array type=f64[] [], delimiter=",", format string="%s", spreadsheet string=w32) -> (array=w33)
  Decimate Array(array=w33) -> (out0=w34, out1=w35)
  Build Array(w34, w35) -> w36
  $"Waveform Graph" <- w36
  call "Enable Output.gvi"(VISA resource name=w30, Enable Output (T: Enable)=FALSE, error in (no error)=w31) -> (VISA resource name out=w37, error out=w38)
  call "Close.gvi"(VISA resource name=w37, error in (no error)=w38) -> (error out=w39)
  call "Display Error.gvi"(error in=w39)
