vi "Keithley 2450 Read Multiple.gvi"   [LabVIEW NXG 5.0.0]
# This example shows how to configure a measurement and take multiple readings.
panel controls:
  "VISA resource name": "VISA Instr"
    # Specifies which instrument to use.  Instruments that are powered on and connected to your computer are visible in the VISA resource name pull-down menu.  Select the resource name from the VISA resource name pull-down menu.  If your instrument does not appear in this list, enter the instrument descriptor using the following format:
    # Interface Type[board index]::Address::INSTR.
    # Examples:
    # GPIB:  GPIB::22::INSTR,  GPIB board 0, primary address 22
    # Serial:  COM1
    # TCP/IP Instr:  TCPIP::10.0.32.48::INSTR
    # TCP/IP Socket: TCPIP::10.0.32.45::3800::SOCKET
    # USB Instr:  selectable from VISA Resource Name pull-down menu
    # USB Raw:  You must first link VISA to non-USBTMC instruments by using the VISA Driver Development Wizard
    # VISA Alias:  "SampleInstr" - Alias names are configured in MAX
    # Refer to the LabVIEW Help for more information about specifying a VISA resource name.
  "Compliance Level (0.1)": f64 = 0.1  # Sets the maximum value for the value not regulated by the Source Mode control. For instance, if the instrument was suppling a voltage, the compliance value would be in amps. Valid Range: 2400: -1.05 A to 1.05 A -210 V to 210 V 2410: -1.05 A to 1.05 A -1100V to 1100V 2420: -3.15 A to 3.15 A -63 V to 63 V 2425 and 2430: -3.15 A to 3.15 A -105 V to 105 V 2430 Pulse Mode: -10.5 A to 10.5 A -105 V to 105 V 2440: -5.25 to 5.25 A -42 V to 42 V
  "Output Level (0)": f64  # The desired output level for the device. The source value unit is dependent on the Source Mode. Valid Range: 2400: -1.05 A to 1.05 A -210 V to 210 V 2410: -1.05 A to 1.05 A -1100V to 1100V 2420: -3.15 A to 3.15 A -63 V to 63 V 2425 and 2430: -3.15 A to 3.15 A -105 V to 105 V 2430 Pulse Mode: -10.5 A to 10.5 A -105 V to 105 V 2440: -5.25 to 5.25 A -42 V to 42 V
  "Source Mode (0: Voltage)": u16 = "Voltage"(0)  # Selects the voltage or current source mode to be configured.
panel indicators:
  "Voltage": f32[]
  "Current": f32[]
  "Resistance": f32[]
uses:
  Labview_NXG_Keithley_SMU_2450_2460_2461::Miscelaneous::Initialize.gvi
  Labview_NXG_Keithley_SMU_2450_2460_2461::Configure::Configure Measurement Range.gvi
  Labview_NXG_Keithley_SMU_2450_2460_2461::Configure::Configure Output.gvi
  Labview_NXG_Keithley_SMU_2450_2460_2461::Configure::Configure Source Function.gvi
  Labview_NXG_Keithley_SMU_2450_2460_2461::Configure::Configure Measurement Function.gvi
  Labview_NXG_Keithley_SMU_2450_2460_2461::Configure::Set Measurement Count.gvi
  Labview_NXG_Keithley_SMU_2450_2460_2461::Action Status::Enable Output.gvi
  Labview_NXG_Keithley_SMU_2450_2460_2461::Data::Make Reading and Store in Buffer.gvi
  Labview_NXG_Keithley_SMU_2450_2460_2461::Data::Read (Multiple Points).gvi
  Labview_NXG_Keithley_SMU_2450_2460_2461::Miscelaneous::Close.gvi
  NI::G Core::Error::Display Error.gvi
diagram:
  w1 = TRUE  # Enable Auto Range
  call "Initialize.gvi"(VISA resource name=$"VISA resource name") -> (VISA resource name out=w2, error out=w3)
  call "Configure Measurement Range.gvi"(VISA resource name=w2, Function (0: Volts)="Volts"(0), Enable Auto Range (T:Enable)=w1, error in (no error)=w3) -> (VISA resource name out=w4, error out=w5)
  call "Configure Measurement Range.gvi"(VISA resource name=w4, Function (0: Volts)="Current"(1), Enable Auto Range (T:Enable)=w1, error in (no error)=w5) -> (VISA resource name out=w6, error out=w7)
  call "Configure Measurement Range.gvi"(VISA resource name=w6, Function (0: Volts)="Resistance"(2), Enable Auto Range (T:Enable)=w1, error in (no error)=w7) -> (VISA resource name out=w8, error out=w9)
  # Configure the output
  # and the source function.
  call "Configure Output.gvi"(VISA resource name=w8, Source Level (0)=$"Output Level (0)", Source Mode (0: Voltage)=$"Source Mode (0: Voltage)", Source Limit Level (0.1)=$"Compliance Level (0.1)", error in (no error)=w9) -> (VISA resource name out=w10, error out=w11)
  call "Configure Source Function.gvi"(VISA resource name=w10, Function (0: Volts)=$"Source Mode (0: Voltage)", error in (no error)=w11) -> (VISA resource name out=w12, error out=w13)
  # Configure each of the three measurements.
  for (iteration -> i1) {
    w14 = each element of [0, 1, 2]
    call "Configure Measurement Function.gvi"(VISA resource name=w12, Function (0: Volts)=w14, error in (no error)=w13) -> (VISA resource name out=w15, error out=w16)
    # Set the measure count.
    call "Set Measurement Count.gvi"(VISA resource name=w15, Measurement Count=10, error in (no error)=w16) -> (VISA resource name out=w17, error out=w18)
    call "Enable Output.gvi"(VISA resource name=w17, Enable Output (T: Enable)=TRUE, error in (no error)=w18) -> (VISA resource name out=w19, error out=w20)
    # Use the Make Reading VI to start the acquisition.
    call "Make Reading and Store in Buffer.gvi"(VISA resource name=w19, error in (no error)=w20) -> (VISA resource name out=w21, error out=w22)
    # Read 10 measurements from the buffer with
    # Read (Multiple Points) VI then move buffer index.
    case (i1) {
      frame 0, Default {
        w23 = 1
        w24 = 10
      }
      frame 1 {
        w23 = 11
        w24 = 20
      }
      frame 2 {
        w23 = 21
        w24 = 30
      }
    }
    call "Read (Multiple Points).gvi"(VISA resource name=w21, Start Index (1)=w23, End Index (1)=w24, error in (no error)=w22) -> (VISA resource name out=w25, Data out=w26, error out=w27)
    Spreadsheet String To Array(array type=f64[] [], delimiter=".", format string="%s", spreadsheet string=w26) -> (array=w28)
    case (w14) {
      frame 0, Default {
        $Voltage <- w28
      }
      frame 1 {
        $Current <- w28
      }
      frame 2 {
        $Resistance <- w28
      }
    }
  }
  call "Enable Output.gvi"(VISA resource name=w25, Enable Output (T: Enable)=FALSE, error in (no error)=w27) -> (VISA resource name out=w29, error out=w30)
  call "Close.gvi"(VISA resource name=w29, error in (no error)=w30) -> (error out=w31)
  call "Display Error.gvi"(error in=w31)
