vi "Keithley 2450 Read Single.gvi"   [LabVIEW NXG 5.0.0]
# This example shows how to configure a measurement and take a reading.
panel controls:
  "VISA resource name": "VISA Instr"
    # Specifies which instrument to use.  Instruments that are powered on and connected to your computer are visible in the VISA resource name pull-down menu.  Select the resource name from the VISA resource name pull-down menu.  If your instrument does not appear in this list, enter the instrument descriptor using the following format:
    # Interface Type[board index]::Address::INSTR.
    # Examples:
    # GPIB:  GPIB::22::INSTR,  GPIB board 0, primary address 22
    # Serial:  COM1
    # TCP/IP Instr:  TCPIP::10.0.32.48::INSTR
    # TCP/IP Socket: TCPIP::10.0.32.45::3800::SOCKET
    # USB Instr:  selectable from VISA Resource Name pull-down menu
    # USB Raw:  You must first link VISA to non-USBTMC instruments by using the VISA Driver Development Wizard
    # VISA Alias:  "SampleInstr" - Alias names are configured in MAX
    # Refer to the LabVIEW Help for more information about specifying a VISA resource name.
  "Output Level (0)": f64  # The desired output level for the device. The source value unit is dependent on the Source Mode. Valid Range: Voltage: +/-210V Current: +/-1A
  "Compliance Level (0.1)": f64 = 0.1  # Sets the maximum value for the value not regulated by the Source Mode control. For instance, if the instrument was suppling a voltage, the compliance value would be in amps. Valid Range: Voltage: +/-210V Current: +/- 1A
  "Source Mode (0: Voltage)": u16 = "Voltage"(0)  # Selects the voltage or current source mode to be configured.
panel indicators:
  "Voltage (V)": f64  # The voltage reading from the instrument.
  "Current (A)": f64  # The current reading from the instrument.
  "Resistance (ohm)": f64  # The resistance reading from the instrument.
  "string": string[]
  "number": f64[]
uses:
  Labview_NXG_Keithley_SMU_2450_2460_2461::Miscelaneous::Initialize.gvi
  Labview_NXG_Keithley_SMU_2450_2460_2461::Configure::Configure Measurement Range.gvi
  Labview_NXG_Keithley_SMU_2450_2460_2461::Configure::Configure Output.gvi
  Labview_NXG_Keithley_SMU_2450_2460_2461::Configure::Configure Source Function.gvi
  Labview_NXG_Keithley_SMU_2450_2460_2461::Configure::Configure Measurement Function.gvi
  Labview_NXG_Keithley_SMU_2450_2460_2461::Action Status::Enable Output.gvi
  Labview_NXG_Keithley_SMU_2450_2460_2461::Data::Read (Single Point).gvi
  Labview_NXG_Keithley_SMU_2450_2460_2461::Miscelaneous::Close.gvi
  NI::G Core::Error::Display Error.gvi
diagram:
  call "Initialize.gvi"(VISA resource name=$"VISA resource name") -> (VISA resource name out=w1, error out=w2)
  call "Configure Measurement Range.gvi"(VISA resource name=w1, Function (0: Volts)="Volts"(0), Enable Auto Range (T:Enable)=TRUE, error in (no error)=w2) -> (VISA resource name out=w3, error out=w4)
  call "Configure Measurement Range.gvi"(VISA resource name=w3, Function (0: Volts)="Current"(1), Enable Auto Range (T:Enable)=TRUE, error in (no error)=w4) -> (VISA resource name out=w5, error out=w6)
  call "Configure Measurement Range.gvi"(VISA resource name=w5, Function (0: Volts)="Resistance"(2), Enable Auto Range (T:Enable)=TRUE, error in (no error)=w6) -> (VISA resource name out=w7, error out=w8)
  call "Configure Output.gvi"(VISA resource name=w7, Source Level (0)=$"Output Level (0)", Source Mode (0: Voltage)=$"Source Mode (0: Voltage)", Source Limit Level (0.1)=$"Compliance Level (0.1)", error in (no error)=w8) -> (VISA resource name out=w9, error out=w10)
  call "Configure Source Function.gvi"(VISA resource name=w9, Function (0: Volts)=$"Source Mode (0: Voltage)", error in (no error)=w10) -> (VISA resource name out=w11, error out=w12)
  for {
    w13 = each element of [0, 1, 2]
    call "Configure Measurement Function.gvi"(VISA resource name=w11, Function (0: Volts)=w13, error in (no error)=w12) -> (VISA resource name out=w15, error out=w16)
    call "Enable Output.gvi"(VISA resource name=w15, Enable Output (T: Enable)=TRUE, error in (no error)=w16) -> (VISA resource name out=w17, error out=w18)
    call "Read (Single Point).gvi"(VISA resource name=w17, error in (no error)=w18) -> (VISA resource name out=w19, Data out=w20, error out=w21)
    append w20 to w14
  }
  $string <- w14
  for {
    w22 = each element of w14
    Floating Point String To Number(string=w22, use system decimal point (T)=FALSE) -> (number=w24)
    append w24 to w23
  }
  Array Index(array=w23) -> (out0[_]=w25, out1[_]=w26, out2[_]=w27)
  $"Current (A)" <- w26
  $number <- w23
  $"Resistance (ohm)" <- w27
  $"Voltage (V)" <- w25
  call "Enable Output.gvi"(VISA resource name=w19, Enable Output (T: Enable)=FALSE, error in (no error)=w21) -> (VISA resource name out=w28, error out=w29)
  call "Close.gvi"(VISA resource name=w28, error in (no error)=w29) -> (error out=w30)
  call "Display Error.gvi"(error in=w30)
