vi "Keithley 2461 Digitized Sweep.gvi"   [LabVIEW NXG 5.0.0]
panel controls:
  "Limit Level (0.1)": f64 = 0.1  # Sets the maximum value for the value not regulated by the Source Mode control. For instance, if the instrument was suppling a voltage, the compliance value would be in amps. Valid Range: Voltage: +/- 210V Current: +/- 1A
  "VISA resource name": "VISA Instr" = "USB0::0x05E6::0x2461::04090181::INSTR"
    # Specifies which instrument to use.  Instruments that are powered on and connected to your computer are visible in the VISA resource name pull-down menu.  Select the resource name from the VISA resource name pull-down menu.  If your instrument does not appear in this list, enter the instrument descriptor using the following format:
    # Interface Type[board index]::Address::INSTR.
    # Examples:
    # GPIB:  GPIB::22::INSTR,  GPIB board 0, primary address 22
    # Serial:  COM1
    # VISA Alias:  "SampleInstr" - Alias names are configured in MAX
    # Refer to the LabVIEW Help for more information about specifying a VISA resource name.
  "Source Mode (0: Voltage)": u16 = "Voltage"(0)  # Selects the voltage or current source mode to be configured.
  "Sweep Points": T1 = {"Start "=0, "Stop "=5, "Number of Points (5)"=100}
  "Delay (0) in Sec": f64  # The amount of delay between source and measure.
  "Sample Rate (1000 Hz)": u32 = 25000  # The number of power line cycles the instrument spends taking a measurement. This setting is global for voltage, current, and resistance measurements. Valid Range: 0.01 to 10 PLC
  "Digital Voltage Range (1.0)": f64 = 10  # Set this command to a specific value or a preset value: Current: 1e-08 to 1 amps Resistance: 20 to 2e8 ohms Voltage: 0.02 to 200 volts
  "Digital Current Range (1.0)": f64 = 0.5  # Set this command to a specific value or a preset value: Current: 1e-08 to 1 amps Resistance: 20 to 2e8 ohms Voltage: 0.02 to 200 volts
panel indicators:
  "Waveform Graph": f64[][]
types:
  T1 = cluster{"Start ": f64, "Stop ": f64, "Number of Points (5)": u32}
uses:
  Labview_NXG_Keithley_SMU_2450_2460_2461::Miscelaneous::Initialize.gvi
  Labview_NXG_Keithley_SMU_2450_2460_2461::Configure::Configure Measurement Manual Range.gvi
  Labview_NXG_Keithley_SMU_2450_2460_2461::Configure::Configure Output.gvi
  Labview_NXG_Keithley_SMU_2450_2460_2461::Configure::Configure Source Function.gvi
  Labview_NXG_Keithley_SMU_2450_2460_2461::Configure::Configure Measurement Function.gvi
  Labview_NXG_Keithley_SMU_2450_2460_2461::Configure::Digitizer Sample Rate.gvi
  Labview_NXG_Keithley_SMU_2450_2460_2461::Configure::Configure Linear Mode Sweep.gvi
  Labview_NXG_Keithley_SMU_2450_2460_2461::Action Status::Enable Output.gvi
  Labview_NXG_Keithley_SMU_2450_2460_2461::Data::Low Level::Initiate.gvi
  Labview_NXG_Keithley_SMU_2450_2460_2461::Data::Low Level::Wait for Operation Complete.gvi
  Labview_NXG_Keithley_SMU_2450_2460_2461::Data::Read (Multiple Points).gvi
  Labview_NXG_Keithley_SMU_2450_2460_2461::Miscelaneous::Close.gvi
  NI::G Core::Error::Display Error.gvi
diagram:
  # Configure the measurements and output.
  Property Node(instance in=$"Sweep Points") -> ("Number of Points (5)"=w1)
  case ($"Source Mode (0: Voltage)") {
    frame 0, Default {
      w2 = "Digitize Current"(4)
      w3 = "Digitize Current"(1)
    }
    frame 1 {
      w2 = "Digitize Voltage"(4)
      w3 = "Digitize Voltage"(0)
    }
  }
  call "Initialize.gvi"(VISA resource name=$"VISA resource name") -> (VISA resource name out=w4, error out=w5)
  call "Configure Measurement Manual Range.gvi"(VISA resource name=w4, Function (0: Volts)="Digitize Voltage"(3), Manual Range (1.0)=$"Digital Voltage Range (1.0)", error in (no error)=w5) -> (VISA resource name out=w6, error out=w7)
  call "Configure Measurement Manual Range.gvi"(VISA resource name=w6, Function (0: Volts)="Digitize Current"(4), Manual Range (1.0)=$"Digital Current Range (1.0)", error in (no error)=w7) -> (VISA resource name out=w8, error out=w9)
  call "Configure Output.gvi"(VISA resource name=w8, Source Mode (0: Voltage)=$"Source Mode (0: Voltage)", Source Limit Level (0.1)=$"Limit Level (0.1)", error in (no error)=w9) -> (VISA resource name out=w10, error out=w11)
  call "Configure Source Function.gvi"(VISA resource name=w10, Function (0: Volts)=$"Source Mode (0: Voltage)", error in (no error)=w11) -> (VISA resource name out=w12, error out=w13)
  call "Configure Measurement Function.gvi"(VISA resource name=w12, Function (0: Volts)=w2, error in (no error)=w13) -> (VISA resource name out=w14, error out=w15)
  call "Digitizer Sample Rate.gvi"(VISA resource name=w14, Digitize Function (Voltage)=w3, Sample Rate (100000)=$"Sample Rate (1000 Hz)", error in (no error)=w15) -> (VISA resource name out=w16, error out=w17)
  call "Configure Linear Mode Sweep.gvi"(VISA resource name=w16, Source Mode (0: Voltage)=$"Source Mode (0: Voltage)", Sweep Points=$"Sweep Points", Delay (0)=$"Delay (0) in Sec", error in (no error)=w17) -> (VISA resource name out=w18, error out=w19)
  call "Enable Output.gvi"(VISA resource name=w18, Enable Output (T: Enable)=TRUE, error in (no error)=w19) -> (VISA resource name out=w20, error out=w21)
  call "Initiate.gvi"(VISA resource name=w20, error in (no error)=w21) -> (VISA resource name out=w22, error out=w23)
  call "Wait for Operation Complete.gvi"(VISA resource name=w22, Timeout (10000 ms)=150000, error in (no error)=w23) -> (VISA resource name out=w24, error out=w25)
  # Read the raw data.
  # Configure the sweep with the amplitude and source settings.
  case ($"Source Mode (0: Voltage)") {
    frame 0, Default {
      sequence {
        frame 0 {
          Wait(time to wait=2000)
        }
        frame 1 {
          call "Read (Multiple Points).gvi"(VISA resource name=w24, Start Index (1)=1, End Index (1)=w1, error in (no error)=w25, Buffer Elements="SOUR, READ") -> (VISA resource name out=w26, Data out=w28, error out=w27)
        }
      }
    }
    frame 1 {
      sequence {
        frame 0 {
          Wait(time to wait=2000)
        }
        frame 1 {
          call "Read (Multiple Points).gvi"(VISA resource name=w24, Start Index (1)=1, End Index (1)=w1, error in (no error)=w25, Buffer Elements="READ, SOUR") -> (VISA resource name out=w26, Data out=w28, error out=w27)
        }
      }
    }
  }
  Spreadsheet String To Array(array type=f64[] [], delimiter=",", format string="%s", spreadsheet string=w28) -> (array=w29)
  Decimate Array(array=w29) -> (out0=w30, out1=w31)
  Build Array(w30, w31) -> w32
  $"Waveform Graph" <- w32
  call "Enable Output.gvi"(VISA resource name=w26, Enable Output (T: Enable)=FALSE, error in (no error)=w27) -> (VISA resource name out=w33, error out=w34)
  call "Close.gvi"(VISA resource name=w33, error in (no error)=w34) -> (error out=w35)
  call "Display Error.gvi"(error in=w35)
