vi "Keithley 2461 Pulse Output List and Aquire.gvi"   [LabVIEW NXG 5.0.0]
panel controls:
  "Limit Level (0.1)": f64 = 0.1  # Sets the maximum value for the value not regulated by the Source Mode control. For instance, if the instrument was suppling a voltage, the compliance value would be in amps.
  "VISA resource name": "VISA Instr" = "USB0::0x05E6::0x2461::04090181::INSTR"
    # Specifies which instrument to use.  Instruments that are powered on and connected to your computer are visible in the VISA resource name pull-down menu.  Select the resource name from the VISA resource name pull-down menu.  If your instrument does not appear in this list, enter the instrument descriptor using the following format:
    # Interface Type[board index]::Address::INSTR.
    # Examples:
    # GPIB:  GPIB::22::INSTR,  GPIB board 0, primary address 22
    # Serial:  COM1
    # VISA Alias:  "SampleInstr" - Alias names are configured in MAX
    # Refer to the LabVIEW Help for more information about specifying a VISA resource name.
  "Output List": f64[] = [1, 2, 0, 4, -3, 7, 0, 11]
  "Source Mode (0: Voltage)": u16 = "Voltage"(0)  # Selects the voltage or current source mode to be configured.
  "Pulse Limit Level (0.1)": f64 = 0.2  # Sets the maximum value for the value not regulated by the Source Mode control. For instance, if the instrument was suppling a voltage, the compliance value would be in amps.
  "Pulse Width": f64 = 0.0002  # Sets the maximum value for the value not regulated by the Source Mode control. For instance, if the instrument was suppling a voltage, the compliance value would be in amps.
  "Pulse Off Time": f64 = 0.0001  # Sets the maximum value for the value not regulated by the Source Mode control. For instance, if the instrument was suppling a voltage, the compliance value would be in amps.
  "Sample Rate (100000)": u32 = 2000  # Sample Rate: 1,000 to 1,000,000 readings per second The sample rate determines how fast the Model 2461 acquires a digitized reading. Set the sample rate before setting the aperture. If the aperture setting is too high for the selected sample rate, it is automatically adjusted to the highest aperture that can be used with the sample rate.
  "Measure Range (1.0)": f64 = 0.1  # Set this command to a specific value or a preset value: Current: 1e-08 to 1 amps Resistance: 20 to 2e8 ohms Voltage: 0.02 to 200 volts
  "Source Range (1.0)": f64 = 20  # Set the desired output range for the device. Valid Ranges: • Current: -1 A to 1 A • Voltage: -200 V to 200 V
panel indicators:
  "Waveform Graph": f64[][]
uses:
  Labview_NXG_Keithley_SMU_2450_2460_2461::Miscelaneous::Initialize.gvi
  Labview_NXG_Keithley_SMU_2450_2460_2461::Configure::Configure Source Range.gvi
  Labview_NXG_Keithley_SMU_2450_2460_2461::Configure::Configure Source Function.gvi
  Labview_NXG_Keithley_SMU_2450_2460_2461::Configure::Configure Measurement Function.gvi
  Labview_NXG_Keithley_SMU_2450_2460_2461::Configure::Configure Pulse Limit.gvi
  Labview_NXG_Keithley_SMU_2450_2460_2461::Configure::Configure Source Limit Level.gvi
  Labview_NXG_Keithley_SMU_2450_2460_2461::Configure::Configure Measurement Manual Range.gvi
  Labview_NXG_Keithley_SMU_2450_2460_2461::Configure::Digitizer Sample Rate.gvi
  Labview_NXG_Keithley_SMU_2450_2460_2461::Configure::Configure Output List.gvi
  Labview_NXG_Keithley_SMU_2450_2460_2461::Action Status::Enable Output.gvi
  Labview_NXG_Keithley_SMU_2450_2460_2461::Configure::Configure Pulse List Sweep.gvi
  Labview_NXG_Keithley_SMU_2450_2460_2461::Data::Low Level::Initiate.gvi
  Labview_NXG_Keithley_SMU_2450_2460_2461::Data::Low Level::Wait for Operation Complete.gvi
  Labview_NXG_Keithley_SMU_2450_2460_2461::Data::Read (Multiple Points).gvi
  Labview_NXG_Keithley_SMU_2450_2460_2461::Miscelaneous::Close.gvi
  NI::G Core::Error::Display Error.gvi
diagram:
  Array Size(array=$"Output List") -> (size(s)=w1)
  # Read the raw data.  For the output list to work correctly, the Output Mode must be set to List.  Also, the size of the list needs to be passed to Sample Count.
  To Unsigned 32 Bit Integer(number=w1) -> w2
  case ($"Source Mode (0: Voltage)") {
    frame 0, Default {
      w5 = "Digitize Volts"(4)  # Function (0: Volts)
      w6 = "Voltage Pulse"(2)  # Function (0: Volts)
      w3 = w5
      w4 = w6
    }
    frame 1 {
      w7 = "Digitize Voltage"(4)  # Function (0: Volts)
      w8 = "Current Pulse"(3)  # Function (0: Volts)
      w3 = w7
      w4 = w8
    }
  }
  # Configure the measurements and output.  Configure Output must be called to set the compliance level.
  call "Initialize.gvi"(VISA resource name=$"VISA resource name") -> (VISA resource name out=w9, error out=w10)
  call "Configure Source Range.gvi"(VISA resource name=w9, Function (0: Volts)=$"Source Mode (0: Voltage)", Source Range (1.0)=$"Source Range (1.0)", error in (no error)=w10) -> (VISA resource name out=w11, error out=w12)
  call "Configure Source Function.gvi"(VISA resource name=w11, Function (0: Volts)=$"Source Mode (0: Voltage)", error in (no error)=w12) -> (VISA resource name out=w13, error out=w14)
  call "Configure Measurement Function.gvi"(VISA resource name=w13, Function (0: Volts)=w3, error in (no error)=w14) -> (VISA resource name out=w15, error out=w16)
  call "Configure Pulse Limit.gvi"(VISA resource name=w15, Function (0:Voltage)=$"Source Mode (0: Voltage)", Limit=$"Pulse Limit Level (0.1)", error in (no error)=w16) -> (VISA resource name out=w17, error out=w18)
  # Configure the list with the amplitude array and source settings.
  call "Configure Source Limit Level.gvi"(VISA resource name=w17, Function (0: Volts)=$"Source Mode (0: Voltage)", Source Limit (1.0)=$"Limit Level (0.1)", error in (no error)=w18) -> (VISA resource name out=w19, error out=w20)
  call "Configure Measurement Manual Range.gvi"(VISA resource name=w19, Function (0: Volts)=w3, Manual Range (1.0)=$"Measure Range (1.0)", error in (no error)=w20) -> (VISA resource name out=w21, error out=w22)
  call "Digitizer Sample Rate.gvi"(VISA resource name=w21, Digitize Function (Voltage)=$"Source Mode (0: Voltage)", Sample Rate (100000)=$"Sample Rate (100000)", error in (no error)=w22) -> (VISA resource name out=w23, error out=w24)
  call "Configure Output List.gvi"(VISA resource name=w23, Output List=$"Output List", Source Mode (0: Voltage)=w4, error in (no error)=w24) -> (VISA resource name out=w25, error out=w26)
  call "Enable Output.gvi"(VISA resource name=w25, error in (no error)=w26) -> (VISA resource name out=w27, error out=w28)
  call "Configure Pulse List Sweep.gvi"(VISA resource name=w27, Pulse Width=$"Pulse Width", Pulse Off Time=$"Pulse Off Time", error in (no error)=w28, Start Index=1, Source Mode (0: Voltage)=$"Source Mode (0: Voltage)") -> (VISA resource name out=w29, error out=w30)
  call "Initiate.gvi"(VISA resource name=w29, error in (no error)=w30) -> (VISA resource name out=w31, error out=w32)
  call "Wait for Operation Complete.gvi"(VISA resource name=w31, Timeout (10000 ms)=200000, error in (no error)=w32) -> (VISA resource name out=w33, error out=w34)
  case ($"Source Mode (0: Voltage)") {
    frame 0, Default {
      sequence {
        frame 0 {
          Wait(time to wait=2000)
        }
        frame 1 {
          call "Read (Multiple Points).gvi"(VISA resource name=w33, Start Index (1)=1, End Index (1)=w2, error in (no error)=w34, Buffer Elements="SOUR, READ") -> (VISA resource name out=w35, Data out=w37, error out=w36)
        }
      }
    }
    frame 1 {
      sequence {
        frame 0 {
          Wait(time to wait=2000)
        }
        frame 1 {
          call "Read (Multiple Points).gvi"(VISA resource name=w33, Start Index (1)=1, End Index (1)=w2, error in (no error)=w34, Buffer Elements="READ, SOUR") -> (VISA resource name out=w35, Data out=w37, error out=w36)
        }
      }
    }
  }
  Spreadsheet String To Array(array type=f64[] [], delimiter=",", format string="%s", spreadsheet string=w37) -> (array=w38)
  Decimate Array(array=w38) -> (out0=w39, out1=w40)
  Build Array(w39, w40) -> w41
  $"Waveform Graph" <- w41
  call "Enable Output.gvi"(VISA resource name=w35, Enable Output (T: Enable)=FALSE, error in (no error)=w36) -> (VISA resource name out=w42, error out=w43)
  call "Close.gvi"(VISA resource name=w42, error in (no error)=w43) -> (error out=w44)
  call "Display Error.gvi"(error in=w44)
