vi "Keithley Send SCPI Command.gvi"   [LabVIEW NXG 5.0.0]
panel controls:
  "SCPI Command": string
  "Send Command": bool
  "Error In": error
  "VISA resource name": "VISA Instr" = "USB0::0x05E6::0x2461::04090176::INSTR"
    # A reference to the instrument in use.  The reference to the resource name is created in the Initialize VI.  Therefore, before calling this VI, you need to call the Initialize VI.  To run this VI interactively, select the previously initialized resource name from the pull-down menu.  To run this VI programmatically, wire the VISA resource name out terminal of the Initialize VI to subsequent VISA resource name input terminals.  You chain instrument driver VIs together by wiring the VISA resource name out terminal to subsequent VISA resource name input terminals.
  "Stop": bool
panel indicators:
  "Readout": string
  "Error Out": error
uses:
  Labview_NXG_Keithley_SMU_2450_2460_2461::Miscelaneous::Initialize.gvi
  NI::VISA::Read (Instr, String).gvi
  Labview_NXG_Keithley_SMU_2450_2460_2461::Utility::Error Query.gvi
  NI::VISA::Clear (Instr).gvi
  NI::VISA::Write (Instr, String).gvi
  NI::G Core::Error::Display Error.gvi
diagram:
  case ($"Error In") {
    frame Error, Default {
      w1 = $"Error In"
    }
    frame No Error {
      call "Initialize.gvi"(VISA resource name=$"VISA resource name", error in (no error)=$"Error In") -> (VISA resource name out=w2, error out=w3)
      s1 = w3  # shift register
      s2 = w2  # shift register
      s3 = uninitialised  # shift register
      while {
        event (timeout = 250) {
          on "Timeout" {
            disable {
              frame Enabled {
                w5 = s2
                w4 = s1
                w6 = s3
              }
              frame Disabled {
                Property Node(instance in=s2, error in=s1) -> ("ASRL Bytes at Port"=w7, error out=w8, instance out=w9)
                Is Not Equal To 0(x=w7) -> w10
                case (w10) {
                  frame False, Default {
                    w5 = w9
                    w4 = w8
                    w6 = s3
                  }
                  frame True {
                    call "Read (Instr, String).gvi"(session in=w9, error in=w8, byte count=w7) -> (session out=w11, error out=w12, read buffer=w13)
                    call "Error Query.gvi"(VISA resource name=w11, error in (no error)=w12) -> (VISA resource name out=w14, error out=w15)
                    call "Clear (Instr).gvi"(session in=w14, error in=w15) -> (session out=w5, error out=w4)
                    Concatenate Strings(s3, w13, "\r\n") -> w6
                    $Readout <- w6
                  }
                }
              }
            }
          }
          on "Send Command" Value changed {
            call "Write (Instr, String).gvi"(session in=s2, error in=s1, write buffer=$"SCPI Command") -> (session out=w5, error out=w4)
            w6 = s3
          }
        }
        call "Display Error.gvi"(error in=w4)
        next s1 = w4
        next s2 = w5
        next s3 = w6
        stop if $Stop
      }
      w1 = s1
    }
  }
  $"Error Out" <- w1
