vi "VI Tree.gvi"   [LabVIEW NXG 5.0.0]
# This is the instrument driver for the Keithley 2400 Series SourceMeter. The VI Tree displays all the user-callable VIs of the instrument driver in an organized table.
uses:
  Labview_NXG_Keithley_SMU_2450_2460_2461::Action Status::Get Digital IO Pins Mode.gvi
  Labview_NXG_Keithley_SMU_2450_2460_2461::Action Status::Enable Remote Sensing.gvi
  Labview_NXG_Keithley_SMU_2450_2460_2461::Action Status::Get Digital IO Pins State.gvi
  Labview_NXG_Keithley_SMU_2450_2460_2461::Action Status::Enable Output.gvi
  Labview_NXG_Keithley_SMU_2450_2460_2461::Action Status::Set Digital IO Mode.gvi
  Labview_NXG_Keithley_SMU_2450_2460_2461::Action Status::Read all Digital IO Pins.gvi
  Labview_NXG_Keithley_SMU_2450_2460_2461::Action Status::In Compliance Query.gvi
  Labview_NXG_Keithley_SMU_2450_2460_2461::Miscelaneous::Initialize.gvi
  Labview_NXG_Keithley_SMU_2450_2460_2461::Miscelaneous::Close.gvi
  Labview_NXG_Keithley_SMU_2450_2460_2461::Action Status::Write to all Digital IO Pins.gvi
  Labview_NXG_Keithley_SMU_2450_2460_2461::Action Status::Set or Reset Digital IO Pins.gvi
  Labview_NXG_Keithley_SMU_2450_2460_2461::Configure::Create Configuration List.gvi
  Labview_NXG_Keithley_SMU_2450_2460_2461::Configure::Configure Brightness of Display.gvi
  Labview_NXG_Keithley_SMU_2450_2460_2461::Configure::Configure Reading Format of Display.gvi
  Labview_NXG_Keithley_SMU_2450_2460_2461::Configure::Get System Access Permission.gvi
  Labview_NXG_Keithley_SMU_2450_2460_2461::Configure::Configure Digits for Display.gvi
  Labview_NXG_Keithley_SMU_2450_2460_2461::Data::Fetch Read Buffer Statistics.gvi
  Labview_NXG_Keithley_SMU_2450_2460_2461::Data::Get Number of Readings in the Buffer.gvi
  Labview_NXG_Keithley_SMU_2450_2460_2461::Data::Make Reading and Store in Buffer.gvi
  Labview_NXG_Keithley_SMU_2450_2460_2461::Data::Query Limit Test Data.gvi
  Labview_NXG_Keithley_SMU_2450_2460_2461::Configure::Get Line Frequency.gvi
  Labview_NXG_Keithley_SMU_2450_2460_2461::Configure::Delete Configuration List.gvi
  Labview_NXG_Keithley_SMU_2450_2460_2461::Configure::Get Time.gvi
  Labview_NXG_Keithley_SMU_2450_2460_2461::Configure::Get GPIB Address.gvi
  Labview_NXG_Keithley_SMU_2450_2460_2461::Configure::Enable Logging.gvi
  Labview_NXG_Keithley_SMU_2450_2460_2461::Data::Read (Multiple Points).gvi
  Labview_NXG_Keithley_SMU_2450_2460_2461::Data::Read (Single Point).gvi
  Labview_NXG_Keithley_SMU_2450_2460_2461::Data::Read (Digitize).gvi
  Labview_NXG_Keithley_SMU_2450_2460_2461::Utility::Recall Configuration List.gvi
  Labview_NXG_Keithley_SMU_2450_2460_2461::Configure::Get Log State.gvi
  Labview_NXG_Keithley_SMU_2450_2460_2461::Configure::Get Version.gvi
  Labview_NXG_Keithley_SMU_2450_2460_2461::Configure::Getting Powered ON Setup.gvi
  Labview_NXG_Keithley_SMU_2450_2460_2461::Configure::Store Configuration List.gvi
  Labview_NXG_Keithley_SMU_2450_2460_2461::Configure::Save Message from Event Log.gvi
  Labview_NXG_Keithley_SMU_2450_2460_2461::Configure::Set GPIB Address.gvi
  Labview_NXG_Keithley_SMU_2450_2460_2461::Configure::Setting Powered ON Setup.gvi
  Labview_NXG_Keithley_SMU_2450_2460_2461::Configure::Set Absolute Time.gvi
  Labview_NXG_Keithley_SMU_2450_2460_2461::Data::Low Level::Fetch (Measurements).gvi
  Labview_NXG_Keithley_SMU_2450_2460_2461::Data::Low Level::Initiate.gvi
  Labview_NXG_Keithley_SMU_2450_2460_2461::Data::Low Level::Abort.gvi
  Labview_NXG_Keithley_SMU_2450_2460_2461::Data::Low Level::Send Software Trigger.gvi
  Labview_NXG_Keithley_SMU_2450_2460_2461::Data::Low Level::Wait for Operation Complete.gvi
  Labview_NXG_Keithley_SMU_2450_2460_2461::Data::Low Level::Measure Lowlevel.gvi
  Labview_NXG_Keithley_SMU_2450_2460_2461::Configure::Configure Linear Mode Sweep.gvi
  Labview_NXG_Keithley_SMU_2450_2460_2461::Configure::Configure Linear Step Mode Sweep.gvi
  Labview_NXG_Keithley_SMU_2450_2460_2461::Configure::Configure Log Mode Sweep.gvi
  Labview_NXG_Keithley_SMU_2450_2460_2461::Configure::Configure List Mode Sweep.gvi
  Labview_NXG_Keithley_SMU_2450_2460_2461::Configure::Configure Trigger Model Branch Counter Block.gvi
  Labview_NXG_Keithley_SMU_2450_2460_2461::Configure::Configure Trigger Model Always Block.gvi
  Labview_NXG_Keithley_SMU_2450_2460_2461::Configure::Clear Trigger timer.gvi
  Labview_NXG_Keithley_SMU_2450_2460_2461::Configure::Configure Trigger Model Blender Mode.gvi
  Labview_NXG_Keithley_SMU_2450_2460_2461::Configure::Configure Output List.gvi
  Labview_NXG_Keithley_SMU_2450_2460_2461::Configure::Configure Output Off Behavior.gvi
  Labview_NXG_Keithley_SMU_2450_2460_2461::Configure::Configure Output Sweep.gvi
  Labview_NXG_Keithley_SMU_2450_2460_2461::Configure::Configure Output.gvi
  Labview_NXG_Keithley_SMU_2450_2460_2461::Configure::Configure Filter.gvi
  Labview_NXG_Keithley_SMU_2450_2460_2461::Configure::Configure Trigger Model Clear Blender.gvi
  Labview_NXG_Keithley_SMU_2450_2460_2461::Configure::Configure Autozero Once.gvi
  Labview_NXG_Keithley_SMU_2450_2460_2461::Configure::Configure Autozero.gvi
  Labview_NXG_Keithley_SMU_2450_2460_2461::Configure::Configure Integration Filter.gvi
  Labview_NXG_Keithley_SMU_2450_2460_2461::Configure::Configure Trigger Model Clear LAN.gvi
  Labview_NXG_Keithley_SMU_2450_2460_2461::Configure::Configure Trigger Model Buffer Clear Block.gvi
  Labview_NXG_Keithley_SMU_2450_2460_2461::Configure::Configure Trigger Model Clear Digital Input Line.gvi
  Labview_NXG_Keithley_SMU_2450_2460_2461::Configure::Configure Over Voltage Protection.gvi
  Labview_NXG_Keithley_SMU_2450_2460_2461::Configure::Configure Source Function.gvi
  Labview_NXG_Keithley_SMU_2450_2460_2461::Configure::Configure Source Level.gvi
  Labview_NXG_Keithley_SMU_2450_2460_2461::Configure::Configure Source Limit Level.gvi
  Labview_NXG_Keithley_SMU_2450_2460_2461::Configure::Enable Limit Test.gvi
  Labview_NXG_Keithley_SMU_2450_2460_2461::Configure::Configure Limit Test Auto Clear.gvi
  Labview_NXG_Keithley_SMU_2450_2460_2461::Configure::Configure Limit Test Clear.gvi
  Labview_NXG_Keithley_SMU_2450_2460_2461::Configure::Configure Limit Test Lower Limit.gvi
  Labview_NXG_Keithley_SMU_2450_2460_2461::Configure::Configure Trigger Model Configuration List Previous index Block.gvi
  Labview_NXG_Keithley_SMU_2450_2460_2461::Configure::Configure Trigger Model Delta Block.gvi
  Labview_NXG_Keithley_SMU_2450_2460_2461::Configure::Configure Trigger Model Configuration List Next Index Block.gvi
  Labview_NXG_Keithley_SMU_2450_2460_2461::Configure::Configure Trigger Model Constant Delay Block.gvi
  Labview_NXG_Keithley_SMU_2450_2460_2461::Configure::Configure Source Range.gvi
  Labview_NXG_Keithley_SMU_2450_2460_2461::Configure::Enable High Capacitance.gvi
  Labview_NXG_Keithley_SMU_2450_2460_2461::Configure::Enable Source Auto Range.gvi
  Labview_NXG_Keithley_SMU_2450_2460_2461::Configure::Enable Source Read Back.gvi
  Labview_NXG_Keithley_SMU_2450_2460_2461::Configure::Configure Measurement Auto Range Upper Limit.gvi
  Labview_NXG_Keithley_SMU_2450_2460_2461::Configure::Configure Limit Test Upper Limit.gvi
  Labview_NXG_Keithley_SMU_2450_2460_2461::Configure::Configure Math.gvi
  Labview_NXG_Keithley_SMU_2450_2460_2461::Configure::Configure Measurement Auto Range Lower Limit.gvi
  Labview_NXG_Keithley_SMU_2450_2460_2461::Configure::Configure Trigger Model Digital Output Mode.gvi
  Labview_NXG_Keithley_SMU_2450_2460_2461::Configure::Configure Trigger Model LAN IP Address.gvi
  Labview_NXG_Keithley_SMU_2450_2460_2461::Configure::Configure Trigger Model Digital Input Mode.gvi
  Labview_NXG_Keithley_SMU_2450_2460_2461::Configure::Configure Trigger Model Digital Output Pulse Width.gvi
  Labview_NXG_Keithley_SMU_2450_2460_2461::Configure::Get High Capacitance State.gvi
  Labview_NXG_Keithley_SMU_2450_2460_2461::Configure::Get Interlock Status.gvi
  Labview_NXG_Keithley_SMU_2450_2460_2461::Configure::Get Source Auto Delay State.gvi
  Labview_NXG_Keithley_SMU_2450_2460_2461::Configure::Get Source Auto Range.gvi
  Labview_NXG_Keithley_SMU_2450_2460_2461::Configure::Configure Measurement Function.gvi
  Labview_NXG_Keithley_SMU_2450_2460_2461::Configure::Configure Measurement Manual Range.gvi
  Labview_NXG_Keithley_SMU_2450_2460_2461::Configure::Configure Measurement Range.gvi
  Labview_NXG_Keithley_SMU_2450_2460_2461::Configure::Configure Offset Compensation.gvi
  Labview_NXG_Keithley_SMU_2450_2460_2461::Configure::Configure Trigger Model LAN Output Protocol.gvi
  Labview_NXG_Keithley_SMU_2450_2460_2461::Configure::Configure Trigger Model Measure Block.gvi
  Labview_NXG_Keithley_SMU_2450_2460_2461::Configure::Configure Trigger Model LAN Output Logic Mode.gvi
  Labview_NXG_Keithley_SMU_2450_2460_2461::Configure::Configure Trigger Model LAN Trigger Mode.gvi
  Labview_NXG_Keithley_SMU_2450_2460_2461::Configure::Get Source Configuration List Catalog.gvi
  Labview_NXG_Keithley_SMU_2450_2460_2461::Configure::Get Source Configuration List Settings.gvi
  Labview_NXG_Keithley_SMU_2450_2460_2461::Configure::Get Source Configuration List Size.gvi
  Labview_NXG_Keithley_SMU_2450_2460_2461::Configure::Get Source Delay.gvi
  Labview_NXG_Keithley_SMU_2450_2460_2461::Configure::Configure Relative Offset.gvi
  Labview_NXG_Keithley_SMU_2450_2460_2461::Configure::Configure Settling Delay.gvi
  Labview_NXG_Keithley_SMU_2450_2460_2461::Configure::Configure Specific Limit Test.gvi
  Labview_NXG_Keithley_SMU_2450_2460_2461::Configure::Configure Unit of Current.gvi
  Labview_NXG_Keithley_SMU_2450_2460_2461::Configure::Configure Trigger Model Once Excluded Block.gvi
  Labview_NXG_Keithley_SMU_2450_2460_2461::Configure::Configure Trigger Model Source Output Block.gvi
  Labview_NXG_Keithley_SMU_2450_2460_2461::Configure::Configure Trigger Model Once Block.gvi
  Labview_NXG_Keithley_SMU_2450_2460_2461::Configure::Configure Trigger Model Recall Configuration List Block.gvi
  Labview_NXG_Keithley_SMU_2450_2460_2461::Configure::Get Source Function.gvi
  Labview_NXG_Keithley_SMU_2450_2460_2461::Configure::Get Source Level.gvi
  Labview_NXG_Keithley_SMU_2450_2460_2461::Configure::Get Source Limit.gvi
  Labview_NXG_Keithley_SMU_2450_2460_2461::Configure::Get Source List Points.gvi
  Labview_NXG_Keithley_SMU_2450_2460_2461::Configure::Configure Unit of Voltage.gvi
  Labview_NXG_Keithley_SMU_2450_2460_2461::Configure::Enable Math Operation.gvi
  Labview_NXG_Keithley_SMU_2450_2460_2461::Configure::Enable Measurement Auto Range.gvi
  Labview_NXG_Keithley_SMU_2450_2460_2461::Configure::Get Limit Test Enabled State.gvi
  Labview_NXG_Keithley_SMU_2450_2460_2461::Configure::Get Trigger Model Blender Mode.gvi
  Labview_NXG_Keithley_SMU_2450_2460_2461::Configure::Get Trigger Model Digital Input Mode.gvi
  Labview_NXG_Keithley_SMU_2450_2460_2461::Configure::Configure Trigger Model.gvi
  Labview_NXG_Keithley_SMU_2450_2460_2461::Configure::Get Trigger Model Blender Overrun Status.gvi
  Labview_NXG_Keithley_SMU_2450_2460_2461::Configure::Get Over Voltage Protection State.gvi
  Labview_NXG_Keithley_SMU_2450_2460_2461::Configure::Get Source Range.gvi
  Labview_NXG_Keithley_SMU_2450_2460_2461::Configure::Get Source User Delay.gvi
  Labview_NXG_Keithley_SMU_2450_2460_2461::Configure::Get Source Read Back State.gvi
  Labview_NXG_Keithley_SMU_2450_2460_2461::Configure::Get Limit Test Lower Limit.gvi
  Labview_NXG_Keithley_SMU_2450_2460_2461::Configure::Get Limit Test Upper Limit.gvi
  Labview_NXG_Keithley_SMU_2450_2460_2461::Configure::Get Measure Configuration List Catalog.gvi
  Labview_NXG_Keithley_SMU_2450_2460_2461::Configure::Get Measure Configuration List Settings.gvi
  Labview_NXG_Keithley_SMU_2450_2460_2461::Configure::Get Trigger Model Digital Output Pulse Width.gvi
  Labview_NXG_Keithley_SMU_2450_2460_2461::Configure::Get Trigger Model LAN Input Logic Mode.gvi
  Labview_NXG_Keithley_SMU_2450_2460_2461::Configure::Get Trigger Model Digital Output Mode.gvi
  Labview_NXG_Keithley_SMU_2450_2460_2461::Configure::Get Trigger Model Digital Overrun Status.gvi
  Labview_NXG_Keithley_SMU_2450_2460_2461::Configure::Get Measure Configuration List Size.gvi
  Labview_NXG_Keithley_SMU_2450_2460_2461::Configure::Get Measurement Auto Range Lower Limit.gvi
  Labview_NXG_Keithley_SMU_2450_2460_2461::Configure::Get Measurement Auto Range.gvi
  Labview_NXG_Keithley_SMU_2450_2460_2461::Configure::Get Measurement Count.gvi
  Labview_NXG_Keithley_SMU_2450_2460_2461::Configure::Get Trigger Model LAN Mode.gvi
  Labview_NXG_Keithley_SMU_2450_2460_2461::Configure::Get Trigger Model LAN Output Protocol.gvi
  Labview_NXG_Keithley_SMU_2450_2460_2461::Configure::Get Trigger Model LAN IP Address.gvi
  Labview_NXG_Keithley_SMU_2450_2460_2461::Configure::Get Trigger Model LAN Output Logic Mode.gvi
  Labview_NXG_Keithley_SMU_2450_2460_2461::Configure::Get Measurement Function.gvi
  Labview_NXG_Keithley_SMU_2450_2460_2461::Configure::Get Measurement Manual Range.gvi
  Labview_NXG_Keithley_SMU_2450_2460_2461::Configure::Get Measure User Delay.gvi
  Labview_NXG_Keithley_SMU_2450_2460_2461::Configure::Set Measurement Count.gvi
  Labview_NXG_Keithley_SMU_2450_2460_2461::Configure::Get Trigger Model State.gvi
  Labview_NXG_Keithley_SMU_2450_2460_2461::Configure::Get Trigger Timer Delay.gvi
  Labview_NXG_Keithley_SMU_2450_2460_2461::Configure::Configure Contact Check.gvi
  Labview_NXG_Keithley_SMU_2450_2460_2461::Configure::Get Conact Check State.gvi
  Labview_NXG_Keithley_SMU_2450_2460_2461::Configure::Configure Pulse Limit.gvi
  Labview_NXG_Keithley_SMU_2450_2460_2461::Configure::Set Pulse Amplitude.gvi
  Labview_NXG_Keithley_SMU_2450_2460_2461::Configure::Get Trigger Model LAN Overrun Status.gvi
  Labview_NXG_Keithley_SMU_2450_2460_2461::Configure::Get Trigger Timer Count.gvi
  Labview_NXG_Keithley_SMU_2450_2460_2461::Configure::Get All Delay Info.gvi
  Labview_NXG_Keithley_SMU_2450_2460_2461::Configure::Get Trigger Timer State.gvi
  Labview_NXG_Keithley_SMU_2450_2460_2461::Configure::Configure Pulse Train.gvi
  Labview_NXG_Keithley_SMU_2450_2460_2461::Configure::Configure Pulse Sweep.gvi
  Labview_NXG_Keithley_SMU_2450_2460_2461::Configure::Configure Pulse List Sweep.gvi
  Labview_NXG_Keithley_SMU_2450_2460_2461::Configure::Turn off Delays and Autozero (High Speed).gvi
  Labview_NXG_Keithley_SMU_2450_2460_2461::Configure::Set Trigger Timer Delay.gvi
  Labview_NXG_Keithley_SMU_2450_2460_2461::Configure::Get Trigger Timer Overrun Status.gvi
  Labview_NXG_Keithley_SMU_2450_2460_2461::Configure::Set Trigger Timer Count.gvi
  Labview_NXG_Keithley_SMU_2450_2460_2461::Configure::Enable LAN Connect State.gvi
  Labview_NXG_Keithley_SMU_2450_2460_2461::Configure::Set Trigger Timer State.gvi
  Labview_NXG_Keithley_SMU_2450_2460_2461::Configure::Get LAN Connect State.gvi
  Labview_NXG_Keithley_SMU_2450_2460_2461::Configure::Digitizer Aperture.gvi
  Labview_NXG_Keithley_SMU_2450_2460_2461::Configure::Digitizer Voltage Units.gvi
  Labview_NXG_Keithley_SMU_2450_2460_2461::Configure::Digitizer Sample Rate.gvi
  Labview_NXG_Keithley_SMU_2450_2460_2461::Configure::Digitizer Current Units.gvi
  Labview_NXG_Keithley_SMU_2450_2460_2461::Utility::Calibrate Adjust Sense Data Query.gvi
  Labview_NXG_Keithley_SMU_2450_2460_2461::Utility::Calibrate Adjust Sense.gvi
  Labview_NXG_Keithley_SMU_2450_2460_2461::Utility::Calibrate Adjust Source Data Query.gvi
  Labview_NXG_Keithley_SMU_2450_2460_2461::Utility::Calibrate Adjust Source.gvi
  Labview_NXG_Keithley_SMU_2450_2460_2461::Utility::Calibration Adjust Count Query.gvi
  Labview_NXG_Keithley_SMU_2450_2460_2461::Utility::Calibration Adjust Date Query.gvi
  Labview_NXG_Keithley_SMU_2450_2460_2461::Utility::Calibration Adjust Date.gvi
  Labview_NXG_Keithley_SMU_2450_2460_2461::Utility::Calibration Lock.gvi
  Labview_NXG_Keithley_SMU_2450_2460_2461::Utility::Create Math Operation.gvi
  Labview_NXG_Keithley_SMU_2450_2460_2461::Utility::Clear Display.gvi
  Labview_NXG_Keithley_SMU_2450_2460_2461::Utility::Set Display Screen.gvi
  Labview_NXG_Keithley_SMU_2450_2460_2461::Utility::Clear System Event Log.gvi
  Labview_NXG_Keithley_SMU_2450_2460_2461::Utility::Calibration Unlock.gvi
  Labview_NXG_Keithley_SMU_2450_2460_2461::Utility::Calibration Password.gvi
  Labview_NXG_Keithley_SMU_2450_2460_2461::Utility::Calibration Save.gvi
  Labview_NXG_Keithley_SMU_2450_2460_2461::Utility::Calibration Verify Date.gvi
  Labview_NXG_Keithley_SMU_2450_2460_2461::Utility::Display Message.gvi
  Labview_NXG_Keithley_SMU_2450_2460_2461::Utility::Enable Questionable Event Register.gvi
  Labview_NXG_Keithley_SMU_2450_2460_2461::Utility::Emit Beep.gvi
  Labview_NXG_Keithley_SMU_2450_2460_2461::Utility::Enable Operation Event Register.gvi
  Labview_NXG_Keithley_SMU_2450_2460_2461::Configure::Clear Buffer.gvi
  Labview_NXG_Keithley_SMU_2450_2460_2461::Configure::Clear Buffer Statistics.gvi
  Labview_NXG_Keithley_SMU_2450_2460_2461::Configure::Delete User Buffer.gvi
  Labview_NXG_Keithley_SMU_2450_2460_2461::Configure::Append Buffer to File in the USB.gvi
  Labview_NXG_Keithley_SMU_2450_2460_2461::Utility::Calibration Verify Date Query.gvi
  Labview_NXG_Keithley_SMU_2450_2460_2461::Utility::Error Query.gvi
  Labview_NXG_Keithley_SMU_2450_2460_2461::Utility::Get Event Id Mapped to Bit Number in Operation Event Register.gvi
  Labview_NXG_Keithley_SMU_2450_2460_2461::Utility::Get Active Terminals.gvi
  Labview_NXG_Keithley_SMU_2450_2460_2461::Utility::Self-Test.gvi
  Labview_NXG_Keithley_SMU_2450_2460_2461::Configure::Get Buffer Size.gvi
  Labview_NXG_Keithley_SMU_2450_2460_2461::Configure::Get Buffer Filling Mode.gvi
  Labview_NXG_Keithley_SMU_2450_2460_2461::Configure::Get Byte Order.gvi
  Labview_NXG_Keithley_SMU_2450_2460_2461::Configure::Create User Buffer.gvi
  Labview_NXG_Keithley_SMU_2450_2460_2461::Utility::Get Event Id Mapped to Bit Number in Questionable Event Register.gvi
  Labview_NXG_Keithley_SMU_2450_2460_2461::Utility::Map Event Id to Bit number in Operation Event Register.gvi
  Labview_NXG_Keithley_SMU_2450_2460_2461::Utility::Get Min-Max Ranges.gvi
  Labview_NXG_Keithley_SMU_2450_2460_2461::Utility::Get Trigger Block List.gvi
  Labview_NXG_Keithley_SMU_2450_2460_2461::Configure::Set Buffer Filling Mode.gvi
  Labview_NXG_Keithley_SMU_2450_2460_2461::Configure::Save Buffer to File in the USB.gvi
  Labview_NXG_Keithley_SMU_2450_2460_2461::Configure::Set Buffer Size.gvi
  Labview_NXG_Keithley_SMU_2450_2460_2461::Configure::Get Data Format.gvi
  Labview_NXG_Keithley_SMU_2450_2460_2461::Utility::Map Event Id to Bit number in Questionable Event Register.gvi
  Labview_NXG_Keithley_SMU_2450_2460_2461::Utility::Read Operation Event Register Status.gvi
  Labview_NXG_Keithley_SMU_2450_2460_2461::Utility::Preset Status.gvi
  Labview_NXG_Keithley_SMU_2450_2460_2461::Utility::Read Operation Condition Register.gvi
  Labview_NXG_Keithley_SMU_2450_2460_2461::Configure::Configure Byte Order.gvi
  Labview_NXG_Keithley_SMU_2450_2460_2461::Utility::Read Operation Event Register.gvi
  Labview_NXG_Keithley_SMU_2450_2460_2461::Utility::Read Questionable Event Register.gvi
  Labview_NXG_Keithley_SMU_2450_2460_2461::Utility::Read Questionable Condition Register.gvi
  Labview_NXG_Keithley_SMU_2450_2460_2461::Utility::Read Questionable Event Register Status.gvi
  Labview_NXG_Keithley_SMU_2450_2460_2461::Utility::Reset.gvi
  Labview_NXG_Keithley_SMU_2450_2460_2461::Utility::Selected Range Query.gvi
  Labview_NXG_Keithley_SMU_2450_2460_2461::Utility::Revision Query.gvi
  Labview_NXG_Keithley_SMU_2450_2460_2461::Utility::Select Active Terminals.gvi
diagram:
  call "Get Digital IO Pins Mode.gvi"(VISA resource name="")
  call "Enable Remote Sensing.gvi"(VISA resource name="")
  call "Get Digital IO Pins State.gvi"(VISA resource name="")
  # Action-Status
  call "Enable Output.gvi"(VISA resource name="")
  call "Set Digital IO Mode.gvi"(VISA resource name="")
  call "Read all Digital IO Pins.gvi"(VISA resource name="")
  call "In Compliance Query.gvi"(VISA resource name="")
  # Initialize
  call "Initialize.gvi"(VISA resource name="")
  # Close
  call "Close.gvi"(VISA resource name="")
  call "Write to all Digital IO Pins.gvi"(VISA resource name="")
  call "Set or Reset Digital IO Pins.gvi"(VISA resource name="")
  call "Create Configuration List.gvi"(VISA resource name="")
  # Configure
  call "Configure Brightness of Display.gvi"(VISA resource name="")
  call "Configure Reading Format of Display.gvi"(VISA resource name="")
  call "Get System Access Permission.gvi"(VISA resource name="")
  call "Configure Digits for Display.gvi"(VISA resource name="USB0::0x05E6::0x2461::04090176::INSTR")
  # Data
  call "Fetch Read Buffer Statistics.gvi"(VISA resource name="")
  call "Get Number of Readings in the Buffer.gvi"(VISA resource name="")
  call "Make Reading and Store in Buffer.gvi"(VISA resource name="")
  call "Query Limit Test Data.gvi"(VISA resource name="")
  call "Get Line Frequency.gvi"(VISA resource name="")
  call "Delete Configuration List.gvi"()
  call "Get Time.gvi"(VISA resource name="")
  call "Get GPIB Address.gvi"(VISA resource name="")
  call "Enable Logging.gvi"(VISA resource name="")
  call "Read (Multiple Points).gvi"(VISA resource name="")
  call "Read (Single Point).gvi"(VISA resource name="")
  call "Read (Digitize).gvi"()
  call "Recall Configuration List.gvi"()
  call "Get Log State.gvi"(VISA resource name="")
  call "Get Version.gvi"(VISA resource name="")
  call "Getting Powered ON Setup.gvi"(VISA resource name="")
  call "Get System Access Permission.gvi"(VISA resource name="")
  call "Store Configuration List.gvi"()
  call "Save Message from Event Log.gvi"(VISA resource name="")
  call "Set GPIB Address.gvi"(VISA resource name="")
  call "Setting Powered ON Setup.gvi"(VISA resource name="")
  call "Set Absolute Time.gvi"(VISA resource name="")
  call "Fetch (Measurements).gvi"(VISA resource name="")
  call "Initiate.gvi"(VISA resource name="")
  # Data, Low Level
  call "Abort.gvi"(VISA resource name="")
  call "Send Software Trigger.gvi"(VISA resource name="")
  call "Wait for Operation Complete.gvi"(VISA resource name="")
  call "Measure Lowlevel.gvi"(VISA resource name="")
  # Configure, Source
  call "Configure Linear Mode Sweep.gvi"()
  call "Configure Linear Step Mode Sweep.gvi"()
  call "Configure Log Mode Sweep.gvi"()
  call "Configure List Mode Sweep.gvi"(VISA resource name="")
  call "Configure Trigger Model Branch Counter Block.gvi"(VISA resource name="")
  call "Configure Trigger Model Always Block.gvi"()
  # Configure, Trigger
  call "Clear Trigger timer.gvi"(VISA resource name="")
  call "Configure Trigger Model Blender Mode.gvi"()
  call "Configure Output List.gvi"(VISA resource name="")
  call "Configure Output Off Behavior.gvi"(VISA resource name="", Output Off Behavior (0: Normal)="Normal"(0))
  call "Configure Output Sweep.gvi"(VISA resource name="")
  call "Configure Output.gvi"(VISA resource name="")
  call "Configure Filter.gvi"()
  call "Configure Trigger Model Clear Blender.gvi"()
  # Configure, Measure
  call "Configure Autozero Once.gvi"(VISA resource name="")
  call "Configure Autozero.gvi"(VISA resource name="")
  call "Configure Integration Filter.gvi"(VISA resource name="")
  call "Configure Trigger Model Clear LAN.gvi"(VISA resource name="")
  call "Configure Trigger Model Buffer Clear Block.gvi"(VISA resource name="")
  call "Configure Trigger Model Clear Digital Input Line.gvi"()
  call "Configure Over Voltage Protection.gvi"(VISA resource name="")
  call "Configure Source Function.gvi"(VISA resource name="")
  call "Configure Source Level.gvi"(VISA resource name="")
  call "Configure Source Limit Level.gvi"(VISA resource name="")
  call "Enable Limit Test.gvi"(VISA resource name="")
  call "Configure Limit Test Auto Clear.gvi"(VISA resource name="")
  call "Configure Limit Test Clear.gvi"(VISA resource name="")
  call "Configure Limit Test Lower Limit.gvi"(VISA resource name="")
  call "Configure Trigger Model Configuration List Previous index Block.gvi"(VISA resource name="")
  call "Configure Trigger Model Delta Block.gvi"()
  call "Configure Trigger Model Configuration List Next Index Block.gvi"(VISA resource name="")
  call "Configure Trigger Model Constant Delay Block.gvi"(VISA resource name="")
  call "Configure Source Range.gvi"(VISA resource name="")
  call "Enable High Capacitance.gvi"(VISA resource name="")
  call "Enable Source Auto Range.gvi"(VISA resource name="")
  call "Enable Source Read Back.gvi"(VISA resource name="")
  call "Configure Measurement Auto Range Upper Limit.gvi"(VISA resource name="")
  call "Configure Limit Test Upper Limit.gvi"(VISA resource name="")
  call "Configure Math.gvi"()
  call "Configure Measurement Auto Range Lower Limit.gvi"(VISA resource name="")
  call "Configure Trigger Model Digital Output Mode.gvi"(VISA resource name="")
  call "Configure Trigger Model LAN IP Address.gvi"(VISA resource name="")
  call "Configure Trigger Model Digital Input Mode.gvi"(VISA resource name="")
  call "Configure Trigger Model Digital Output Pulse Width.gvi"()
  call "Get High Capacitance State.gvi"(VISA resource name="")
  call "Get Interlock Status.gvi"(VISA resource name="")
  call "Get Source Auto Delay State.gvi"(VISA resource name="")
  call "Get Source Auto Range.gvi"(VISA resource name="")
  call "Configure Measurement Function.gvi"(VISA resource name="")
  call "Configure Measurement Manual Range.gvi"(VISA resource name="USB0::0x05E6::0x2461::04090176::INSTR")
  call "Configure Measurement Range.gvi"(VISA resource name="")
  call "Configure Offset Compensation.gvi"(VISA resource name="")
  call "Configure Trigger Model LAN Output Protocol.gvi"(VISA resource name="")
  call "Configure Trigger Model Measure Block.gvi"(VISA resource name="")
  call "Configure Trigger Model LAN Output Logic Mode.gvi"()
  call "Configure Trigger Model LAN Trigger Mode.gvi"(VISA resource name="")
  call "Get Source Configuration List Catalog.gvi"(VISA resource name="")
  call "Get Source Configuration List Settings.gvi"(VISA resource name="")
  call "Get Source Configuration List Size.gvi"(VISA resource name="")
  call "Get Source Delay.gvi"(VISA resource name="")
  call "Configure Relative Offset.gvi"(VISA resource name="")
  call "Configure Settling Delay.gvi"(VISA resource name="")
  call "Configure Specific Limit Test.gvi"(VISA resource name="")
  call "Configure Unit of Current.gvi"(VISA resource name="")
  call "Configure Trigger Model Once Excluded Block.gvi"(VISA resource name="")
  call "Configure Trigger Model Source Output Block.gvi"()
  call "Configure Trigger Model Once Block.gvi"(VISA resource name="")
  call "Configure Trigger Model Recall Configuration List Block.gvi"()
  call "Get Source Function.gvi"(VISA resource name="")
  call "Get Source Level.gvi"(VISA resource name="")
  call "Get Source Limit.gvi"(VISA resource name="")
  call "Get Source List Points.gvi"(VISA resource name="")
  call "Configure Unit of Voltage.gvi"(VISA resource name="")
  call "Enable Math Operation.gvi"(VISA resource name="")
  call "Enable Measurement Auto Range.gvi"(VISA resource name="")
  call "Get Limit Test Enabled State.gvi"(VISA resource name="")
  call "Get Trigger Model Blender Mode.gvi"(VISA resource name="")
  call "Get Trigger Model Digital Input Mode.gvi"(VISA resource name="")
  call "Configure Trigger Model.gvi"()
  call "Get Trigger Model Blender Overrun Status.gvi"(VISA resource name="")
  call "Get Over Voltage Protection State.gvi"(VISA resource name="")
  call "Get Source Range.gvi"(VISA resource name="")
  call "Get Source User Delay.gvi"(VISA resource name="")
  call "Get Source Read Back State.gvi"(VISA resource name="")
  call "Get Limit Test Lower Limit.gvi"(VISA resource name="")
  call "Get Limit Test Upper Limit.gvi"(VISA resource name="USB0::0x05E6::0x2461::04090176::INSTR")
  call "Get Measure Configuration List Catalog.gvi"(VISA resource name="")
  call "Get Measure Configuration List Settings.gvi"(VISA resource name="")
  call "Get Trigger Model Digital Output Pulse Width.gvi"(VISA resource name="")
  call "Get Trigger Model LAN Input Logic Mode.gvi"(VISA resource name="")
  call "Get Trigger Model Digital Output Mode.gvi"(VISA resource name="")
  call "Get Trigger Model Digital Overrun Status.gvi"(VISA resource name="")
  call "Get Measure Configuration List Size.gvi"(VISA resource name="")
  call "Get Measurement Auto Range Lower Limit.gvi"()
  call "Get Measurement Auto Range.gvi"()
  call "Get Measurement Count.gvi"(VISA resource name="")
  call "Get Trigger Model LAN Mode.gvi"(VISA resource name="")
  call "Get Trigger Model LAN Output Protocol.gvi"()
  call "Get Trigger Model LAN IP Address.gvi"(VISA resource name="")
  call "Get Trigger Model LAN Output Logic Mode.gvi"(VISA resource name="")
  call "Get Measurement Function.gvi"(VISA resource name="")
  call "Get Measurement Manual Range.gvi"()
  call "Get Measure User Delay.gvi"(VISA resource name="")
  call "Set Measurement Count.gvi"(VISA resource name="USB0::0x05E6::0x2461::04090181::INSTR")
  call "Get Trigger Model State.gvi"(VISA resource name="")
  call "Get Trigger Timer Delay.gvi"(VISA resource name="")
  # 2461 Specific VIs
  call "Configure Contact Check.gvi"()
  call "Get Conact Check State.gvi"()
  call "Configure Pulse Limit.gvi"()
  call "Set Pulse Amplitude.gvi"()
  call "Get Trigger Model LAN Overrun Status.gvi"(VISA resource name="")
  call "Get Trigger Timer Count.gvi"(VISA resource name="")
  call "Get All Delay Info.gvi"()
  call "Get Trigger Timer State.gvi"(VISA resource name="")
  call "Configure Pulse Train.gvi"()
  call "Configure Pulse Sweep.gvi"()
  call "Configure Pulse List Sweep.gvi"()
  call "Turn off Delays and Autozero (High Speed).gvi"()
  call "Set Trigger Timer Delay.gvi"(VISA resource name="")
  call "Get Trigger Timer Overrun Status.gvi"(VISA resource name="")
  call "Set Trigger Timer Count.gvi"(VISA resource name="")
  call "Enable LAN Connect State.gvi"(VISA resource name="")
  call "Set Trigger Timer State.gvi"(VISA resource name="")
  call "Get LAN Connect State.gvi"(VISA resource name="")
  call "Digitizer Aperture.gvi"()
  call "Digitizer Voltage Units.gvi"()
  # 2461 Specific VIs
  call "Digitizer Sample Rate.gvi"()
  call "Digitizer Current Units.gvi"()
  # Calibration
  call "Calibrate Adjust Sense Data Query.gvi"()
  call "Calibrate Adjust Sense.gvi"(VISA resource name="GPIB0::24::INSTR", Sense Value=0)
  call "Calibrate Adjust Source Data Query.gvi"()
  call "Calibrate Adjust Source.gvi"(VISA resource name="GPIB0::24::INSTR", Source Value=0)
  call "Calibration Adjust Count Query.gvi"(VISA resource name="GPIB0::24::INSTR")
  call "Calibration Adjust Date Query.gvi"(VISA resource name="GPIB0::24::INSTR")
  call "Calibration Adjust Date.gvi"(VISA resource name="GPIB0::24::INSTR")
  call "Calibration Lock.gvi"(VISA resource name="GPIB0::24::INSTR")
  call "Create Math Operation.gvi"()
  # Utility
  call "Clear Display.gvi"(VISA resource name="")
  call "Set Display Screen.gvi"(VISA resource name="")
  call "Clear System Event Log.gvi"(VISA resource name="")
  call "Calibration Unlock.gvi"(VISA resource name="GPIB0::24::INSTR", Password="")
  call "Calibration Password.gvi"()
  call "Calibration Save.gvi"(VISA resource name="GPIB0::24::INSTR")
  call "Calibration Verify Date.gvi"()
  call "Display Message.gvi"(VISA resource name="")
  call "Enable Questionable Event Register.gvi"(VISA resource name="")
  call "Emit Beep.gvi"(VISA resource name="")
  call "Enable Operation Event Register.gvi"(VISA resource name="")
  call "Clear Buffer.gvi"(VISA resource name="")
  call "Clear Buffer Statistics.gvi"(VISA resource name="")
  call "Delete User Buffer.gvi"(VISA resource name="")
  # Configure, Buffer
  call "Append Buffer to File in the USB.gvi"(VISA resource name="")
  call "Calibration Verify Date Query.gvi"()
  call "Error Query.gvi"(VISA resource name="")
  call "Get Event Id Mapped to Bit Number in Operation Event Register.gvi"(VISA resource name="")
  call "Get Active Terminals.gvi"(VISA resource name="")
  call "Self-Test.gvi"(VISA resource name="")
  call "Get Buffer Size.gvi"(VISA resource name="")
  call "Get Buffer Filling Mode.gvi"(VISA resource name="")
  call "Get Byte Order.gvi"(VISA resource name="")
  call "Create User Buffer.gvi"(VISA resource name="")
  call "Get Event Id Mapped to Bit Number in Questionable Event Register.gvi"(VISA resource name="")
  call "Map Event Id to Bit number in Operation Event Register.gvi"(VISA resource name="")
  call "Get Min-Max Ranges.gvi"(VISA resource name="GPIB0::24::INSTR")
  call "Get Trigger Block List.gvi"(VISA resource name="")
  call "Set Buffer Filling Mode.gvi"(VISA resource name="")
  call "Save Buffer to File in the USB.gvi"()
  call "Set Buffer Size.gvi"(VISA resource name="")
  call "Get Data Format.gvi"(VISA resource name="")
  call "Map Event Id to Bit number in Questionable Event Register.gvi"(VISA resource name="")
  call "Read Operation Event Register Status.gvi"(VISA resource name="")
  call "Preset Status.gvi"(VISA resource name="")
  call "Read Operation Condition Register.gvi"(VISA resource name="")
  call "Configure Byte Order.gvi"(VISA resource name="")
  call "Read Operation Event Register.gvi"(VISA resource name="")
  call "Read Questionable Event Register.gvi"(VISA resource name="")
  call "Read Questionable Condition Register.gvi"(VISA resource name="")
  call "Read Questionable Event Register Status.gvi"(VISA resource name="")
  call "Reset.gvi"(VISA resource name="")
  call "Selected Range Query.gvi"(VISA resource name="GPIB0::24::INSTR")
  call "Revision Query.gvi"(VISA resource name="")
  call "Select Active Terminals.gvi"(VISA resource name="")
