vi "Close.gvi"   [LabVIEW NXG 5.0.0]
# Performs an instrument error query before terminating the software connection to the instrument.
inputs:
  "VISA resource name": "VISA Instr", required
    # A reference to the instrument in use.  The reference to the resource name is created in the Initialize VI.  Therefore, before calling this VI, you need to call the Initialize VI.  To run this VI interactively, select the previously initialized resource name from the pull-down menu.  To run this VI programmatically, wire the VISA resource name out terminal of the Initialize VI to subsequent VISA resource name input terminals.  You chain instrument driver VIs together by wiring the VISA resource name out terminal to subsequent VISA resource name input terminals.
  "error in (no error)": error
outputs:
  "error out": error
uses:
  Labview_NXG_Keithley_SMU_2450_2460_2461::Utility::Error Query.gvi
  NI::VISA::Close (Instr).gvi
diagram:
  # Close Session
  call "Error Query.gvi"(VISA resource name=$"VISA resource name", error in (no error)=$"error in (no error)") -> (VISA resource name out=w1, error out=w2)
  call "Close (Instr).gvi"(session in=w1, error in=w2) -> (error out=w3)
  $"error out" <- w3
