vi "Calibrate Adjust Source.gvi"   [LabVIEW NXG 5.0.0]
# This VI calibrates the source function/range currently configured with the given characerized Source Value.
inputs:
  "VISA resource name": "VISA Instr" = "GPIB0::24::INSTR", required
  "Source Value": f64, required
  "error in (no error)": error
outputs:
  "VISA resource name out": "VISA Instr"
  "error out": error
uses:
  NI::VISA::Write (Instr, String).gvi
  Labview_NXG_Keithley_SMU_2450_2460_2461::Data::Low Level::Wait for Operation Complete.gvi
  Labview_NXG_Keithley_SMU_2450_2460_2461::Utility::Error Query.gvi
diagram:
  case ($"error in (no error)") {
    frame No Error {
      Number To Exponential String(number=$"Source Value") -> (E-format string=w3)
      Concatenate Strings(":CAL:ADJ:SOUR ", w3) -> w4
      call "Write (Instr, String).gvi"(session in=$"VISA resource name", error in=$"error in (no error)", write buffer=w4) -> (session out=w5, error out=w6)
      call "Wait for Operation Complete.gvi"(VISA resource name=w5, error in (no error)=w6) -> (VISA resource name out=w7, error out=w8)
      call "Error Query.gvi"(VISA resource name=w7, error in (no error)=w8) -> (VISA resource name out=w2, error out=w1)
    }
    frame Error {
      # Do nothing if error condition
      w1 = $"error in (no error)"
      w2 = $"VISA resource name"
    }
  }
  $"VISA resource name out" <- w2
  $"error out" <- w1
