vi "Calibration Adjust Count Query.gvi"   [LabVIEW NXG 5.0.0]
# This VI queries calibration adjust count.
inputs:
  "VISA resource name": "VISA Instr" = "GPIB0::24::INSTR", required
  "error in (no error)": error
outputs:
  "VISA resource name out": "VISA Instr"
  "Cal Count": i32
  "error out": error
uses:
  NI::VISA::Write (Instr, String).gvi
  NI::VISA::Read (Instr, String).gvi
  Labview_NXG_Keithley_SMU_2450_2460_2461::Utility::Error Query.gvi
diagram:
  case ($"error in (no error)") {
    frame No Error {
      call "Write (Instr, String).gvi"(session in=$"VISA resource name", error in=$"error in (no error)", write buffer=":CAL:ADJ:COUNT?") -> (session out=w4, error out=w5)
      call "Read (Instr, String).gvi"(session in=w4, error in=w5, byte count=128) -> (session out=w6, error out=w7, read buffer=w8)
      call "Error Query.gvi"(VISA resource name=w6, error in (no error)=w7) -> (VISA resource name out=w2, error out=w1)
      Decimal String To Number(string=w8) -> (number=w3)
    }
    frame Error {
      # Do nothing if error condition
      w1 = $"error in (no error)"
      w2 = $"VISA resource name"
      w3 = 0
    }
  }
  $"VISA resource name out" <- w2
  $"error out" <- w1
  $"Cal Count" <- w3
