vi "Calibration Adjust Date Query.gvi"   [LabVIEW NXG 5.0.0]
# This VI queries calibration adjust date.
inputs:
  "VISA resource name": "VISA Instr" = "GPIB0::24::INSTR", required
  "error in (no error)": error
outputs:
  "VISA resource name out": "VISA Instr"
  "Cal Date": string
  "error out": error
uses:
  NI::VISA::Write (Instr, String).gvi
  NI::VISA::Read (Instr, String).gvi
  Labview_NXG_Keithley_SMU_2450_2460_2461::Utility::Error Query.gvi
diagram:
  case ($"error in (no error)") {
    frame No Error {
      call "Write (Instr, String).gvi"(session in=$"VISA resource name", error in=$"error in (no error)", write buffer=":CAL:ADJ:DATE?") -> (session out=w4, error out=w5)
      call "Read (Instr, String).gvi"(session in=w4, error in=w5, byte count=128) -> (session out=w6, error out=w7, read buffer=w3)
      call "Error Query.gvi"(VISA resource name=w6, error in (no error)=w7) -> (VISA resource name out=w2, error out=w1)
    }
    frame Error {
      # Do nothing if error condition
      w1 = $"error in (no error)"
      w2 = $"VISA resource name"
      w3 = ""
    }
  }
  $"VISA resource name out" <- w2
  $"error out" <- w1
  $"Cal Date" <- w3
