vi "Calibration Adjust Date.gvi"   [LabVIEW NXG 5.0.0]
# This VI sets calibration adjust date.
inputs:
  "VISA resource name": "VISA Instr" = "GPIB0::24::INSTR", required
  "Date Override (yyyy,mm,dd)": string
  "error in (no error)": error
outputs:
  "VISA resource name out": "VISA Instr"
  "error out": error
uses:
  NI::VISA::Write (Instr, String).gvi
  Labview_NXG_Keithley_SMU_2450_2460_2461::Utility::Error Query.gvi
diagram:
  case ($"error in (no error)") {
    frame No Error {
      # Override system date if date override is not blank
      Is Not Equal(x=$"Date Override (yyyy,mm,dd)", y="") -> w3
      Get Current Time() -> (current time=w4)
      # Get system date and format it into
      # YYYY,MM,DD
      Format Date Time String(time format string (%c)="%Y,%m,%d", time stamp=w4) -> (date/time string=w5)
      Select(s=w3, t=$"Date Override (yyyy,mm,dd)", f=w5) -> w6
      Concatenate Strings(":CAL:ADJ:DATE ", w6) -> w7
      call "Write (Instr, String).gvi"(session in=$"VISA resource name", error in=$"error in (no error)", write buffer=w7) -> (session out=w8, error out=w9)
      call "Error Query.gvi"(VISA resource name=w8, error in (no error)=w9) -> (VISA resource name out=w2, error out=w1)
    }
    frame Error {
      # Do nothing if error condition
      w1 = $"error in (no error)"
      w2 = $"VISA resource name"
    }
  }
  $"VISA resource name out" <- w2
  $"error out" <- w1
