vi "Calibration Password.gvi"   [LabVIEW NXG 5.0.0]
# This VI changes the password used for calibration.
inputs:
  "VISA resource name": "VISA Instr" = "GPIB0::24::INSTR"
  "Password": string  # This is the new password that will be used to unlock an instrument for calibration.
  "error in (no error)": error
outputs:
  "VISA resource name out": "VISA Instr"
  "error out": error
uses:
  NI::VISA::Write (Instr, String).gvi
  Labview_NXG_Keithley_SMU_2450_2460_2461::Utility::Error Query.gvi
diagram:
  case ($"error in (no error)") {
    frame No Error {
      Concatenate Strings(":CAL:PASS '", $Password, "'") -> w3
      call "Write (Instr, String).gvi"(session in=$"VISA resource name", error in=$"error in (no error)", write buffer=w3) -> (session out=w4, error out=w5)
      call "Error Query.gvi"(VISA resource name=w4, error in (no error)=w5) -> (VISA resource name out=w2, error out=w1)
    }
    frame Error {
      # Do nothing if error condition
      w1 = $"error in (no error)"
      w2 = $"VISA resource name"
    }
  }
  $"VISA resource name out" <- w2
  $"error out" <- w1
