vi "Calibration Save.gvi"   [LabVIEW NXG 5.0.0]
# This VI saves calibration data to EEPROM.
inputs:
  "VISA resource name": "VISA Instr" = "GPIB0::24::INSTR", required
  "error in (no error)": error
outputs:
  "VISA resource name out": "VISA Instr"
  "error out": error
uses:
  NI::VISA::Write (Instr, String).gvi
  Labview_NXG_Keithley_SMU_2450_2460_2461::Utility::Error Query.gvi
diagram:
  case ($"error in (no error)") {
    frame No Error {
      call "Write (Instr, String).gvi"(session in=$"VISA resource name", error in=$"error in (no error)", write buffer=":CAL:SAVE") -> (session out=w3, error out=w4)
      call "Error Query.gvi"(VISA resource name=w3, error in (no error)=w4) -> (VISA resource name out=w2, error out=w1)
    }
    frame Error {
      # Do nothing if error condition
      w1 = $"error in (no error)"
      w2 = $"VISA resource name"
    }
  }
  $"VISA resource name out" <- w2
  $"error out" <- w1
