vi "Create Math Operation.gvi"   [LabVIEW NXG 5.0.0]
# Creates a custom math operation that can then be used with Configure Math.
inputs:
  "Percent Value (1)": f64 = 1
  "VISA resource name": "VISA Instr"
    # A reference to the instrument in use.  The reference to the resource name is created in the Initialize VI.  Therefore, before calling this VI, you need to call the Initialize VI.  To run this VI interactively, select the previously initialized resource name from the pull-down menu.  To run this VI programmatically, wire the VISA resource name out terminal of the Initialize VI to subsequent VISA resource name input terminals.  You chain instrument driver VIs together by wiring the VISA resource name out terminal to subsequent VISA resource name input terminals.
  "Function (0: Volts)": u16 = "Volts"(0)  # The function which is to be measured. Note: Voltage, Current, and Resistance measurements are always taken regardless of any VI calls. The Digitize Voltage and Digitize Current functions are only compatible with the 2461.
  "Math Operation (1: Percent)": u16 = "Percent"(1)  # The name of the math operation: • y = mx+b: MXB • Percent: PERCent • Reciprocal: RECiprocal
  "M Value (0)": f64  # Specifies the scale factor for the y = mx + b math operation.
  "B Value (1)": f64 = 1  # Specifies the offset for the y = mx + b operation.
  "error in (no error)": error
outputs:
  "VISA resource name out": "VISA Instr"  # A copy of the reference to the instrument in use. The reference to the resource name is created in the Initialize VI. Wire the VISA resource name out terminal of the Initialize VI to subsequent VISA resource name input terminals. You chain instrument driver VIs together by wiring the VISA resource name out terminal to subsequent VISA resource name input terminals.
  "error out": error
uses:
  NI::VISA::Write (Instr, String).gvi
  Labview_NXG_Keithley_SMU_2450_2460_2461::Utility::Error Query.gvi
diagram:
  w1 = "VOLT\nCURR\nRES\nDIG:VOLT\nDIG:CURR"  # Function
  Pick Line(line index=$"Function (0: Volts)", multi-line string=w1) -> (output string=w2)
  # :CALCulate[1]:func:MATH:FORMat <name>
  # :CALCulate[1]:func:MATH:MMFactor <n>
  # :CALCulate[1]:func:MATH:MBFactor <n>
  # :CALCulate[1]:func:MATH:PERCent <n>
  Pick Line(line index=$"Math Operation (1: Percent)", multi-line string="MXB\nPERC\nREC") -> (output string=w3)
  Format Into String(formatString=":CALC1:%s:MATH:FORM %s;", w2, w3) -> w4
  case ($"Math Operation (1: Percent)") {
    frame 1, Default {
      Format Into String(formatString=":CALC:%s:MATH:PERC %g;", initString=w4, w2, $"Percent Value (1)") -> w5
    }
    frame 2 {
      w5 = w4
    }
    frame 0 {
      Format Into String(formatString=":CALC:%s:MATH:MMF %g;:CALC:%s:MATH:MBF %g;", initString=w4, w2, $"M Value (0)", w2, $"B Value (1)") -> w5
    }
  }
  call "Write (Instr, String).gvi"(session in=$"VISA resource name", error in=$"error in (no error)", write buffer=w5) -> (session out=w6, error out=w7)
  call "Error Query.gvi"(VISA resource name=w6, error in (no error)=w7) -> (VISA resource name out=w8, error out=w9)
  $"VISA resource name out" <- w8
  $"error out" <- w9
