vi "Display Message.gvi"   [LabVIEW NXG 5.0.0]
# Displays a message on the instrument's User display.
inputs:
  "Enable Lower Message (T: Enable)": bool = TRUE  # Enables the message on the lower half of the screen.
  "VISA resource name": "VISA Instr", required
    # A reference to the instrument in use.  The reference to the resource name is created in the Initialize VI.  Therefore, before calling this VI, you need to call the Initialize VI.  To run this VI interactively, select the previously initialized resource name from the pull-down menu.  To run this VI programmatically, wire the VISA resource name out terminal of the Initialize VI to subsequent VISA resource name input terminals.  You chain instrument driver VIs together by wiring the VISA resource name out terminal to subsequent VISA resource name input terminals.
  "Upper Message (\"Default\")": string = "Default"  # The message to display on the upper half of the display.
  "Lower Message (\"Message\")": string = "Message"  # The message to display on the lower half of the screen.
  "error in (no error)": error
  "Enable Upper Message (T: Enable)": bool = TRUE  # Enables the message on the upper half of the screen.
outputs:
  "VISA resource name out": "VISA Instr"  # A copy of the reference to the instrument in use. The reference to the resource name is created in the Initialize VI. Wire the VISA resource name out terminal of the Initialize VI to subsequent VISA resource name input terminals. You chain instrument driver VIs together by wiring the VISA resource name out terminal to subsequent VISA resource name input terminals.
  "error out": error
uses:
  NI::VISA::Write (Instr, String).gvi
  Labview_NXG_Keithley_SMU_2450_2460_2461::Utility::Error Query.gvi
diagram:
  # :DISPlay:USER1:TEXT[:DATA] <textMessage>
  # :DISPlay:USER2:TEXT[:DATA] <textMessage>
  case ($"Enable Upper Message (T: Enable)") {
    frame False, Default {
      w1 = ""
    }
    frame True {
      Format Into String(formatString=":DISP:USER1:TEXT \"%s\";", $"Upper Message (\"Default\")") -> w1
    }
  }
  case ($"Enable Lower Message (T: Enable)") {
    frame False, Default {
      w2 = ""
    }
    frame True {
      Format Into String(formatString=":DISP:USER2:TEXT \"%s\";", $"Lower Message (\"Message\")") -> w2
    }
  }
  Concatenate Strings(w1, w2) -> w3
  call "Write (Instr, String).gvi"(session in=$"VISA resource name", error in=$"error in (no error)", write buffer=w3) -> (session out=w4, error out=w5)
  call "Error Query.gvi"(VISA resource name=w4, error in (no error)=w5) -> (VISA resource name out=w6, error out=w7)
  $"VISA resource name out" <- w6
  $"error out" <- w7
