vi "Get Event Id Mapped to Bit Number in Operation Event Register.gvi"   [LabVIEW NXG 5.0.0]
# This gets Set Event Id and Clear Event Id Mapped to Bit Number in Operation Event Register.
inputs:
  "VISA resource name": "VISA Instr", required
    # A reference to the instrument in use.  The reference to the resource name is created in the Initialize VI.  Therefore, before calling this VI, you need to call the Initialize VI.  To run this VI interactively, select the previously initialized resource name from the pull-down menu.  To run this VI programmatically, wire the VISA resource name out terminal of the Initialize VI to subsequent VISA resource name input terminals.  You chain instrument driver VIs together by wiring the VISA resource name out terminal to subsequent VISA resource name input terminals.
  "Bit Number": i32  # The bit number to check.
  "error in (no error)": error
outputs:
  "VISA resource name out": "VISA Instr"  # A copy of the reference to the instrument in use. The reference to the resource name is created in the Initialize VI. Wire the VISA resource name out terminal of the Initialize VI to subsequent VISA resource name input terminals. You chain instrument driver VIs together by wiring the VISA resource name out terminal to subsequent VISA resource name input terminals.
  "Set Event": i32  # The event number mapped to set this bit; 0 if no mapping.
  "Clear Event": i32  # The event number mapped to clear this bit; 0 if no mapping.
  "error out": error
uses:
  NI::VISA::Write (Instr, String).gvi
  NI::VISA::Read (Instr, String).gvi
  Labview_NXG_Keithley_SMU_2450_2460_2461::Utility::Error Query.gvi
diagram:
  Format Into String(formatString=":STAT:OPER:MAP? %d", $"Bit Number") -> w1
  call "Write (Instr, String).gvi"(session in=$"VISA resource name", error in=$"error in (no error)", write buffer=w1) -> (session out=w2, error out=w3)
  call "Read (Instr, String).gvi"(session in=w2, error in=w3, byte count=128) -> (session out=w4, error out=w5, read buffer=w6)
  Match Pattern(regular expression=",", string=w6) -> (after substring=w7, before substring=w8)
  Decimal String To Number(string=w8) -> (number=w9)
  $"Set Event" <- w9
  Decimal String To Number(string=w7) -> (number=w10)
  $"Clear Event" <- w10
  call "Error Query.gvi"(VISA resource name=w4, error in (no error)=w5) -> (VISA resource name out=w11, error out=w12)
  $"VISA resource name out" <- w11
  $"error out" <- w12
