vi "Get Min-Max Ranges.gvi"   [LabVIEW NXG 5.0.0]
# This VI query returns the min and max voltage and current ranges on 2450/2460 SMU.
inputs:
  "VISA resource name": "VISA Instr" = "GPIB0::24::INSTR", required
  "error in (no error)": error
outputs:
  "I Min": f64  # Current Function Min Range.
  "VISA resource name out": "VISA Instr"  # A copy of the reference to the instrument in use. The reference to the resource name is created in the Initialize VI. Wire the VISA resource name out terminal of the Initialize VI to subsequent VISA resource name input terminals. You chain instrument driver VIs together by wiring the VISA resource name out terminal to subsequent VISA resource name input terminals.
  "V Max": f64  # Voltage Function Max Range.
  "I Max": f64  # Current Function Max Range.
  "error out": error
  "V Min": f64  # Voltage Function Min Range.
uses:
  Labview_NXG_Keithley_SMU_2450_2460_2461::Action Status::Enable Output.gvi
  NI::VISA::Write (Instr, String).gvi
  NI::VISA::Read (Instr, String).gvi
  Labview_NXG_Keithley_SMU_2450_2460_2461::Utility::Error Query.gvi
diagram:
  case ($"error in (no error)") {
    frame No Error {
      # SCPI 2450
      # SCPI 2450
      # SCPI 2450
      call "Enable Output.gvi"(VISA resource name=$"VISA resource name", Enable Output (T: Enable)=FALSE, error in (no error)=$"error in (no error)") -> (VISA resource name out=w7, error out=w8)
      call "Write (Instr, String).gvi"(session in=w7, error in=w8, write buffer=":SOUR:VOLT:RANG? MIN;") -> (session out=w9, error out=w10)
      call "Read (Instr, String).gvi"(session in=w9, error in=w10, byte count=128) -> (session out=w11, error out=w12, read buffer=w13)
      call "Write (Instr, String).gvi"(session in=w11, error in=w12, write buffer=":SOUR:CURR:RANG? MIN;") -> (session out=w14, error out=w15)
      call "Read (Instr, String).gvi"(session in=w14, error in=w15, byte count=128) -> (session out=w16, error out=w17, read buffer=w18)
      call "Write (Instr, String).gvi"(session in=w16, error in=w17, write buffer=":SOUR:VOLT:RANG? MAX") -> (session out=w19, error out=w20)
      call "Read (Instr, String).gvi"(session in=w19, error in=w20, byte count=128) -> (session out=w21, error out=w22, read buffer=w23)
      Floating Point String To Number(default (0 DBL)=0, string=w23) -> (number=w3)
      # SCPI 2450
      call "Write (Instr, String).gvi"(session in=w21, error in=w22, write buffer=":SOUR:CURR:RANG? MAX") -> (session out=w24, error out=w25)
      call "Read (Instr, String).gvi"(session in=w24, error in=w25, byte count=128) -> (session out=w26, error out=w27, read buffer=w28)
      Floating Point String To Number(default (0 DBL)=0, string=w28) -> (number=w5)
      Floating Point String To Number(default (0 DBL)=0, string=w13) -> (number=w4)
      Floating Point String To Number(default (0 DBL)=0, string=w18) -> (number=w6)
      call "Write (Instr, String).gvi"(session in=w26, error in=w27, write buffer="*RST") -> (session out=w29, error out=w30)
      call "Error Query.gvi"(VISA resource name=w29, error in (no error)=w30) -> (VISA resource name out=w2, error out=w1)
    }
    frame Error {
      # Do nothing if error condition
      w1 = $"error in (no error)"
      w2 = $"VISA resource name"
      w3 = 0
      w4 = 0
      w5 = 0
      w6 = 0
    }
  }
  $"V Max" <- w3
  $"I Max" <- w5
  $"V Min" <- w4
  $"I Min" <- w6
  $"VISA resource name out" <- w2
  $"error out" <- w1
