vi "Revision Query.gvi"   [LabVIEW NXG 5.0.0]
# Queries the current instrument firmware revision and instrument driver revision.
# Refer to the Readme file for detailed driver information including modification history.
inputs:
  "Error In": error
  "VISA resource name": "VISA Instr", required
    # A reference to the instrument in use.  The reference to the resource name is created in the Initialize VI.  Therefore, before calling this VI, you need to call the Initialize VI.  To run this VI interactively, select the previously initialized resource name from the pull-down menu.  To run this VI programmatically, wire the VISA resource name out terminal of the Initialize VI to subsequent VISA resource name input terminals.  You chain instrument driver VIs together by wiring the VISA resource name out terminal to subsequent VISA resource name input terminals.
outputs:
  "VISA resource name out": "VISA Instr"  # A copy of the reference to the instrument in use. The reference to the resource name is created in the Initialize VI. Wire the VISA resource name out terminal of the Initialize VI to subsequent VISA resource name input terminals. You chain instrument driver VIs together by wiring the VISA resource name out terminal to subsequent VISA resource name input terminals.
  "Instrument Driver Revision": string  # Returns the instrument driver software revision in the form of a string.
  "Instrument Firmware Revision": string  # Returns the instrument firmware revision numbers in the form of a string. This version and its capabilities are set by the instrument manufacturer.
  "error out": error
uses:
  NI::VISA::Write (Instr, String).gvi
  NI::VISA::Read (Instr, String).gvi
  Labview_NXG_Keithley_SMU_2450_2460_2461::Utility::Error Query.gvi
diagram:
  w1 = 100  # Bytes to Read
  w2 = "*IDN?"  # Revision Query Command
  call "Write (Instr, String).gvi"(session in=$"VISA resource name", error in=$"Error In", write buffer=w2) -> (session out=w3, error out=w4)
  call "Read (Instr, String).gvi"(session in=w3, error in=w4, byte count=w1) -> (session out=w5, error out=w6, read buffer=w7)
  call "Error Query.gvi"(VISA resource name=w5, error in (no error)=w6) -> (VISA resource name out=w8, error out=w9)
  $"VISA resource name out" <- w8
  $"error out" <- w9
  Scan From String(formatString="%[^,], %[^,], %[^,],%[^\\r\\n]", inputString=w7) -> (out3=w10)
  $"Instrument Firmware Revision" <- w10
  $"Instrument Driver Revision" <- "1.0.1"
