vi "Selected Range Query.gvi"   [LabVIEW NXG 5.0.0]
# This VI returns the active range for the selected function on the 2450 SMU.
inputs:
  "VISA resource name": "VISA Instr" = "GPIB0::24::INSTR", required
    # A reference to the instrument in use.  The reference to the resource name is created in the Initialize VI.  Therefore, before calling this VI, you need to call the Initialize VI.  To run this VI interactively, select the previously initialized resource name from the pull-down menu.  To run this VI programmatically, wire the VISA resource name out terminal of the Initialize VI to subsequent VISA resource name input terminals.  You chain instrument driver VIs together by wiring the VISA resource name out terminal to subsequent VISA resource name input terminals.
  "Function": string = "VOLT"  # The source function to which this setting applies: • Current • Voltage
  "error in (no error)": error
outputs:
  "VISA resource name out": "VISA Instr"  # A copy of the reference to the instrument in use. The reference to the resource name is created in the Initialize VI. Wire the VISA resource name out terminal of the Initialize VI to subsequent VISA resource name input terminals. You chain instrument driver VIs together by wiring the VISA resource name out terminal to subsequent VISA resource name input terminals.
  "Selected Range": f64  # Set to the maximum expected voltage or current to be sourced; the ranges are: • Current: -1 A to 1 A • Voltage: -200 V to 200 V
  "error out": error
uses:
  NI::VISA::Write (Instr, String).gvi
  NI::VISA::Read (Instr, String).gvi
  Labview_NXG_Keithley_SMU_2450_2460_2461::Utility::Error Query.gvi
diagram:
  case ($"error in (no error)") {
    frame No Error {
      Concatenate Strings(":SOUR:", $Function, ":RANG?") -> w4
      call "Write (Instr, String).gvi"(session in=$"VISA resource name", error in=$"error in (no error)", write buffer=w4) -> (session out=w5, error out=w6)
      call "Read (Instr, String).gvi"(session in=w5, error in=w6, byte count=128) -> (session out=w7, error out=w8, read buffer=w9)
      Floating Point String To Number(default (0 DBL)=0, string=w9) -> (number=w3)
      call "Error Query.gvi"(VISA resource name=w7, error in (no error)=w8) -> (VISA resource name out=w2, error out=w1)
    }
    frame Error {
      # Do nothing if error condition
      w1 = $"error in (no error)"
      w2 = $"VISA resource name"
      w3 = 0
    }
  }
  $"Selected Range" <- w3
  $"VISA resource name out" <- w2
  $"error out" <- w1
