vi "Self-Test.gvi"   [LabVIEW NXG 5.0.0]
# Runs the instrument's self-test routine and returns the test results.
inputs:
  "VISA resource name": "VISA Instr", required
    # A reference to the instrument in use.  The reference to the resource name is created in the Initialize VI.  Therefore, before calling this VI, you need to call the Initialize VI.  To run this VI interactively, select the previously initialized resource name from the pull-down menu.  To run this VI programmatically, wire the VISA resource name out terminal of the Initialize VI to subsequent VISA resource name input terminals.  You chain instrument driver VIs together by wiring the VISA resource name out terminal to subsequent VISA resource name input terminals.
  "error in (no error)": error
outputs:
  "VISA resource name out": "VISA Instr"  # A copy of the reference to the instrument in use. The reference to the resource name is created in the Initialize VI. Wire the VISA resource name out terminal of the Initialize VI to subsequent VISA resource name input terminals. You chain instrument driver VIs together by wiring the VISA resource name out terminal to subsequent VISA resource name input terminals.
  "Self-Test Result Code": i32  # Contains the value returned from the instrument self test. Zero means success. For any other code, see the instrument's operation manual.
  "Self-Test Result Message": string  # Returns the self-test response string from the instrument. See the instrument's operation manual for an explanation of the string's contents.
  "error out": error
uses:
  NI::VISA::Write (Instr, String).gvi
  NI::VISA::Read (Instr, String).gvi
  NI::G Core::Error::Legacy::Error Cluster From Error Code.gvi
  Labview_NXG_Keithley_SMU_2450_2460_2461::Utility::Error Query.gvi
diagram:
  w1 = 20000  # Timeout
  Property Node(instance in=$"VISA resource name", "Timeout"=w1, error in=$"error in (no error)") -> ("Timeout"=w2, error out=w3, instance out=w4)
  w5 = "*TST?"  # Self-Test Command
  call "Write (Instr, String).gvi"(session in=w4, error in=w3, write buffer=w5) -> (session out=w6, error out=w7)
  call "Read (Instr, String).gvi"(session in=w6, error in=w7, byte count=20) -> (session out=w8, error out=w9, read buffer=w10)
  Property Node(instance in=w8, "Timeout"=w2, error in=w9) -> (error out=w11, instance out=w12)
  Property Node(instance in=w11) -> ("status"=w13)
  Scan From String(formatString="%d", inputString=w10) -> (out0=w14)
  Is Not Equal(x=w14, y=0) -> w15
  Logical And(not w13, w15) -> w16
  case (w16) {
    frame False, Default {
      w17 = w11
      w18 = w12
    }
    frame True {
      call "Error Cluster From Error Code.gvi"(error code=-1074000001, error message="The self-test failed.", show call chain?=TRUE) -> (error out=w17)
      w18 = w12
    }
  }
  call "Error Query.gvi"(VISA resource name=w18, error in (no error)=w17) -> (VISA resource name out=w19, error out=w20)
  $"VISA resource name out" <- w19
  $"error out" <- w20
  Scan From String(formatString="%[^\\r\\n]", inputString=w10) -> (out0=w21)
  $"Self-Test Result Message" <- w21
  $"Self-Test Result Code" <- w14
